# Grasshopper definition tool_part1_ v7.1_0.gh (Grasshopper 0.9.76)
# plug-ins: Python Interpreter, Human, FalseStartToggle, MetaHopper, TT Toolbox

honeybee = Honeybee_Honeybee()  # -> Vviiiiiiiiiizzz; plug-in component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
honeybee_2 = Honeybee_Honeybee()  # -> Vviiiiiiiiiizzz; plug-in component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
ladybug = Ladybug_Ladybug()  # -> Vviiiiiiiiiizzz; plug-in component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
ladybug_2 = Ladybug_Ladybug()  # -> Vviiiiiiiiiizzz; plug-in component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
number_slider = Slider(10, range=0..10)
floors_above_ground = Panel("2")
floors_below_ground = Panel("1")
floors_above_ground_num = Number(floors_above_ground)
floors_below_ground_num = Number(floors_below_ground)
python = PythonScript(ag=floors_above_ground_num, ug=floors_below_ground_num)  # -> a; inputs ag: Int32, ug: Int32
# ---------- python: Python ----------
a = []
v = -(ug)
for i in range(ug):
    a.append(v)
    v=v+1

for j in range(ag):
    a.append(j)
# ---------- end python ----------
bnd = Bounds(Numbers=python)
dedomain = DeconstructDomain(Domain=bnd)  # -> Start, End
start_domain_floors_num = Data(dedomain.Start)
start_domain_floors_num_2 = Data(0)

# ---- group: total number of floors
floors_above_ground_num_2 = Number(floors_above_ground_num)
floors_below_ground_num_2 = Number(floors_below_ground_num)
addition = Addition(A=floors_above_ground_num_2, B=floors_below_ground_num_2)

# ----
start_domain_floors_num_3 = Data(start_domain_floors_num)
series = Series(Start=start_domain_floors_num_3, Step=1, Count=addition)
default_floor_height = Panel("3.5")

# ---- group: enter heights and levels
level = Panel(series)
floor_heights = Panel("""3
3
3
4.1
3.72
3.72
3.72
3.72
3.72
3.72
3.72""")
elevations = Panel("""0
3
6
9
13.1
16.82
20.54
24.26
27.98
31.7
35.42""")

# ----
dup = DuplicateData(Data=default_floor_height, Number=addition, Order=True)  # -> flatten(Data)
multiplication = Multiplication(A=series, B=default_floor_height)
vertical_shade = Panel("""Reflectance          
Roughness           
Specularity          """)
data = Data(flatten(multiplication))
data_2 = Data(flatten(dup))
f2 = Panel("""2.95
0.5
0.31
1.57""")
# window properties: Sill Level
# Window Height
# VLT Value
# Refractive Index
f1 = Panel("""0.1
0.4
0.31
1.56""")
f3 = Panel("""0.1
3.3
0.71
1.52""")
# window properties: Sill Level
# Window Height
# VLT Value
# Refractive Index
f2_2 = Panel("""0.1
3.3
0.71
1.57""")
# window properties: Sill Level
# Window Height
# VLT Value
# Refractive Index
f1_2 = Panel("""0.55
2.35
0.61
1.56""")
# window properties: Sill Level
# Window Height
# VLT Value
# Refractive Index
f3_2 = Panel("""0.1
3.3
0.99
1""")
cennect_this_for_default = Panel(data)
connect_this_for_default = Panel(data_2)
shade_type_2 = Panel("""0.1
3.25
0.5""")
# window properties: Sill Level
# Window Height
# VLT Value
# Refractive Index
f1_3 = Panel("""0.1
0.4
0.31
1.56""")
# window properties: Sill Level
# Window Height
# VLT Value
# Refractive Index
f2_4 = Panel("""0.1
3.3
0.71
1.57""")
# window properties: Sill Level
# Window Height
# VLT Value
# Refractive Index
f1_4 = Panel("""0.55
2.35
0.61
1.56""")
# window properties: Sill Level
# Window Height
# VLT Value
# Refractive Index
f3_4 = Panel("""0.1
3.3
0.99
1""")
shade_type_2_2 = Panel("""0.1
3.25
0.5""")
# horizontal shade: Height from floor
# Thickness
# Reflectance
# Roughness
# Specularity
shade_type_1 = Panel("""2.8
0.25
0.6
0.05
0""")
# horizontal shade: Height from floor
# Thickness
# Reflectance
# Roughness
# Specularity
shade_type_1_2 = Panel("""2.8
0.25
0.6
0.05
0""")
# horizontal shade: Height from floor
# Thickness
# Reflectance
# Roughness
# Specularity
shade_type_1_3 = Panel("""2.8
0.25
0.6
0.05
0""")
merge = Merge(Data1=f1_2, Data2=f2_2, Data3=f3_2)  # -> simplify(graft(Result))

# ---- group: FloorHeight
data_3 = Data(graft(connect_this_for_default))

# ---- group: Level_Elevation
data_4 = Data(graft(cennect_this_for_default))

# ----
int = Integer(series)
window_types = Data(merge)
merge_2 = Merge(Data1=shade_type_2, Data2=shade_type_2_2)  # -> simplify(graft(Result))
merge_3 = Merge(Data1=f1_4, Data2=f2_4)  # -> simplify(graft(Result))
merge_4 = Merge(Data1=shade_type_1, Data2=shade_type_1_2)  # -> simplify(graft(Result))
h_shade_type = Data(merge_2)
h_shade_type_2 = Data(merge_4)
interior_window_types = Data(merge_3)

floor_level = Data(data_4)
level_serese = Integer(int)
window_types_2 = Data(window_types)
floor_heights_2 = Data(data_3)
window_types_3 = Data(window_types_2)
level_serese_2 = Integer(level_serese)
lng = ListLength(List=flatten(window_types_3))
number_of_windows = Number(expr("x/4", lng))
number_of_windows_2 = Number(number_of_windows)
int_2 = Integer(number_of_windows_2)
series_2 = Series(Start=1, Step=1, Count=int_2)
int_3 = Integer(series_2)
concat = Concatenate(
    FragmentA="lvl",
    FragmentB=" ",
    FragmentA_2=graft(level_serese_2),
    FragmentA_3=" ",
    FragmentA_4="win_type",
    FragmentB_2=" ",
    FragmentA_5=int_3)  # -> simplify(Result)
dpipeline = DynamicGeometryPipeline(
    LayerFilter=concat,
    TypeFilter="Curve",
    NameFilter="*",
    enableFullPath=False,
    GroupByLayer=False,
    GroupByType=False,
    IncludeHidden=True,
    IncludeLocked=True,
    listenToAttributes=True)  # -> simplify(GeometryOut)
floor_heights_3 = Data(floor_heights_2)
window_types_4 = Data(window_types_2)
path_mapper = PathMapper(window_types_4, source="{a}(i)", target="{0;floor(a/4)}")
flip = FlipMatrix(Data=path_mapper)
floor_level_2 = Data(floor_level)
window_data = ExplodeTree(Data=flip)  # -> Branch0, Branch1, flatten(Branch2), flatten(Branch3)
number_of_windows_3 = Number(number_of_windows)
number_of_windows_4 = Number(number_of_windows)
Z = UnitZ(Factor=floor_level_2)
path_mapper_2 = PathMapper(window_data.Branch1, source="{0;1}", target="{0}")
path_mapper_3 = PathMapper(window_data.Branch0, source="{0;1}", target="{0}")
int_4 = Integer(number_of_windows_3)
dup_2 = DuplicateData(Data=Z, Number=number_of_windows_4, Order=True)  # -> simplify(graft(Data))
windows = Curve(dpipeline)
series_3 = Series(Start=1, Step=1, Count=number_of_windows_3)
data_5 = Data(graft(path_mapper_2))
data_6 = Data(graft(path_mapper_3))
int_5 = Integer(series_3)
move = Move(Geometry=windows, Motion=dup_2)  # -> Geometry, Transform
concat_2 = Concatenate(FragmentA="winType", FragmentB=int_5)
data_7 = Data(window_data.Branch3)
data_8 = Data(window_data.Branch2)
radglassmaterial = Honeybee_RadianceGlassMaterial(materialName=concat_2, RTransmittance=data_8, GTransmittance=data_8, BTransmittance=data_8, refractiveIndex=data_7)  # -> avrgTrans, RADMaterial; plug-in component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
level_serese_3 = Integer(level_serese)
flip_2 = FlipMatrix(Data=radglassmaterial.RADMaterial)
lng_2 = ListLength(List=level_serese_3)
dup_3 = DuplicateData(Data=data_5, Number=flatten(lng_2), Order=True)
dup_4 = DuplicateData(Data=data_6, Number=flatten(lng_2), Order=True)
flip_3 = FlipMatrix(Data=dup_3)
flip_4 = FlipMatrix(Data=dup_4)
path_mapper_4 = PathMapper(flip_3, source="{A;B;C}(i)", target="{B;(i)}")
path_mapper_5 = PathMapper(flip_4, source="{A;B;C}(i)", target="{B;(i)}")
dup_5 = DuplicateData(Data=flip_2, Number=lng_2, Order=True)
Z_2 = UnitZ(Factor=path_mapper_5)  # -> graft(UnitVector)
Z_3 = UnitZ(Factor=path_mapper_4)  # -> graft(UnitVector)
extr = Extrude(Base=move.Geometry, Direction=Z_3)
flip_5 = FlipMatrix(Data=dup_5)  # -> simplify(graft(Data))
move_2 = Move(Geometry=extr, Motion=Z_2)  # -> Geometry, Transform
lng_3 = ListLength(List=int_3)
clean = CleanTree(RemoveNulls=True, RemoveInvalid=True, RemoveEmpty=False, Tree=move_2.Geometry)
larger = LargerThan(FirstNumber=lng_3, SecondNumber=1)  # -> LargerThan, OrEqualTo
gate = StreamGate(Stream=clean, Gate=larger.LargerThan)  # -> Target0, Target1
path_mapper_6 = PathMapper(gate.Target0, source="{A;B;C}", target="{C;B}")
path_mapper_7 = PathMapper(gate.Target1, source="{A;B;C}", target="{A;B}")
filter = StreamFilter(Gate=larger.LargerThan, Stream0=path_mapper_6, Stream1=path_mapper_7)
lng_4 = ListLength(List=filter)
dup_6 = DuplicateData(Data=flip_5, Number=lng_4, Order=True)
path_mapper_8 = PathMapper(dup_6, source="{A;B;C}", target="{A;B}")

floor_heights_4 = Data(data_3)
floor_level_3 = Data(data_4)
level_serese_4 = Integer(int)
level_serese_5 = Integer(level_serese_4)
concat_3 = Concatenate(FragmentA="lvl", FragmentA_2=" ", FragmentA_3=level_serese_5, FragmentA_4=" ", FragmentB="irregular")
dpipeline_2 = DynamicGeometryPipeline(
    LayerFilter=concat_3,
    TypeFilter="Curve",
    NameFilter="*",
    enableFullPath=False,
    GroupByLayer=False,
    GroupByType=False,
    IncludeHidden=True,
    IncludeLocked=True,
    listenToAttributes=True)  # -> simplify(GeometryOut)
floor_heights_5 = Data(floor_heights_4)
floor_level_4 = Data(floor_level_3)
irregular = Curve(dpipeline_2)
Z_4 = UnitZ(Factor=floor_level_4)
move_3 = Move(Geometry=irregular, Motion=Z_4)  # -> Geometry, Transform
Z_5 = UnitZ(Factor=floor_heights_5)
boundary = BoundarySurfaces(Edges=move_3.Geometry)
irregular_2 = Extrude(Base=boundary, Direction=Z_5)

panel = Panel("""0.4
0.05
0.0""")
wallmaterialname = Panel("context_mat")
item = ListItem(List=panel, Index=0, Wrap=True)  # -> Item, Item1, Item2
geometry_pipeline = GeometryPipeline(
    GroupByLayer=False,
    GroupByType=False,
    IncludeHidden=True,
    IncludeLocked=True,
    LayerFilter="context",
    NameFilter="*",
    TypeFilter=1073741848)
radopaquematerial = Honeybee_RadianceOpaqueMaterial(
    materialName=wallmaterialname,
    RReflectance=item.Item,
    GReflectance=item.Item,
    BReflectance=item.Item,
    roughness=item.Item1,
    specularity=item.Item2)  # -> avrgRef, RADMaterial; plug-in component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
deconstruct_brep = DeconstructBrep(Brep=geometry_pipeline)  # -> Faces, Edges, Vertices
createhbsrfs = Honeybee_createHBSrfs(geometry=flatten(deconstruct_brep.Faces), RADMaterial=radopaquematerial.RADMaterial)  # -> out, simplify(HBSurface); plug-in component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
context = Geometry(createhbsrfs.HBSurface)

floor_level_5 = Data(data_4)
level_serese_6 = Integer(int)
window_types_5 = Data(interior_window_types)
floor_heights_6 = Data(data_3)
window_types_6 = Data(window_types_5)
level_serese_7 = Integer(level_serese_6)
lng_5 = ListLength(List=flatten(window_types_6))
number_of_windows_5 = Number(expr("x/4", lng_5))
number_of_windows_6 = Number(number_of_windows_5)
int_6 = Integer(number_of_windows_6)
series_4 = Series(Start=1, Step=1, Count=int_6)
int_7 = Integer(series_4)
concat_4 = Concatenate(
    FragmentA="lvl",
    FragmentB=" ",
    FragmentA_2=graft(level_serese_7),
    FragmentA_3=" ",
    FragmentA_4="internal_win_type",
    FragmentB_2=" ",
    FragmentA_5=int_7)  # -> simplify(Result)
dpipeline_3 = DynamicGeometryPipeline(
    LayerFilter=concat_4,
    TypeFilter="Curve",
    NameFilter="*",
    enableFullPath=False,
    GroupByLayer=False,
    GroupByType=False,
    IncludeHidden=True,
    IncludeLocked=True,
    listenToAttributes=True)  # -> simplify(GeometryOut)
floor_heights_7 = Data(floor_heights_6)
window_types_7 = Data(window_types_5)
path_mapper_9 = PathMapper(window_types_7, source="{a}(i)", target="{0;floor(a/4)}")
flip_6 = FlipMatrix(Data=path_mapper_9)
floor_level_6 = Data(floor_level_5)
window_data_2 = ExplodeTree(Data=flip_6)  # -> Branch0, Branch1, flatten(Branch2), flatten(Branch3)
number_of_windows_7 = Number(number_of_windows_5)
number_of_windows_8 = Number(number_of_windows_5)
Z_6 = UnitZ(Factor=floor_level_6)
path_mapper_10 = PathMapper(window_data_2.Branch1, source="{0;1}", target="{0}")
path_mapper_11 = PathMapper(window_data_2.Branch0, source="{0;1}", target="{0}")
int_8 = Integer(number_of_windows_7)
dup_7 = DuplicateData(Data=Z_6, Number=number_of_windows_8, Order=True)  # -> simplify(graft(Data))
windows_2 = Curve(dpipeline_3)
series_5 = Series(Start=1, Step=1, Count=number_of_windows_7)
data_9 = Data(graft(path_mapper_10))
data_10 = Data(graft(path_mapper_11))
int_9 = Integer(series_5)
move_4 = Move(Geometry=windows_2, Motion=dup_7)  # -> Geometry, Transform
concat_5 = Concatenate(FragmentA="winType", FragmentB=int_9)
data_11 = Data(window_data_2.Branch3)
data_12 = Data(window_data_2.Branch2)
radglassmaterial_2 = Honeybee_RadianceGlassMaterial(materialName=concat_5, RTransmittance=data_12, GTransmittance=data_12, BTransmittance=data_12, refractiveIndex=data_11)  # -> avrgTrans, RADMaterial; plug-in component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
level_serese_8 = Integer(level_serese_6)
flip_7 = FlipMatrix(Data=radglassmaterial_2.RADMaterial)
lng_6 = ListLength(List=level_serese_8)
dup_8 = DuplicateData(Data=data_9, Number=flatten(lng_6), Order=True)
dup_9 = DuplicateData(Data=data_10, Number=flatten(lng_6), Order=True)
flip_8 = FlipMatrix(Data=dup_8)
flip_9 = FlipMatrix(Data=dup_9)
path_mapper_12 = PathMapper(flip_8, source="{A;B;C}(i)", target="{B;(i)}")
path_mapper_13 = PathMapper(flip_9, source="{A;B;C}(i)", target="{B;(i)}")
dup_10 = DuplicateData(Data=flip_7, Number=lng_6, Order=True)
Z_7 = UnitZ(Factor=path_mapper_13)  # -> graft(UnitVector)
Z_8 = UnitZ(Factor=path_mapper_12)  # -> graft(UnitVector)
extr_2 = Extrude(Base=move_4.Geometry, Direction=Z_8)
flip_10 = FlipMatrix(Data=dup_10)  # -> simplify(graft(Data))
move_5 = Move(Geometry=extr_2, Motion=Z_7)  # -> Geometry, Transform
clean_2 = CleanTree(RemoveNulls=True, RemoveInvalid=True, RemoveEmpty=False, Tree=move_5.Geometry)
lng_7 = ListLength(List=int_7)
larger_2 = LargerThan(FirstNumber=lng_7, SecondNumber=1)  # -> LargerThan, OrEqualTo
gate_2 = StreamGate(Stream=clean_2, Gate=larger_2.LargerThan)  # -> Target0, Target1
path_mapper_14 = PathMapper(gate_2.Target0, source="{A;B;C}", target="{C;B}")
path_mapper_15 = PathMapper(gate_2.Target1, source="{A;B;C}", target="{A;B}")
filter_2 = StreamFilter(Gate=larger_2.LargerThan, Stream0=path_mapper_14, Stream1=path_mapper_15)
lng_8 = ListLength(List=filter_2)
dup_11 = DuplicateData(Data=flip_10, Number=lng_8, Order=True)
path_mapper_16 = PathMapper(dup_11, source="{A;B;C}", target="{A;B}")
path_mapper_17 = PathMapper(filter_2, source="{A;B}", target="{A}")
clean_3 = CleanTree(RemoveNulls=True, RemoveInvalid=True, RemoveEmpty=Toggle(True), Tree=path_mapper_17)

floor_heights_8 = Data(data_3)
floor_level_7 = Data(data_4)
level_serese_9 = Integer(int)
level_serese_10 = Integer(level_serese_9)
concat_6 = Concatenate(FragmentA="lvl", FragmentA_2=" ", FragmentA_3=level_serese_10, FragmentA_4=" ", FragmentB="regular")
dpipeline_4 = DynamicGeometryPipeline(
    LayerFilter=concat_6,
    TypeFilter="Curve",
    NameFilter="*",
    enableFullPath=False,
    GroupByLayer=False,
    GroupByType=False,
    IncludeHidden=True,
    IncludeLocked=True,
    listenToAttributes=True)  # -> simplify(GeometryOut)
floor_heights_9 = Data(floor_heights_8)
floor_level_8 = Data(floor_level_7)
Z_9 = UnitZ(Factor=floor_level_8)
regular = Curve(dpipeline_4)
move_6 = Move(Geometry=regular, Motion=Z_9)  # -> Geometry, Transform
boundary_2 = BoundarySurfaces(Edges=move_6.Geometry)
Z_10 = UnitZ(Factor=floor_heights_9)
regular_2 = Extrude(Base=boundary_2, Direction=Z_10)

floor_level_9 = Data(data_4)
level_serese_11 = Integer(int)
floor_heights_10 = Data(data_3)
level_serese_12 = Integer(level_serese_11)
concat_7 = Concatenate(FragmentA="lvl", FragmentA_2=" ", FragmentA_3=level_serese_12, FragmentA_4=" ", FragmentB="internal_wall")
panel_2 = Panel("""0.6
0.05
0.0""")
dpipeline_5 = DynamicGeometryPipeline(
    LayerFilter=concat_7,
    TypeFilter="Curve",
    NameFilter="*",
    enableFullPath=False,
    GroupByLayer=False,
    GroupByType=False,
    IncludeHidden=True,
    IncludeLocked=True,
    listenToAttributes=True)  # -> simplify(GeometryOut)
floor_heights_11 = Data(floor_heights_10)
floor_level_10 = Data(floor_level_9)
regular_3 = Curve(dpipeline_5)
Z_11 = UnitZ(Factor=floor_level_10)
wallmaterialname_2 = Panel("Wall")
item_2 = ListItem(List=panel_2, Index=0, Wrap=True)  # -> Item, Item1, Item2
move_7 = Move(Geometry=regular_3, Motion=Z_11)  # -> Geometry, Transform
Z_12 = UnitZ(Factor=floor_heights_11)
if_internal_shade_doesnt_work = Button()
extr_3 = Extrude(Base=move_7.Geometry, Direction=Z_12)
radopaquematerial_2 = Honeybee_RadianceOpaqueMaterial(
    materialName=wallmaterialname_2,
    RReflectance=item_2.Item,
    GReflectance=item_2.Item,
    BReflectance=item_2.Item,
    roughness=item_2.Item1,
    specularity=item_2.Item2)  # -> avrgRef, RADMaterial; plug-in component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
clean_4 = CleanTree(RemoveNulls=True, RemoveInvalid=True, RemoveEmpty=False, Tree=extr_3)
flatten_if_doesnt_work = Boolean(if_internal_shade_doesnt_work)
gate_3 = StreamGate(Stream=clean_4, Gate=flatten_if_doesnt_work)  # -> flatten(Target0), Target1
flatten_if_doesnt_work_2 = Boolean(if_internal_shade_doesnt_work)
createhbsrfs_2 = Honeybee_createHBSrfs(geometry=[gate_3.Target0, gate_3.Target1], srfType=Slider(0, range=0..100), RADMaterial=radopaquematerial_2.RADMaterial)  # -> readMe, simplify(HBSurface); plug-in component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
match = MatchTreeStructure(DataList=flatten(createhbsrfs_2.HBSurface), TreeMask=clean_4)
data_13 = Data(createhbsrfs_2.HBSurface)
filter_3 = StreamFilter(Gate=flatten_if_doesnt_work, Stream0=match, Stream1=data_13)
data_14 = Data(filter_3)
clean_5 = CleanTree(RemoveNulls=True, RemoveInvalid=True, RemoveEmpty=Toggle(True), Tree=data_14)
path_mapper_18 = PathMapper(clean_5, source="{A;B}", target="{A;B}")

if_internal_shade_doesnt_work_2 = Button()
create_zone_2 = FalseStartToggle(True)
internal_walls = Data(path_mapper_18)
addhbglz = Honeybee_addHBGlz(HBObj=internal_walls, childSurfaces=flatten(filter_2), RADMaterials=flatten(path_mapper_16))  # -> HBObjWGLZ; plug-in component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
path_mapper_19 = PathMapper(internal_walls, source="{A;B}", target="{B}")
path_mapper_20 = PathMapper(addhbglz, source="{A;B;C}", target="{B}")
context_2 = Geometry(flatten(context))
context_3 = Geometry(flatten(context_2))
selobj = GetSelectedObjects(AllObjects_Object=[shades_all, zone_names_all_zones, all_zones, interior_wall_with_windows, text_data, zones_for_floors, interior_wall, window, irregular_3, context_4])  # -> ComponentObjects, ParamObjects, OtherObjects

interior_wall_with_windows = Data(Tree({1}: [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], {2}: [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]))
zone_names_all_zones = Text(Tree({0}: ["lvl -1 zone -1 2", "lvl -1 zone -1 1", "lvl -1 zone -1 3"], {1}: ["lvl 0 zone -0 1", "lvl 0 zone -0 3", "lvl 0 zone -0 4", "lvl 0 zone -0 5"], {2}: ["lvl 1 zone 2 2", "lvl 1 zone 2 1", "lvl 1 zone 2 3"]))
zones_for_floors = Data(Tree({0}: [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], {1}: [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], {2}: [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]))
interior_wall = Data(Tree({1}: [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], {2}: [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]))
shades_all = Data(Tree({0}: [], {1}: [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], {2}: [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]))
text_data = Data(Tree({0;0}: [Point(12.72865896, 27.16415292, -2.5), Point(9.003773708, 8.458050375, -2.5), Point(26.58398583, 8.458050375, -2.5)], {0;1}: [Point(12.3753819, 23.10465, 1), Point(7.599552633, 16.39076401, 1), Point(7.599552633, 12.13648558, 1), Point(28.60912213, 9.666977459, 1)], {0;2}: [Point(12.82774717, 9.413184173, 4.5), Point(27.48718222, 9.413184173, 4.5), Point(7.100699356, 20.03545272, 4.5)], {1;0}: ["zone -1 3", "zone -1 2", "zone -1 1"], {1;1}: ["zone -0 5", "zone -0 4", "zone -0 3", "zone -0 1"], {1;2}: ["zone 2 2", "zone 2 1", "zone 2 3"], {2;0}: [1, 1, 1], {2;1}: [1, 1, 1, 1], {2;2}: [1, 1, 1]))
context_4 = Geometry([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])
all_zones = Data(Tree({0}: [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], {1}: [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], {2}: [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]))
irregular_3 = Data(Tree({0}: [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], {1}: [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], {2}: [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]))
window = Data(Tree({1}: [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], {2}: [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]))

internalize = InternalizeParamData(Param=selobj.ParamObjects, Internalize=Button())

floor_level_11 = Data(data_4)
level_serese_13 = Integer(int)
level_serese_14 = Integer(int)
level_serese_15 = Integer(level_serese_13)
concat_8 = Concatenate(FragmentA="lvl", FragmentA_2=" ", FragmentA_3=level_serese_15, FragmentA_4=" ", FragmentB="zone_name")
dpipeline_6 = DynamicGeometryPipeline(
    LayerFilter=concat_8,
    TypeFilter="Text",
    NameFilter="*",
    enableFullPath=False,
    GroupByLayer=False,
    GroupByType=False,
    IncludeHidden=True,
    IncludeLocked=True,
    listenToAttributes=True)  # -> simplify(GeometryOut)
data_15 = Data(dpipeline_6)
txtobjinfo = TextObjectInfo(TextObjects=data_15)  # -> Plane, Text, Size, Alignment, VerticalAlignment
floor_level_12 = Data(floor_level_11)
lng_9 = ListLength(List=flatten(data_15))  # -> flatten(Length)
addition_2 = Addition(A=floor_level_12, B=1)
pt = Point(txtobjinfo.Plane)
Z_13 = UnitZ(Factor=addition_2)
level_serese_16 = Integer(graft(level_serese_14))
move_8 = Move(Geometry=pt, Motion=Z_13)  # -> flatten(Geometry), Transform
clean_6 = CleanTree(RemoveNulls=True, RemoveInvalid=True, RemoveEmpty=False, Tree=move_8.Geometry)
data_16 = Data(txtobjinfo.Text)
move_9 = Move(Geometry=pt, Motion=Z_13)  # -> Geometry, Transform
text_location = Data(move_9.Geometry)
scale = Data(txtobjinfo.Size)
text = Data(txtobjinfo.Text)
concat_9 = Concatenate(A="lvl", spoace=" ", zone_name=level_serese_16, space=" ", B=data_16)  # -> flatten(Result)
path_mapper_21 = PathMapper(text_location, source="{A;B}", target="{0;B}")
path_mapper_22 = PathMapper(scale, source="{A}", target="{2;A}")
path_mapper_23 = PathMapper(text, source="{A}", target="{1;A}")
txt = Text("0")
txt_2 = Text("1")
text_data_2 = Data([path_mapper_21, path_mapper_23, path_mapper_22])
text_data_3 = Data(text_data_2)

level_serese_17 = Integer(int)
floor_heights_12 = Data(data_3)
floor_level_13 = Data(data_4)
level_serese_18 = Integer(level_serese_17)
concat_10 = Concatenate(FragmentA="lvl", FragmentA_2=" ", FragmentA_3=level_serese_18, FragmentA_4=" ", FragmentB="regular_internal")
dpipeline_7 = DynamicGeometryPipeline(
    LayerFilter=concat_10,
    TypeFilter="Curve",
    NameFilter="*",
    enableFullPath=False,
    GroupByLayer=False,
    GroupByType=False,
    IncludeHidden=True,
    IncludeLocked=True,
    listenToAttributes=True)  # -> simplify(GeometryOut)
floor_heights_13 = Data(floor_heights_12)
floor_level_14 = Data(floor_level_13)
Z_14 = UnitZ(Factor=floor_level_14)
regular_4 = Curve(dpipeline_7)
move_10 = Move(Geometry=regular_4, Motion=Z_14)  # -> Geometry, Transform
Z_15 = UnitZ(Factor=floor_heights_13)

floor_level_15 = Data(data_4)
level_serese_19 = Integer(int)
v_shade_types = Data(h_shade_type)
floor_heights_14 = Data(data_3)
v_shade_types_2 = Data(v_shade_types)
level_serese_20 = Integer(level_serese_19)
lng_10 = ListLength(List=flatten(v_shade_types_2))
number_of_v_shades = Number(expr("x/3", lng_10))
number_of_vshades = Number(number_of_v_shades)
int_10 = Integer(number_of_vshades)
series_6 = Series(Start=1, Step=1, Count=int_10)
int_11 = Integer(series_6)
concat_11 = Concatenate(
    FragmentA="lvl",
    FragmentB=" ",
    FragmentA_2=graft(level_serese_20),
    FragmentA_3=" ",
    FragmentA_4="vshade_type",
    FragmentB_2=" ",
    FragmentA_5=int_11)  # -> simplify(Result)
dpipeline_8 = DynamicGeometryPipeline(
    LayerFilter=concat_11,
    TypeFilter="Curve",
    NameFilter="*",
    enableFullPath=False,
    GroupByLayer=False,
    GroupByType=False,
    IncludeHidden=True,
    IncludeLocked=True,
    listenToAttributes=True)  # -> simplify(GeometryOut)
floor_heights_15 = Data(floor_heights_14)
v_shade_types_3 = Data(v_shade_types)
path_mapper_24 = PathMapper(v_shade_types_3, source="{a}(i)", target="{0;floor(a/3)}")
flip_11 = FlipMatrix(Data=path_mapper_24)
floor_level_16 = Data(floor_level_15)
window_data_3 = ExplodeTree(Data=flip_11)  # -> Branch0, Branch1, flatten(Branch2)
number_of_v_shades_2 = Number(number_of_v_shades)
number_of_h_shades = Number(number_of_v_shades)
Z_16 = UnitZ(Factor=floor_level_16)
dup_12 = DuplicateData(Data=Z_16, Number=number_of_h_shades, Order=True)  # -> simplify(graft(Data))
int_12 = Integer(number_of_v_shades_2)
windows_3 = Curve(dpipeline_8)
series_7 = Series(Start=1, Step=1, Count=number_of_v_shades_2)
int_13 = Integer(series_7)
move_11 = Move(Geometry=windows_3, Motion=dup_12)  # -> Geometry, Transform
concat_12 = Concatenate(FragmentA="vshadeType", FragmentB=int_13)
data_17 = Data(window_data_3.Branch1)
data_18 = Data(window_data_3.Branch2)
data_19 = Data(window_data_3.Branch0)
floor_heights_16 = Data(floor_heights_15)
boundary_3 = BoundarySurfaces(Edges=move_11.Geometry)
radopaquematerial_3 = Honeybee_RadianceOpaqueMaterial(
    materialName=concat_12,
    RReflectance=data_19,
    GReflectance=data_19,
    BReflectance=data_19,
    roughness=data_17,
    specularity=data_18)  # -> avrgRef, RADMaterial; plug-in component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
Z_17 = UnitZ(Factor=floor_heights_16)
level_serese_21 = Integer(level_serese_19)
extr_4 = Extrude(Base=boundary_3, Direction=Z_17)
flip_12 = FlipMatrix(Data=radopaquematerial_3.RADMaterial)
lng_11 = ListLength(List=level_serese_21)
dup_13 = DuplicateData(Data=flip_12, Number=lng_11, Order=True)
flip_13 = FlipMatrix(Data=dup_13)  # -> simplify(graft(Data))
path_mapper_25 = PathMapper(extr_4, source="{A;B}", target="{A;B}")

floor_heights_17 = Data(data_3)
floor_level_17 = Data(data_4)
floor_level_18 = Data(data_4)
level_serese_22 = Integer(int)
level_serese_23 = Integer(int)
level_serese_24 = Integer(level_serese_23)
level_serese_25 = Integer(level_serese_22)
concat_13 = Concatenate(FragmentA="lvl", FragmentA_2=" ", FragmentA_3=level_serese_24, FragmentA_4=" ", FragmentB="cutout_above")
concat_14 = Concatenate(FragmentA="lvl", FragmentA_2=" ", FragmentA_3=level_serese_25, FragmentA_4=" ", FragmentB="cutout_below")
number_slider_2 = Slider(1, range=0..1)
dpipeline_9 = DynamicGeometryPipeline(
    LayerFilter=concat_13,
    TypeFilter="Curve",
    NameFilter="*",
    enableFullPath=False,
    GroupByLayer=False,
    GroupByType=False,
    IncludeHidden=True,
    IncludeLocked=True,
    listenToAttributes=True)  # -> simplify(GeometryOut)
dpipeline_10 = DynamicGeometryPipeline(
    LayerFilter=concat_14,
    TypeFilter="Curve",
    NameFilter="*",
    enableFullPath=False,
    GroupByLayer=False,
    GroupByType=False,
    IncludeHidden=True,
    IncludeLocked=True,
    listenToAttributes=True)  # -> simplify(GeometryOut)
floor_heights_18 = Data(floor_heights_17)
floor_level_19 = Data(floor_level_17)
floor_level_20 = Data(floor_level_18)
regular_5 = Curve(dpipeline_9)
regular_6 = Curve(dpipeline_10)
Z_18 = UnitZ(Factor=floor_level_19)
Z_19 = UnitZ(Factor=floor_level_20)
subtraction = Subtraction(A=floor_heights_18, B=number_slider_2)
num = Number(number_slider_2)
move_12 = Move(Geometry=regular_5, Motion=Z_18)  # -> Geometry, Transform
Z_20 = UnitZ(Factor=num)
move_13 = Move(Geometry=regular_6, Motion=Z_19)  # -> Geometry, Transform
Z_21 = UnitZ(Factor=subtraction)
move_14 = Move(Geometry=move_12.Geometry, Motion=Z_21)  # -> Geometry, Transform
move_15 = Move(Geometry=move_13.Geometry, Motion=Z_20)  # -> Geometry, Transform
rev = Reverse(Vector=Z_20)
multiplication_2 = Multiplication(A=number_slider_2, B=2)
multiplication_3 = Multiplication(A=rev, B=2)
Z_22 = UnitZ(Factor=multiplication_2)

clean_7 = CleanTree(RemoveNulls=True, RemoveInvalid=True, RemoveEmpty=False, Tree=move_14.Geometry)
clean_8 = CleanTree(RemoveNulls=True, RemoveInvalid=True, RemoveEmpty=False, Tree=move_15.Geometry)

boundary_4 = BoundarySurfaces(Edges=clean_8)
boundary_5 = BoundarySurfaces(Edges=clean_7)
regular_7 = Extrude(Base=boundary_5, Direction=Z_22)
regular_8 = Extrude(Base=boundary_4, Direction=multiplication_3)

geo = Geometry([regular_7, regular_8])
geo_2 = Geometry(geo)

floor_level_21 = Data(data_4)
level_serese_26 = Integer(int)
h_shade_types = Data(h_shade_type_2)
floor_heights_19 = Data(data_3)
h_shade_types_2 = Data(h_shade_types)
level_serese_27 = Integer(level_serese_26)
lng_12 = ListLength(List=flatten(h_shade_types_2))
number_of_h_shades_2 = Number(expr("x/5", lng_12))
number_of_hshades = Number(number_of_h_shades_2)
int_14 = Integer(number_of_hshades)
series_8 = Series(Start=1, Step=1, Count=int_14)
int_15 = Integer(series_8)
concat_15 = Concatenate(
    FragmentA="lvl",
    FragmentB=" ",
    FragmentA_2=graft(level_serese_27),
    FragmentA_3=" ",
    FragmentA_4="hshade_type",
    FragmentB_2=" ",
    FragmentA_5=int_15)  # -> simplify(Result)
dpipeline_11 = DynamicGeometryPipeline(
    LayerFilter=concat_15,
    TypeFilter="Curve",
    NameFilter="*",
    enableFullPath=False,
    GroupByLayer=False,
    GroupByType=False,
    IncludeHidden=True,
    IncludeLocked=True,
    listenToAttributes=True)  # -> simplify(GeometryOut)
floor_heights_20 = Data(floor_heights_19)
h_shade_types_3 = Data(h_shade_types)
path_mapper_26 = PathMapper(h_shade_types_3, source="{a}(i)", target="{0;floor(a/5)}")
flip_14 = FlipMatrix(Data=path_mapper_26)
floor_level_22 = Data(floor_level_21)
window_data_4 = ExplodeTree(Data=flip_14)  # -> Branch0, Branch1, flatten(Branch2), flatten(Branch3), Branch4
number_of_h_shades_3 = Number(number_of_h_shades_2)
number_of_h_shades_4 = Number(number_of_h_shades_2)
Z_23 = UnitZ(Factor=floor_level_22)
path_mapper_27 = PathMapper(window_data_4.Branch1, source="{0;1}", target="{0}")
path_mapper_28 = PathMapper(window_data_4.Branch0, source="{0;1}", target="{0}")
int_16 = Integer(number_of_h_shades_3)
dup_14 = DuplicateData(Data=Z_23, Number=number_of_h_shades_4, Order=True)  # -> simplify(graft(Data))
windows_4 = Curve(dpipeline_11)
series_9 = Series(Start=1, Step=1, Count=number_of_h_shades_3)
data_20 = Data(graft(path_mapper_28))
data_21 = Data(graft(path_mapper_27))
int_17 = Integer(series_9)
move_16 = Move(Geometry=windows_4, Motion=dup_14)  # -> Geometry, Transform
concat_16 = Concatenate(FragmentA="hshadeType", FragmentB=int_17)
data_22 = Data(window_data_4.Branch3)
data_23 = Data(window_data_4.Branch4)
data_24 = Data(window_data_4.Branch2)
radopaquematerial_4 = Honeybee_RadianceOpaqueMaterial(
    materialName=concat_16,
    RReflectance=data_24,
    GReflectance=data_24,
    BReflectance=data_24,
    roughness=data_22,
    specularity=data_23)  # -> avrgRef, RADMaterial; plug-in component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
level_serese_28 = Integer(level_serese_26)
flip_15 = FlipMatrix(Data=radopaquematerial_4.RADMaterial)
lng_13 = ListLength(List=level_serese_28)
dup_15 = DuplicateData(Data=data_20, Number=flatten(lng_13), Order=True)
dup_16 = DuplicateData(Data=data_21, Number=flatten(lng_13), Order=True)
flip_16 = FlipMatrix(Data=dup_15)
flip_17 = FlipMatrix(Data=dup_16)
path_mapper_29 = PathMapper(flip_16, source="{A;B;C}(i)", target="{B;(i)}")
path_mapper_30 = PathMapper(flip_17, source="{A;B;C}(i)", target="{B;(i)}")
dup_17 = DuplicateData(Data=flip_15, Number=lng_13, Order=True)
Z_24 = UnitZ(Factor=path_mapper_30)  # -> graft(UnitVector)
Z_25 = UnitZ(Factor=path_mapper_29)  # -> graft(UnitVector)
move_17 = Move(Geometry=move_16.Geometry, Motion=Z_25)  # -> Geometry, Transform
flip_18 = FlipMatrix(Data=dup_17)  # -> simplify(graft(Data))
boundary_6 = BoundarySurfaces(Edges=move_17.Geometry)
extr_5 = Extrude(Base=boundary_6, Direction=Z_24)
clean_9 = CleanTree(RemoveNulls=True, RemoveInvalid=True, RemoveEmpty=False, Tree=extr_5)
path_mapper_31 = PathMapper(clean_9, source="{A;B;C}", target="{A;B}")

clean_10 = CleanTree(RemoveNulls=True, RemoveInvalid=True, RemoveEmpty=False, Tree=move_10.Geometry)
irregular_4 = Data(irregular_2)

boundary_7 = BoundarySurfaces(Edges=clean_10)
regular_9 = Extrude(Base=boundary_7, Direction=Z_15)

sdiff = SolidDifference(BrepsA=regular_2, BrepsB=regular_9)
data_25 = Data(regular_9)
ifcomponent = PythonScript(x=regular_2, y=sdiff)  # -> a; inputs x: Brep, y: Brep
# ---------- ifcomponent: Python ----------
if y!=None:
    a=y
else:
    a=x
# ---------- end ifcomponent ----------
merge_5 = Merge(Data1=ifcomponent, Data2=data_25)
sdiff_2 = SolidDifference(BrepsA=merge_5, BrepsB=irregular_2)
ifcomponent_2 = PythonScript(x=merge_5, y=sdiff_2)  # -> a; inputs x: Brep, y: Brep; same code as ifcomponent
merge_6 = Merge(Data1=ifcomponent_2)
zones = Data(merge_6)

data_26 = Data(merge_6)
zones_2 = Data(flatten(data_26))
data_27 = Data(zones_2)
lng_14 = ListLength(List=data_27)
subtraction_2 = Subtraction(A=lng_14, B=lng_9)
zones_3 = Data(zones_2)
series_10 = Series(Start=lng_9, Step=1, Count=subtraction_2)
round = Round(Number=series_10)  # -> Nearest, Floor, Ceiling
series_11 = Series(Start="1", Step=1, Count=subtraction_2)
brepinc = PointInBrep(Brep=graft(zones_3), Point=clean_6, Strict=False)
round_2 = Round(Number=series_11)  # -> Nearest, Floor, Ceiling
data_28 = Data(round_2.Nearest)
concat_17 = Concatenate(FragmentA="unnamed zone", FragmentC=" ", FragmentB=data_28)  # -> flatten(Result)
mindex = MemberIndex(Set=brepinc, Member=Toggle(True))  # -> flatten(Index), flatten(Count)
txt_3 = Text(mindex.Count)
mindex_2 = MemberIndex(Set=txt_3, Member=txt)  # -> Index, Count
replace = ReplaceItems(List=mindex.Count, Item=round.Nearest, Indices=mindex_2.Index, Wrap=False)  # -> flatten(List)
data_29 = Data(flatten([concat_9, concat_17]))
txt_4 = Text(replace)
mindex_3 = MemberIndex(Set=txt_4, Member=txt_2)  # -> Index, Count
replace_2 = ReplaceItems(List=replace, Item=mindex.Index, Indices=mindex_3.Index, Wrap=False)
item_3 = ListItem(List=data_29, Index=replace_2, Wrap=True)
zone_names = Text(item_3)
match_2 = MatchTreeStructure(DataList=flatten(zone_names), TreeMask=data_26)
path_mapper_32 = PathMapper(match_2, source="{A;B}", target="{B}")

viewer = ParamViewer(zones)
panel_3 = Panel(match_2)
trim = TrimSolid(Shape=zones, Cutters=geo_2)
trim_2 = TrimSolid(Shape=irregular_4, Cutters=geo_2)
panel_4 = Panel(zones)
trim_3 = TrimTree(Tree=trim, Depth=1)
trim_4 = TrimTree(Tree=trim_2, Depth=1)
zone_names_2 = Text(match_2)
zones_4 = Data(trim_3)
zones_5 = Data(trim_4)
mass2zone = Honeybee_Masses2Zones(zoneMasses=flatten(zones_4), isConditioned=Toggle(True), maxRoofAngle=30, createHBZones=create_zone_2)  # -> readMe, HBZones; plug-in component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
mass2zone_2 = Honeybee_Masses2Zones(zoneMasses=flatten(zones_5), isConditioned=Toggle(False), maxRoofAngle=30, createHBZones=create_zone_2)  # -> readMe, HBZones; plug-in component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
match_3 = MatchTreeStructure(DataList=flatten(mass2zone.HBZones), TreeMask=zones_4)
match_4 = MatchTreeStructure(DataList=flatten(mass2zone_2.HBZones), TreeMask=zones_5)
merge_7 = Merge(Data1=match_3, Data2=match_4)
all_zones_2 = Data(trim_4)
conditionedunconditioned = Honeybee_SeparateConditionedAndUnconditionedZones(HBZones=flatten(merge_7))  # -> conditionedZones, unconditionedZones; plug-in component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
match_5 = MatchTreeStructure(DataList=flatten(conditionedunconditioned.conditionedZones), TreeMask=match_3)
match_6 = MatchTreeStructure(DataList=flatten(conditionedunconditioned.unconditionedZones), TreeMask=match_4)
path_mapper_33 = PathMapper(match_5, source="{A;B}", target="{B}")
addhbglz_2 = Honeybee_addHBGlz(HBObj=merge_7, childSurfaces=flatten(filter), RADMaterials=flatten(path_mapper_8))  # -> HBObjWGLZ; plug-in component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
path_mapper_34 = PathMapper(addhbglz_2, source="{A;B;C}", target="{B}")

data_30 = Data(path_mapper_34)
volume = Volume(Geometry=data_30)  # -> Volume, Centroid
brepinc_2 = PointInBrep(Brep=data_30, Point=volume.Centroid, Strict=False)
dispatch = Dispatch(List=path_mapper_34, DispatchPattern=brepinc_2)  # -> ListA, ListB
bang = ExplodeTree(Data=dispatch.ListB)  # -> Branch0, Branch1, Branch2, Branch3
cull_i = CullIndex(List=bang.Branch2, Indices=Slider(0, range=0..1), Wrap=True)
item_4 = ListItem(List=cull_i, Index=Slider(2, range=0..100), Wrap=True)

all_zones_3 = Data(all_zones_2)
path_mapper_35 = PathMapper(all_zones_3, source="{A;B}", target="{B}")

debrep = DeconstructBrep(Brep=path_mapper_25)  # -> Faces, Edges, Vertices
trim_5 = TrimTree(Tree=debrep.Faces, Depth=1)
data_31 = Data(trim_5)
flatten_if_doesnt_work_3 = Boolean(if_internal_shade_doesnt_work_2)
gate_4 = StreamGate(Stream=data_31, Gate=flatten_if_doesnt_work_3)  # -> flatten(Target0), Target1

lng_15 = ListLength(List=trim_5)
dup_18 = DuplicateData(Data=flip_13, Number=lng_15, Order=True)
path_mapper_36 = PathMapper(dup_18, source="{A;B;C}", target="{A;B}")

gate_5 = StreamGate(Stream=path_mapper_36, Gate=flatten_if_doesnt_work_3)  # -> flatten(Target0), Target1
createhbsrfs_3 = Honeybee_createHBSrfs(geometry=[gate_4.Target0, gate_4.Target1], srfType=Slider(6, range=0..10), RADMaterial=[gate_5.Target0, gate_5.Target1])  # -> readMe, simplify(HBSurface); plug-in component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
match_7 = MatchTreeStructure(DataList=flatten(createhbsrfs_3.HBSurface), TreeMask=data_31)
data_32 = Data(createhbsrfs_3.HBSurface)
filter_4 = StreamFilter(Gate=flatten_if_doesnt_work_3, Stream0=match_7, Stream1=data_32)
data_33 = Data(filter_4)
clean_11 = CleanTree(RemoveNulls=True, RemoveInvalid=True, RemoveEmpty=False, Tree=data_33)  # -> simplify(Tree)
data_34 = Data(clean_11)

debrep_2 = DeconstructBrep(Brep=path_mapper_31)  # -> Faces, Edges, Vertices
trim_6 = TrimTree(Tree=debrep_2.Faces, Depth=1)
data_35 = Data(trim_6)
flatten_if_doesnt_work_4 = Boolean(if_internal_shade_doesnt_work_2)
gate_6 = StreamGate(Stream=data_35, Gate=flatten_if_doesnt_work_4)  # -> flatten(Target0), Target1

lng_16 = ListLength(List=trim_6)
dup_19 = DuplicateData(Data=flip_18, Number=lng_16, Order=True)
path_mapper_37 = PathMapper(dup_19, source="{A;B;C}", target="{A;B}")

gate_7 = StreamGate(Stream=path_mapper_37, Gate=flatten_if_doesnt_work_4)  # -> flatten(Target0), Target1
createhbsrfs_4 = Honeybee_createHBSrfs(geometry=[gate_6.Target0, gate_6.Target1], srfType=Slider(6, range=0..10), RADMaterial=[gate_7.Target0, gate_7.Target1])  # -> readMe, simplify(HBSurface); plug-in component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
match_8 = MatchTreeStructure(DataList=flatten(createhbsrfs_4.HBSurface), TreeMask=data_35)
data_36 = Data(createhbsrfs_4.HBSurface)
filter_5 = StreamFilter(Gate=flatten_if_doesnt_work_4, Stream0=match_8, Stream1=data_36)
data_37 = Data(filter_5)
clean_12 = CleanTree(RemoveNulls=True, RemoveInvalid=True, RemoveEmpty=False, Tree=data_37)  # -> simplify(Tree)
data_38 = Data(clean_12)

shades_all_2 = Data([data_38, data_34])

path_mapper_38 = PathMapper(shades_all_2, source="{A;B}", target="{A}")

interior_wall_with_windows_2 = Data(path_mapper_20)
zone_names_all_zones_2 = Text(path_mapper_32)
zones_for_floors_2 = Data(path_mapper_33)
interior_wall_2 = Data(path_mapper_19)
shades_all_3 = Data(path_mapper_38)
text_data_4 = Data(text_data_3)
context_5 = Geometry(context_3)
all_zones_4 = Data(path_mapper_34)
irregular_5 = Data(path_mapper_35)
window_2 = Data(clean_3)
