# Grasshopper definition tool_part1_ v7.1_1.gh (Grasshopper 0.9.76)
# plug-ins: Python Interpreter, FalseStartToggle

interior_wall_with_windows = Data(Tree({1}: [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], {2}: [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]))
zone_names_all_zones = Text(Tree({0}: ["lvl -1 zone -1 2", "lvl -1 zone -1 1", "lvl -1 zone -1 3"], {1}: ["lvl 0 zone -0 1", "lvl 0 zone -0 3", "lvl 0 zone -0 4", "lvl 0 zone -0 5"], {2}: ["lvl 1 zone 2 2", "lvl 1 zone 2 1", "lvl 1 zone 2 3"]))
zones_for_floors = Data(Tree({0}: [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], {1}: [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], {2}: [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]))
interior_wall = Data(Tree({1}: [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], {2}: [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]))
shades_all = Data(Tree({0}: [], {1}: [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], {2}: [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]))
text_data = Data(Tree({0;0}: [Point(12.72865896, 27.16415292, -2.5), Point(9.003773708, 8.458050375, -2.5), Point(26.58398583, 8.458050375, -2.5)], {0;1}: [Point(12.3753819, 23.10465, 1), Point(7.599552633, 16.39076401, 1), Point(7.599552633, 12.13648558, 1), Point(28.60912213, 9.666977459, 1)], {0;2}: [Point(12.82774717, 9.413184173, 4.5), Point(27.48718222, 9.413184173, 4.5), Point(7.100699356, 20.03545272, 4.5)], {1;0}: ["zone -1 3", "zone -1 2", "zone -1 1"], {1;1}: ["zone -0 5", "zone -0 4", "zone -0 3", "zone -0 1"], {1;2}: ["zone 2 2", "zone 2 1", "zone 2 3"], {2;0}: [1, 1, 1], {2;1}: [1, 1, 1, 1], {2;2}: [1, 1, 1]))
context = Geometry([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])
all_zones = Data(Tree({0}: [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], {1}: [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], {2}: [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]))
irregular = Data(Tree({0}: [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], {1}: [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], {2}: [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]))
window = Data(Tree({1}: [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], {2}: [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]))

interior_wall_with_windows_2 = Data(interior_wall_with_windows)
zone_names_all_zones_2 = Text(zone_names_all_zones)
interior_wall_2 = Data(interior_wall)
shades_all_2 = Data(shades_all)
window_2 = Data(window)
text_data_2 = Data(text_data)
irregular_2 = Data(irregular)
all_zones_2 = Data(zones_for_floors)
all_zones_3 = Data(all_zones)
context_2 = Geometry(context)

data = Data(all_zones_3)

select_time_9_am = BooleanToggle(False)
select_time_3_pm = BooleanToggle(True)
data_2 = Data([select_time_9_am, select_time_3_pm])
open_epw = BooleanToggle(True)
panel = Panel("""9AM
3PM""")
data_3 = Data(data_2)
mindex = MemberIndex(Set=data_2, Member=Toggle(True))  # -> Index, Count
open_weather_file = Ladybug_OpenEPWWeatherFile(open=open_epw)  # -> epwFile; plug-in component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
item = ListItem(List=panel, Index=mindex.Index, Wrap=True)
weatherfile = FilePath(open_weather_file)
importepw = Ladybug_ImportEpw(epwFile=weatherfile)  # -> readMe, latitude, location, dryBulbTemperature, dewPointTemperature, relativeHumidity, windSpeed, windDirection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; plug-in component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
sunpath = Ladybug_SunPath(location=importepw.location, hour=12, day=21, month=12, timeStep=1, dailyOrAnnualSunPath=True)  # -> readMe, sunVectors, sunAltitudes, sunAzimuths, port, sunSpheresMesh, sunPathCrvs, compassCrvs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; plug-in component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
april = Panel("""1
2
3
4
5""")
march = Panel("""6
7
8
9
10
11
12
13
14
15
16
17
18
19
20
21
22
23
24
25
26
27
28
29
30
31""")
months = Panel("""3
4""")
months_2 = Panel("""9
10""")
oct = Panel("""1
2
3
4
5""")
sept = Panel("""6
7
8
9
10
11
12
13
14
15
16
17
18
19
20
21
22
23
24
25
26
27
28
29
30
31""")
hours = Panel("9")
entwine = Entwine(Branch00=sept, Branch01=oct, FlattenInputs=True)
hours_2 = Panel("9")
entwine_2 = Entwine(Branch00=march, Branch01=april, FlattenInputs=True)
strnum = Ladybug_SeparateData(inputList=flatten(importepw.directNormalRadiation))  # -> numbers, strings; plug-in component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
strnum_2 = Ladybug_SeparateData(inputList=flatten(importepw.diffuseHorizontalRadiation))  # -> numbers, strings; plug-in component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
doy_hoy = Ladybug_DOY_HOY(days=entwine, months=simplify(graft(months_2)), hours=hours_2)  # -> flatten(HOY), DOY, flatten(date); plug-in component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
doy_hoy_2 = Ladybug_DOY_HOY(days=entwine_2, months=simplify(graft(months)), hours=hours)  # -> flatten(HOY), DOY, flatten(date); plug-in component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
subtraction = Subtraction(A="90", B=sunpath.sunAltitudes)
diffusehorizontalradiation = Data(strnum_2.numbers)
directnormalradiation = Data(strnum.numbers)
_6hr = Addition(A=doy_hoy_2.HOY, B=6)
data_4 = Data(subtraction)
_6hr_2 = Addition(A=doy_hoy.HOY, B=6)
path_mapper = PathMapper(_6hr, source="{A}", target="{1;1;0}")
path_mapper_2 = PathMapper(doy_hoy_2.HOY, source="{A}", target="{0;1;0}")
path_mapper_3 = PathMapper(_6hr_2, source="{A}", target="{1;1;1}")
path_mapper_4 = PathMapper(doy_hoy.HOY, source="{A}", target="{0;1;1}")
_9am_hours = Integer(path_mapper_2)
_15pm_hours = Integer(path_mapper)
_9am_hours_2 = Integer(path_mapper_4)
_15pm_hours_2 = Integer(path_mapper_3)
data_5 = Data([_9am_hours, _15pm_hours, _9am_hours_2, _15pm_hours_2])
directnormalradiation_wh_m2 = Number(directnormalradiation)
diffusehorizontalradiation_wh_m2 = Number(diffusehorizontalradiation)
item_2 = ListItem(List=directnormalradiation_wh_m2, Index=data_5, Wrap=True)
item_3 = ListItem(List=diffusehorizontalradiation_wh_m2, Index=data_5, Wrap=True)
python = PythonScript(diffuseirradiance=item_3, directirradiance=item_2, sunzenith=data_4)  # -> skyclearness
# ---------- python: Python ----------
import math
skyclearness = ((diffuseirradiance + directirradiance) / (diffuseirradiance) +1.041 * sunzenith * math.pi / 180 * sunzenith * math.pi /180 * sunzenith * math.pi / 180) / (1 + 1.041 * sunzenith * math.pi / 180 *sunzenith * math.pi / 180 * sunzenith *math.pi / 180)
# ---------- end python ----------
skyclearness = Data(python)
sort = SortList(Keys=skyclearness)  # -> Keys, ValuesA
item_4 = ListItem(List=sort.Keys, Index=0, Wrap=True)  # -> Item1, Item
python_2 = PythonScript(x=skyclearness, y=item_4.Item1)  # -> a
# ---------- python_2: Python ----------
if x==y:
    a=True
else:
    a=False
# ---------- end python_2 ----------
cull = CullPattern(List=item_3, CullPattern=python_2)
cull_2 = CullPattern(List=item_2, CullPattern=python_2)
trim = TrimTree(Tree=cull, Depth=1)
trim_2 = TrimTree(Tree=cull_2, Depth=1)
avr = Average(Input=trim)  # -> flatten(ArithmeticMean)
addition = Addition(A="9", B="6")
avr_2 = Average(Input=trim_2)  # -> flatten(ArithmeticMean)
merge = Merge(Data1="9", Data2=addition)
item_5 = ListItem(List=avr, Index=0, Wrap=True)
item_6 = ListItem(List=avr, Index=1, Wrap=True)
item_7 = ListItem(List=avr_2, Index=0, Wrap=True)
item_8 = ListItem(List=avr_2, Index=1, Wrap=True)
int = Integer(item_5)
int_2 = Integer(item_6)
int_3 = Integer(item_7)
int_4 = Integer(item_8)
dispatch = Dispatch(List=merge, DispatchPattern=data_2)  # -> ListA, ListB
directnormalradiation_wh_m2_2 = Panel(int_4)
directnormalradiation_wh_m2_3 = Panel(int_3)
diffusehorizontalradiation_wh_m2_2 = Panel(int)
diffusehorizontalradiation_wh_m2_3 = Panel(int_2)
genstandardciesky = Honeybee_GenerateStandardCIESky(weatherFile=weatherfile, month="9", day="21", hour=dispatch.ListA, skyType=0)  # -> skyFilePath; plug-in component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
gencustomsky = Honeybee_GenerateCustomSky(
    locationData=importepw.location,
    directNrmRad=directnormalradiation_wh_m2_3,
    diffuseHorRad=diffusehorizontalradiation_wh_m2_2,
    month="3",
    day="21",
    hour="9")  # -> skyFilePath; plug-in component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
gencustomsky_2 = Honeybee_GenerateCustomSky(
    locationData=importepw.location,
    directNrmRad=directnormalradiation_wh_m2_2,
    diffuseHorRad=diffusehorizontalradiation_wh_m2_3,
    month="3",
    day="21",
    hour="15")  # -> skyFilePath; plug-in component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
merge_2 = Merge(Data1=gencustomsky, Data2=gencustomsky_2)
dispatch_2 = Dispatch(List=merge_2, DispatchPattern=data_2)  # -> ListA, ListB
merge_3 = Merge(Data1=genstandardciesky, Data2=dispatch_2.ListA, Data3=dispatch_2.ListA)
leed_v4_1_op2 = BooleanToggle(False)
v_2009_op1 = BooleanToggle(False)
leed_v4_op2 = BooleanToggle(True)
data_6 = Data([v_2009_op1, leed_v4_op2, leed_v4_1_op2])
dispatch_3 = Dispatch(List=merge_3, DispatchPattern=data_6)  # -> ListA, ListB
time_text = Data(item)
sky_file = Data(dispatch_3.ListA)

geo_all = Data(data)
shades_all_3 = Data(shades_all_2)
context_3 = Geometry(context_2)
item_9 = ListItem(List=geo_all, Index=0, Wrap=True)  # -> flatten(Item)
lng = ListLength(List=item_9)
series = Series(Start=0, Step=1, Count=lng)
level_serese = Integer(series)
all_floors = Panel(level_serese)
interior_wall_with_windows_3 = Data(interior_wall_with_windows_2)
single_floor = BooleanToggle(True)
context_4 = BooleanToggle(True)
data_7 = Data("1")
gate = StreamGate(Stream=interior_wall_with_windows_3, Gate=single_floor)  # -> Target0, Target1
gate_2 = StreamGate(Stream=geo_all, Gate=single_floor)  # -> Target0, Target1
gate_3 = StreamGate(Stream=all_zones_2, Gate=single_floor)  # -> Target0, Target1
gate_4 = StreamGate(Stream=shades_all_3, Gate=single_floor)  # -> Target0, Target1
gate_5 = StreamGate(Stream=context_3, Gate=context_4)  # -> Target0, Target1
branch = TreeBranch(Tree=gate.Target1, Path=data_7, MaintainPaths=True)
branch_2 = TreeBranch(Tree=gate_4.Target1, Path=data_7, MaintainPaths=True)
branch_3 = TreeBranch(Tree=gate_2.Target1, Path=data_7, MaintainPaths=True)
branch_4 = TreeBranch(Tree=gate_3.Target1, Path=data_7, MaintainPaths=True)
path_mapper_5 = PathMapper(branch_3, source="{A}", target="{A}")
path_mapper_6 = PathMapper(branch_2, source="{A}", target="{A}")
path_mapper_7 = PathMapper(branch, source="{A}", target="{A}")
path_mapper_8 = PathMapper(branch_4, source="{A}", target="{A}")
filter = StreamFilter(Gate=single_floor, Stream0=gate.Target0, Stream1=path_mapper_7)
filter_2 = StreamFilter(Gate=single_floor, Stream0=gate_3.Target0, Stream1=path_mapper_8)
filter_3 = StreamFilter(Gate=single_floor, Stream0=gate_2.Target0, Stream1=path_mapper_5)
filter_4 = StreamFilter(Gate=single_floor, Stream0=gate_4.Target0, Stream1=path_mapper_6)
filter_5 = StreamFilter(Gate=context_4, Stream1=gate_5.Target1)
context_5 = Data(filter_5)
interior_wall_with_windows_4 = Data(filter)
geo_all_2 = Data(filter_3)
shades = Data(filter_4)
decomposebytype = Honeybee_DecomposeBasedOnType(HBZone=filter_2)  # -> walls, interiorWalls, airWalls, windows, interiorWindows, skylights, roofs, ceilings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; plug-in component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
decomposebytype_2 = Honeybee_DecomposeBasedOnType(HBZone=geo_all_2)  # -> walls, interiorWalls, airWalls, windows, interiorWindows, skylights, roofs, ceilings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; plug-in component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
interior_wall_3 = Data(interior_wall_2)
window_3 = Data(window_2)
path_mapper_9 = PathMapper(window_3, source="{A}", target="{A;0}")
floor = Geometry([decomposebytype.floors, decomposebytype.exposedFloors, decomposebytype.groundFloors, decomposebytype.undergroundCeilings, decomposebytype.undergroundSlabs])
wall = Geometry([decomposebytype_2.walls, decomposebytype_2.interiorWalls, decomposebytype_2.undergroundWalls])
window_4 = Geometry([decomposebytype_2.windows, decomposebytype_2.interiorWindows, decomposebytype_2.skylights])
path_mapper_10 = PathMapper(interior_wall_3, source="{A}", target="{A;0}")
window_5 = Geometry([window_4, path_mapper_9])
floor_2 = Geometry([floor, path_mapper_10])
path_mapper_11 = PathMapper(window_5, source="{A;B}", target="{1;A}")
path_mapper_12 = PathMapper(floor_2, source="{A;B}", target="{2;A}")
path_mapper_13 = PathMapper(wall, source="{A;B}", target="{0;A}")
panel_2 = Panel(sky_file)
visualize_data = Data([path_mapper_13, path_mapper_11, path_mapper_12])
before_windows_for_test_points = Data(filter_2)
panel_3 = Panel("""0.6
0.05
0.0""")
panel_4 = Panel("""0.2
0.05
0.0""")
panel_5 = Panel("""0.8
0.05
0.0""")
panel_6 = Panel("""0.8
0.05
0.0""")
panel_7 = Panel("""0.6
0.05
0.0""")
wallmaterialname = Panel("Wall")
floormaterialname = Panel("Floor")
ceilingmaterialname = Panel("Ceiling")
roofmaterialname = Panel("Roof")
ceilingmaterialname_2 = Panel("Context")
item_10 = ListItem(List=panel_3, Index=0, Wrap=True)  # -> Item, Item1, Item2
item_11 = ListItem(List=panel_4, Index=0, Wrap=True)  # -> Item, Item1, Item2
item_12 = ListItem(List=panel_5, Index=0, Wrap=True)  # -> Item, Item1, Item2
item_13 = ListItem(List=panel_6, Index=0, Wrap=True)  # -> Item, Item1, Item2
item_14 = ListItem(List=panel_7, Index=0, Wrap=True)  # -> Item, Item1, Item2
lower = Panel("""0
2
500
128
16
0.25""")
radopaquematerial = Honeybee_RadianceOpaqueMaterial(
    materialName=wallmaterialname,
    RReflectance=item_10.Item,
    GReflectance=item_10.Item,
    BReflectance=item_10.Item,
    roughness=item_10.Item1,
    specularity=item_10.Item2)  # -> avrgRef, RADMaterial; plug-in component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
radopaquematerial_2 = Honeybee_RadianceOpaqueMaterial(
    materialName=floormaterialname,
    RReflectance=item_11.Item,
    GReflectance=item_11.Item,
    BReflectance=item_11.Item,
    roughness=item_11.Item1,
    specularity=item_11.Item2)  # -> avrgRef, RADMaterial; plug-in component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
radopaquematerial_3 = Honeybee_RadianceOpaqueMaterial(
    materialName=ceilingmaterialname,
    RReflectance=item_12.Item,
    GReflectance=item_12.Item,
    BReflectance=item_12.Item,
    roughness=item_12.Item1,
    specularity=item_12.Item2)  # -> avrgRef, RADMaterial; plug-in component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
radopaquematerial_4 = Honeybee_RadianceOpaqueMaterial(
    materialName=roofmaterialname,
    RReflectance=item_13.Item,
    GReflectance=item_13.Item,
    BReflectance=item_13.Item,
    roughness=item_13.Item1,
    specularity=item_13.Item2)  # -> avrgRef, RADMaterial; plug-in component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
radopaquematerial_5 = Honeybee_RadianceOpaqueMaterial(
    materialName=ceilingmaterialname_2,
    RReflectance=item_14.Item,
    GReflectance=item_14.Item,
    BReflectance=item_14.Item,
    roughness=item_14.Item1,
    specularity=item_14.Item2)  # -> avrgRef, RADMaterial; plug-in component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

# ----
# quality (0,1,2)
# Ambient Bounces
# Ambient Divisions
# Ambient Super-Samples
# Ambient Resolution
# Ambient Accuracy
before_windows_for_test_points_2 = Data(before_windows_for_test_points)
decomposebytype_3 = Honeybee_DecomposeBasedOnType(HBZone=before_windows_for_test_points_2)  # -> walls, interiorWalls, airWalls, windows, interiorWindows, skylights, roofs, ceilings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; plug-in component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
merge_4 = Merge(
    Data1=decomposebytype_3.floors,
    Data2=decomposebytype_3.exposedFloors,
    Data3=decomposebytype_3.groundFloors,
    Data4=decomposebytype_3.undergroundSlabs)
brep = Brep(merge_4)
trim_3 = TrimTree(Tree=brep, Depth=1)
separatebynormal = Honeybee_SeparateByNormal(geometry=trim_3)  # -> lookingUp, lookingDown, simplify(lookingSide); plug-in component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
final = Panel("""2
9
1500
100
300
0.25""")
flip = Flip(Surface=separatebynormal.lookingDown)  # -> Surface, Result
number_slider = Slider(1, range=0..1)
merge_5 = Merge(Data1=separatebynormal.lookingUp, Data2=flip.Surface)
item_15 = ListItem(List=lower, Index=0, Wrap=True)  # -> Item, Item1, Item2, Item3, Item4, Item5, Item6
trim_4 = TrimTree(Tree=merge_5, Depth=1)
gentestpts = Honeybee_GenerateTestPoints(testGeometry=trim_4, gridSize=Slider(0.5, range=0..1), distBaseSrf=Slider(0.7, range=0..1), moveTestMesh=Toggle(True))  # -> out, simplify(testPoints), simplify(ptsVectors), simplify(facesArea), simplify(mesh); plug-in component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
radparameters = Honeybee_RADParameters(quality=item_15.Item, ab=item_15.Item1, ad=item_15.Item2, as=item_15.Item3, ar=item_15.Item4, aa=item_15.Item5)  # -> readMe, radParameters; plug-in component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
sky_file_2 = Data(sky_file)
gridbasedsimulation = Honeybee_GridBasedSimulation(
    skyFile=sky_file_2,
    testPoints=gentestpts.testPoints,
    ptsVectors=gentestpts.ptsVectors,
    testMesh=gentestpts.mesh,
    simulationType=0,
    radParameters=radparameters.radParameters)  # -> analysisRecipe; plug-in component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

hb_epcontextsrf = HoneybeeEPContextSurfaces(RADMaterial=radopaquematerial_5.RADMaterial)  # -> HBContext; inputs shdSurfaces: list of Brep, justBoundingBox: Boolean
# ---------- hb_epcontextsrf: Python ----------
"""
prepare shading/context geometries

    Args:
        northVectorOrRotation: A vector that shows North or a number that shows
                               the rotation of the North from the Y axis
        bldgMasses: List of closed Breps as thermal zones.
    Returns:
        report: ...
        thermalZones: Thermal zone's geometries for visualiza
"""

ghenv.Component.Name = 'Honeybee EP context Surfaces'
ghenv.Component.NickName = 'HB_EPContextSrf'
ghenv.Component.Message = 'VER 0.0.62\nJUL_28_2017'
ghenv.Component.IconDisplayMode = ghenv.Component.IconDisplayMode.application
ghenv.Component.Category = "Honeybee"
ghenv.Component.SubCategory = "10 | Energy | Energy"
#compatibleHBVersion = VER 0.0.57\nNOV_04_2016
#compatibleLBVersion = VER 0.0.59\nFEB_01_2015
ghenv.Component.AdditionalHelpFromDocStrings = "2"

import rhinoscriptsyntax as rs
import Rhino as rc
import scriptcontext as sc
import os
import System
import Grasshopper.Kernel as gh
import uuid

tolerance = sc.doc.ModelAbsoluteTolerance
import math


def main(shdSurfaces, EPTransSchedule, meshingSettings, justBoundingBox):
    
    # import the classes
    if sc.sticky.has_key('honeybee_release'):

        try:
            if not sc.sticky['honeybee_release'].isCompatible(ghenv.Component): return -1
            if sc.sticky['honeybee_release'].isInputMissing(ghenv.Component): return -1
        except:
            warning = "You need a newer version of Honeybee to use this compoent." + \
            " Use updateHoneybee component to update userObjects.\n" + \
            "If you have already updated userObjects drag Honeybee_Honeybee component " + \
            "into canvas and try again."
            w = gh.GH_RuntimeMessageLevel.Warning
            ghenv.Component.AddRuntimeMessage(w, warning)
            return -1
        
        # don't customize this part
        hb_EPSrf = sc.sticky["honeybee_EPSurface"]
        hb_EPSHDSurface = sc.sticky["honeybee_EPShdSurface"]
        hb_RADMaterialAUX = sc.sticky["honeybee_RADMaterialAUX"]
        hb_EPObjectsAux = sc.sticky["honeybee_EPObjectsAUX"]()
        HBScheduleList = sc.sticky["honeybee_ScheduleLib"].keys()

        ########################################################################
        #----------------------------------------------------------------------#
        shdBreps = []
        # create bounding box of shading geometries
        if justBoundingBox:
            for brep in shdSurfaces:
                if brep.Faces.Count>1 or not brep.Faces[0].IsPlanar(sc.doc.ModelAbsoluteTolerance):
                    shdBreps.append(brep.GetBoundingBox(True).ToBrep())
                else:
                    shdBreps.append(brep)
        else:
            shdBreps = shdSurfaces
        
        shadingClasses = []
        shadingMeshPreview = []
        
        if meshingSettings == None:
            mp = rc.Geometry.MeshingParameters.Minimal
            mp.SimplePlanes = True
        else:
            mp = meshingSettings
        
        def getRadMaterialName(radMaterial):
            nameStr = radMaterial.split(" ")[2]
            name =  nameStr.split("\n")[0]
            return name
        
        for brepCount, brep in enumerate(shdBreps):
            if brep != None:
                isPlanar = True
                # check planarity
                for face in brep.Faces:
                    if not face.IsPlanar(tolerance):
                        isPlanar = False
                        break
                
                shadingBreps = []
                if not isPlanar:
                    meshArray = rc.Geometry.Mesh.CreateFromBrep(brep, mp)
                    for mesh in meshArray:
                        for meshFace in range(mesh.Faces.Count):
                            vertices = list(mesh.Faces.GetFaceVertices(meshFace))[1:]
                            vertices = vertices + [sc.doc.ModelAbsoluteTolerance]
                            # create the brep from mesh
                            shdBrep = rc.Geometry.Brep.CreateFromCornerPoints(*vertices)
                            shadingBreps.append(shdBrep)
                else:
                    for face in brep.Faces:
                        shadingBreps.append(face.DuplicateFace(False))
                
                for faceCount, shdBrep in enumerate(shadingBreps):
                        thisShading = hb_EPSHDSurface(shdBrep, 1000*brepCount + faceCount, 'shdSrf_' + `brepCount` + '_' + `faceCount` + "_" + str(uuid.uuid4()))
                        
                        # add transmittance schedule if any
                        if EPTransSchedule!=None:
                            schedule= EPTransSchedule.upper()
                            if schedule!=None and not schedule.lower().endswith(".csv") and schedule not in HBScheduleList:
                                msg = "Cannot find " + schedule + " in Honeybee schedule library."
                                print msg
                                ghenv.Component.AddRuntimeMessage(gh.GH_RuntimeMessageLevel.Warning, msg)
                                return -1
                            elif schedule!=None and schedule.lower().endswith(".csv"):
                                # check if csv file is existed
                                if not os.path.isfile(schedule):
                                    msg = "Cannot find the shchedule file: " + schedule
                                    print msg
                                    ghenv.Component.AddRuntimeMessage(gh.GH_RuntimeMessageLevel.Warning, msg)
                                    return -1
                            
                            thisShading.TransmittanceSCH = schedule
                        
                        # add the Rad Material if any
                        if RADMaterial!=None:
                            # if it is just the name of the material make sure it is already defined
                            if len(RADMaterial.split(" ")) == 1:
                                # if the material is not in the library add it to the library
                                if not hb_RADMaterialAUX.isMatrialExistInLibrary(RADMaterial):
                                    warningMsg = "Can't find " + RADMaterial + " in RAD Material Library.\n" + \
                                                "Add the material to the library and try again."
                                    ghenv.Component.AddRuntimeMessage(gh.GH_RuntimeMessageLevel.Warning, warningMsg)
                                    return
                                
                                try:
                                    thisShading.setRADMaterial(RADMaterial)
                                except Exception, e:
                                    print e
                                    warningMsg = "You are using an old version of Honeybee_Honeybee! Update your files and try again."
                                    print warningMsg
                                    ghenv.Component.AddRuntimeMessage(gh.GH_RuntimeMessageLevel.Warning, warningMsg)
                                    return
                                
                                addedToLib = True
                            else:
                                
                                # try to add the material to the library
                                addedToLib, thisShading.RadMaterial = hb_RADMaterialAUX.analyseRadMaterials(RADMaterial, True)
                                
                            if addedToLib==False:
                                warningMsg = "Failed to add " + RADMaterial + " to the Library."
                                ghenv.Component.AddRuntimeMessage(gh.GH_RuntimeMessageLevel.Warning, warningMsg)
                                return
                        
                        # add shading to the list
                        shadingClasses.append(thisShading)
                
        # add to the hive
        hb_hive = sc.sticky["honeybee_Hive"]()
        HBContext  = hb_hive.addToHoneybeeHive(shadingClasses, ghenv.Component)
        return HBContext
        ################################################################################################
    else:
        print "You should first let Honeybee to fly..."
        w = gh.GH_RuntimeMessageLevel.Warning
        ghenv.Component.AddRuntimeMessage(w, "You should first let Honeybee to fly...")
        return -1
        

if _shdSurfaces and _shdSurfaces[0]!=None:
    # add cleaning function
    result= main(_shdSurfaces, EPTransSchedule_, meshingSettings_, justBoundingBox_)
    
    if result != -1: HBContext = result
# ---------- end hb_epcontextsrf ----------
setradmaterials = Honeybee_SetRadianceMaterials(
    HBObject=geo_all_2,
    wallRADMaterial=radopaquematerial.RADMaterial,
    roofRADMaterial=radopaquematerial_4.RADMaterial,
    floorRADMaterial=radopaquematerial_2.RADMaterial,
    ceilingRADMaterial=radopaquematerial_3.RADMaterial)  # -> modifiedHBObject; plug-in component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
data_8 = Data(hb_epcontextsrf)
trim_5 = TrimTree(Tree=setradmaterials, Depth=1)
interior_wall_with_windows_5 = Data(interior_wall_with_windows_4)
toggle = FalseStartToggle(False)
toggle_2 = FalseStartToggle(False)
context_6 = Data(context_5)
shades_2 = Data(shades)
geo = Data(trim_5)
rundaylightanalysis = Honeybee_RunDaylightSimulation(
    HBObjects=flatten([context_6, shades_2, geo, interior_wall_with_windows_5]),
    analysisRecipe=gridbasedsimulation,
    writeRad=toggle,
    runRad=toggle_2,
    numOfCPUs=Slider(4, range=0..10),
    radFileName="final3pmv1",
    overwriteResults=Toggle(True))  # -> out, analysisType, resultsUnit, results, testPts, resultFiles, radGeoFile, studyFolder, done; plug-in component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
zone_names_all_zones_3 = Text(zone_names_all_zones_2)
time_text_2 = Data(time_text)

zone_names_all_zones_4 = Text(zone_names_all_zones_3)
illuminance_data_all = Data(rundaylightanalysis.results)
visualize_data_2 = Data(visualize_data)
mesh_data_all = Data(gentestpts.mesh)
irregular_3 = Data(irregular_2)
time_text_3 = Data(time_text_2)
text_data_3 = Data(text_data_2)
