# Grasshopper definition tool_part1_ v7.1_2.gh (Grasshopper 0.9.76)
# plug-ins: Python Interpreter, treesloth01, LunchBox, TT Toolbox

zone_names_all_zones = Text(Tree({0}: ["""lvl 0 Towncenter/rece
2-037""", "lvl 0 Pantry 2-052", "lvl 0 OFFICE 2-024", """lvl 0 Exec OFFICE
2-019""", "lvl 0 OFFICE 2-013", "lvl 0 Huddle 2-012", "lvl 0 OFFICE 2-010", "lvl 0 OFFICE 2-009", "lvl 0 Conf 2-007", "lvl 0 Lounge 2-042", "lvl 0 OFFICE 2-025", "lvl 0 Phone 2-015", "lvl 0 Phone 2-016", """lvl 0 Open OFFICE
2-011""", "lvl 0 Board room 2-036", "lvl 0 Conf 2-033", "lvl 0 Huddle 2-031", """lvl 0 Exec OFFICE
2-029""", """lvl 0 Exec OFFICE
2-028""", "lvl 0 Huddle 2-027", "lvl 0 Conf 2-020", """lvl 0 Exec OFFICE
2-018""", "lvl 0 Conf 2-006", "lvl 0 Phone 2-040", "lvl 0 Phone 2-041", "lvl 0 Phone 2-049", """lvl 0 Exec office
2-050""", "lvl 0 Huddle 2-051", "lvl 0 CONF 2-054", """lvl 0 Open office
2-048""", "lvl 0 Corri 2-034", "lvl 0 Huddle 2-017"], {1}: ["lvl 1 Pantry/teaming 3-005", "lvl 1 Office 3-014", "lvl 1 HUDDLE 3-026", "lvl 1 HUDDLE 3-027", "lvl 1 Huddle 3-031", "lvl 1 Office 3-007", "lvl 1 Open Office 3-010", "lvl 1 Conf 3-034", "lvl 1 Pantry 3-012", "lvl 1 Exec Office 3-013", "lvl 1 Conf 3-015", "lvl 1 Office 3-016", "lvl 1 Shared Office 3-017", "lvl 1 HUDDLE 3-018", "lvl 1 Exec Office 3-019", "lvl 1 HUDDLE 3-020", "lvl 1 HUDDLE 3-025", "lvl 1 HUDDLE 3-028", "lvl 1 HUDDLE 3-029", "lvl 1 Shared Office 3-033", "lvl 1 Office 3-032", "lvl 1 Office 3-008", "lvl 1 Conf 3-006", "lvl 1 Elev Lobby 3-003", "lvl 1 Conf 3-003"], {2}: ["lvl 2 Office 4-003", "lvl 2 HUDDLE 4-037", "lvl 2 Exec office 4-033", "lvl 2 Office 4-029", "lvl 2 Office 4-028", "lvl 2 Office 4-026", "lvl 2 Office 4-025", "lvl 2 Exec office 4-013", "lvl 2 Exec office 4-015", "lvl 2 Exec office 4-020", "lvl 2 Exec office 4-021", "lvl 2 Exec office 4-022", "lvl 2 HUDDLE 4-023", "lvl 2 Office 4-009", "lvl 2 Open Office 4-004", "lvl 2 lunch/pantry 4-000", "lvl 2 Exec office 4-002", "lvl 2 Office 4-006", "lvl 2 HUDDLE 4-038", "lvl 2 Exec office 4-034", "lvl 2 Office 4-027", "lvl 2 Pantry 4-017", "lvl 2 Huddle 4-011", "lvl 2 Exec office 4-012", "lvl 2 Exec office 4-014", "lvl 2 Office 4-005", "lvl 2 Exec office 4-008", "lvl 2 Confe 4-001", "lvl 2 elev lob 4-999"], {3}: ["lvl 3 Exec office 5-025", "lvl 3 Huddle 5-005", """lvl 3 Exec Office
 5-004""", """lvl 3 Exec Office
 5-003""", """lvl 3 Exec Office
 5-002""", """lvl 3 Exec Office
 5-001""", "lvl 3 Office 5-044", "lvl 3 HUDDLE 5-037", "lvl 3 Office 5-036", "lvl 3 Office 5-035", "lvl 3 HUDDLE 5-024", "lvl 3 HUDDLE 5-017", "lvl 3 Exec office 5-016", """lvl 3 Open Office
 5-000""", "lvl 3 CONF 5-042", "lvl 3 CONF 5-041", "lvl 3 Office 5-043", "lvl 3 HUDDLE 5-040", "lvl 3 HUDDLE 5-039", "lvl 3 HUDDLE 5-038", "lvl 3 HUDDLE 5-026", "lvl 3 Exec office 5-023", "lvl 3 HUDDLE 5-018", "lvl 3 CONF 5-015", "lvl 3 elev lob 5-998", "lvl 3 Office 5-999", "lvl 3 Office 5-049", "lvl 3 Pantry 5-021", "lvl 3 Office 5-008", "lvl 3 Office 5-047", "lvl 3 Office 5-048", "lvl 3 Office 5-050", "lvl 3 Office 5-007", "lvl 3 HUDDLE 5-028", "lvl 3 Office 5-029", "lvl 3 Office 5-030"]))
illuminance_data_all = Data(Tree({0}: ["35510.18", "36087.61", "36271.23", "36303.34", "36375.45", "36384.83"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], {1}: ["0.00", "0.00", "0.00", "0.00", "0.00", "0.00", "0.00", "0.00", "0.00", "0.00", "0.00", "0.00", "0.00", "0.00", "0.00", "0.00", "0.00", "0.00", "0.00", "0.00", "0.00", "0.00", "0.00", "0.00", "0.00", "0.00", "0.00", "0.00", "0.00", "0.00", "0.00", "0.00", "0.00", "0.00", "0.00", "0.00"], {2}: ["198.62", "188.49", "172.17", "179.04", "178.91", "218.43", "222.78", "216.40", "219.71", "190.05", "268.89", "283.27", "273.30", "266.84", "238.89", "341.76", "343.50", "342.16", "318.17", "301.84", "414.19", "459.85", "422.19", "417.99", "369.54", "499.39", "560.96", "549.35", "513.49", "446.93", "620.69", "681.37", "699.09", "632.29", "518.17", "748.73", "788.53", "819.26", "795.62", "531.39"], {3}: ["183.25", "193.71", "196.04", "193.26", "182.41", "177.70", "206.12", "230.68", "227.96", "229.26", "219.99", "194.82", "241.85", "269.15", "281.82", "281.10", "264.15", "244.13", "296.80", "334.14", "343.48", "343.98", "321.06", "302.53", "352.68", "401.70", "409.66", "446.57", "407.06", "384.71", "432.17", "495.15", "527.88", "541.02", "517.14", "444.95", "527.36", "633.69", "637.52", "659.63", "662.00", "531.40", "658.74", "764.70", "756.04", "770.36", "763.62", "579.54"], {4}: ["172.28", "187.85", "215.11", "257.08", "319.65", "402.45", "642.71", "950.73", "1304.11", "207.34", "210.49", "241.97", "277.08", "351.78", "460.58", "679.55", "1066.99", "1548.78", "228.29", "229.66", "243.78", "283.24", "361.73", "474.52", "663.07", "1022.58", "1459.06", "243.28", "242.29", "258.98", "265.54", "349.16", "450.14", "615.65", "947.43", "1319.73", "253.28", "241.54", "240.86", "268.12", "314.79", "402.62", "526.19", "226.94", "220.45", "223.33", "245.81", "265.06", "310.43", "339.14", "810.60", "615.21", "1078.65", "158.94"], {5}: ["1.64", "1.26", "1.48", "1.26", "0.90", "0.61", "2.00", "2.02", "1.99", "1.79", "1.31", "0.89", "2.51", "2.82", "2.44", "2.64", "1.81", "1.23", "2.91", "3.92", "4.05", "4.17", "2.94", "1.55", "3.78", "4.50", "5.60", "6.13", "4.63", "2.05", "5.34", "6.88", "8.05", "8.57", "9.34", "5.69"]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))
visualize_data = Data(Tree({0;0}: [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], {0;1}: [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], {0;2}: [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], {0;3}: [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], {1;0}: [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], {1;1}: [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], {1;2}: [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], {1;3}: [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], {2;0}: [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], {2;1}: [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], {2;2}: [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], {2;3}: [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]))
mesh_data_all = Data(Tree({0;0}: [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], {0;1}: [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], {0;2}: [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], {0;3}: [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], {0;4}: [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], {0;5}: [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]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))
irregular = Data(Tree({0;0}: [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], {0;1}: [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], {0;2}: [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], {0;3}: [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]))
time_text = Data("3PM")
text_data = Data(Tree({0;0}: [Point(16.21217837, 62.55393147, 1), Point(20.3121876, 57.20003592, 1), Point(56.66732905, 16.50482017, 1), Point(47.00469015, 9.38680391, 1), Point(35.35013849, 14.32367588, 1), Point(13.01961241, 10.17559054, 1)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], {0;1}: [Point(54.95545663, 29.78269975, 4.5), Point(27.83811803, 25.55059713, 4.5), Point(68.32715006, 16.69270063, 4.5), Point(68.32715006, 22.00777312, 4.5), Point(74.48069107, 10.13590566, 4.5), Point(74.50997922, 14.53021959, 4.5)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], {0;2}: [Point(32.32880068, 31.50466341, 8), Point(54.05330947, 29.95720741, 8), Point(68.63572137, 22.10446905, 8), Point(74.99618626, 8.649426886, 8), Point(74.4975306, 13.29369431, 8), Point(74.51185958, 14.76573478, 8)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], {0;3}: [Point(73.94845627, 31.674831, 11.5), Point(24.06285697, 29.77605421, 11.5), Point(29.35943337, 37.15365077, 11.5), Point(32.47155023, 37.08175369, 11.5), Point(35.27553671, 36.96877255, 11.5), Point(38.08979421, 36.7203601, 11.5)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], {1;0}: ["CONF 2-054", "Pantry 2-052", "Huddle 2-031", "Conf 2-033", "Corri 2-034", "Board room 2-036", """Towncenter/rece
2-037""", "Lounge 2-042", "Phone 2-040", "Phone 2-041", "Phone 2-015", "Phone 2-016", "Huddle 2-017", """Open OFFICE
2-011""", "Conf 2-006", "Conf 2-007", "OFFICE 2-009", "OFFICE 2-010", "Huddle 2-012", "OFFICE 2-013", """Exec OFFICE
2-018""", """Exec OFFICE
2-019""", "Conf 2-020", "OFFICE 2-024", "OFFICE 2-025", "Phone 2-049", """Exec office
2-050""", "Huddle 2-051", """Open office
2-048""", "Huddle 2-027", """Exec OFFICE
2-028""", """Exec OFFICE
2-029"""], {1;1}: ["Open Office 3-010", "Pantry/teaming 3-005", "HUDDLE 3-025", "Pantry 3-012", "HUDDLE 3-020", "HUDDLE 3-018", "Exec Office 3-019", "Shared Office 3-017", "Office 3-016", "Office 3-014", "Exec Office 3-013", "Conf 3-015", "Office 3-007", "Office 3-008", "Conf 3-006", "HUDDLE 3-026", "HUDDLE 3-027", "HUDDLE 3-028", "HUDDLE 3-029", "Shared Office 3-033", "Office 3-032", "Huddle 3-031", "Conf 3-034", "Conf 3-003", "Elev Lobby 3-003"], {1;2}: ["Exec office 4-002", "Open Office 4-004", "Pantry 4-017", "HUDDLE 4-023", "Exec office 4-022", "Exec office 4-021", "Exec office 4-020", "Exec office 4-015", "Exec office 4-014", "Exec office 4-013", "Exec office 4-012", "Huddle 4-011", "Exec office 4-008", "Office 4-005", "Office 4-006", "Office 4-009", "Office 4-003", "HUDDLE 4-038", "HUDDLE 4-037", "Exec office 4-034", "Exec office 4-033", "Office 4-029", "Office 4-028", "Office 4-027", "Office 4-026", "Office 4-025", "lunch/pantry 4-000", "Confe 4-001", "elev lob 4-999"], {1;3}: ["CONF 5-015", """Open Office
 5-000""", """Exec Office
 5-001""", """Exec Office
 5-002""", """Exec Office
 5-003""", """Exec Office
 5-004""", "Huddle 5-005", "Office 5-008", "Office 5-007", "Office 5-050", "Office 5-049", "Office 5-048", "Office 5-047", "CONF 5-042", "Office 5-044", "Office 5-043", "CONF 5-041", "HUDDLE 5-040", "HUDDLE 5-039", "HUDDLE 5-038", "HUDDLE 5-037", "Office 5-036", "Office 5-035", "Office 5-030", "Office 5-029", "Pantry 5-021", "Exec office 5-016", "HUDDLE 5-017", "HUDDLE 5-018", "Exec office 5-023", "HUDDLE 5-028", "HUDDLE 5-024", "Exec office 5-025", "HUDDLE 5-026", "Office 5-999", "elev lob 5-998"], {2;0}: [0.2286, 0.2286, 0.2286, 0.2286, 0.2286, 0.2286, 0.2286, 0.2286, 0.2286, 0.2286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], {2;1}: [0.2286, 0.2286, 0.2286, 0.2286, 0.2286, 0.2286, 0.2286, 0.2286, 0.2286, 0.2286, 0.2286, 0.2286, 0.2286, 0.2286, 0.2286, 0.2286, 0.2286, 0.2286, 0.2286, 0.2286, 0.2286, 0.2286, 0.2286, 0.2286, 0.2286], {2;2}: [0.2286, 0.2286, 0.2286, 0.2286, 0.2286, 0.2286, 0.2286, 0.2286, 0.2286, 0.2286, 0.2286, 0.2286, 0.2286, 0.2286, 0.2286, 0.2286, 0.2286, 0.2286, 0.2286, 0.2286, 0.2286, 0.2286, 0.2286, 0.2286, 0.2286, 0.2286, 0.2286, 0.2286, 0.2286], {2;3}: [0.2286, 0.2286, 0.2286, 0.2286, 0.2286, 0.2286, 0.2286, 0.2286, 0.2286, 0.2286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]))

honeybee = Honeybee_Honeybee()  # -> Vviiiiiiiiiizzz; plug-in component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
ladybug = Ladybug_Ladybug()  # -> Vviiiiiiiiiizzz; plug-in component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
number_slider = Slider(0, range=0..100)

illuminance_data_all_2 = Data(illuminance_data_all)
num_higher_limit = Number(Slider(5400, range=0..10000))
num_lower_limit = Number(Slider(108, range=0..1000))
zone_names_all = Text(zone_names_all_zones)
visualize_data_2 = Data(visualize_data)
number_floor = Data(Slider(0, range=0..9))
mesh_data_all_2 = Data(mesh_data_all)
irregular_2 = Data(irregular)
text_data_2 = Data(text_data)
time_text_2 = Data(time_text)

number_slider_2 = Slider(0, range=0..100)
explode_at_index = ExplodeAtIndex(Data=text_data_2, Index=number_slider, VaryingIndices=True)  # -> _0, _1, _2
explode_at_index_2 = ExplodeAtIndex(Data=visualize_data_2, Index=number_slider, VaryingIndices=True)  # -> _0, _1, _2
item = ListItem(List=zone_names_all, Index=0, Wrap=True)  # -> flatten(Item)
lng = ListLength(List=item)
number = Data(number_floor)
match = MatchTree(Tree=illuminance_data_all_2, Guide=mesh_data_all_2)
trim = TrimTree(Tree=mesh_data_all_2, Depth=1)
number_2 = Data(number_floor)
text_location = Data(explode_at_index._0)
path = DataPath(number)
series = Series(Start=0, Step=1, Count=lng)
irregular_3 = Data(irregular_2)
window = Data(explode_at_index_2._1)
walls = Data(explode_at_index_2._0)
floor = Data(explode_at_index_2._2)
scale = Data(explode_at_index._2)
text = Data(explode_at_index._1)
trim_2 = TrimTree(Tree=match, Depth=1)
path_2 = DataPath(number_2)
branch = TreeBranch(Tree=trim, Path=path, MaintainPaths=True)
level_serese = Integer(series)
irregular_4 = Data(irregular_3)
number_3 = Data(number_floor)
number_4 = Data(number_floor)
number_5 = Data(number_floor)
mjoin = MeshJoin(Meshes=flatten(branch))
branch_2 = TreeBranch(Tree=trim_2, Path=path_2, MaintainPaths=True)
tbi = TreeBranchIndex(DataTree=text_location, BranchIndex=number_3)
tbi_2 = TreeBranchIndex(DataTree=text, BranchIndex=number_3)
tbi_3 = TreeBranchIndex(DataTree=scale, BranchIndex=number_3)
tbi_4 = TreeBranchIndex(DataTree=walls, BranchIndex=number_4)
tbi_5 = TreeBranchIndex(DataTree=window, BranchIndex=number_4)
tbi_6 = TreeBranchIndex(DataTree=irregular_4, BranchIndex=number_5)
tbi_7 = TreeBranchIndex(DataTree=floor, BranchIndex=number_4)
text_location_2 = Data(tbi)
window_2 = Data(tbi_5)
text_2 = Data(tbi_2)
scale_2 = Data(tbi_3)
walls_2 = Data(tbi_4)
floor_2 = Data(tbi_7)
illuminance_1_floor = Data(branch_2)
mesh_1_floor = Data(mjoin)

faceb = FaceBoundaries(Mesh=mesh_1_floor)
round = Round(Number=illuminance_1_floor)  # -> Nearest, Floor, Ceiling
area = Area(Geometry=faceb)  # -> Area, Centroid
tag = TextTag3D(Location=area.Centroid, Text=round.Nearest, Size=Slider(0.2, range=0..1), Justification=7)

illuminance = Data(illuminance_data_all_2)
mesh = Data(mesh_data_all_2)

num_higher_limit_2 = Number(num_higher_limit)
num_lower_limit_2 = Number(num_lower_limit)
panel = Panel(num_higher_limit_2)
panel_2 = Panel(num_lower_limit_2)
analysis_result = Data(illuminance_1_floor)
all_mesh = Data(mesh_1_floor)

# ---- group: inputs
num_no_of_segments = Number("11")
num_scale_of_text = Number(Slider(0.8, range=0..10))
num_analysis_result = Number(analysis_result)
color_upper_limit = Colour(ColourSwatch(SwatchColor=RGB(255, 208, 0)))
color_upper_limit_2 = Colour(ColourSwatch(SwatchColor=RGB(7, 39, 247)))
num_higher_limit_3 = Number(panel)
color_lower_limit = Colour(ColourSwatch(SwatchColor=RGB(255, 255, 255)))
color_lower_limit_2 = Colour(ColourSwatch(SwatchColor=RGB(144, 205, 230)))
num_lower_limit_3 = Number(panel_2)
txt_heading = Text("Lux values")
mesh_2 = Mesh(all_mesh)

# ----
num_higher_limit_4 = Number(num_higher_limit)
num_lower_limit_4 = Number(num_lower_limit)
zone_names_all_2 = Text(zone_names_all)
level_serese_2 = Integer(level_serese)
all_mesh_2 = Mesh(mesh)
number_6 = Data(number_floor)
results = Data(illuminance)

text_location_3 = Data(text_location_2)
time_text_3 = Data(time_text_2)
irregular_5 = Data(tbi_6)
window_3 = Data(window_2)
text_3 = Data(text_2)
scale_3 = Data(scale_2)
walls_3 = Data(walls_2)
floor_3 = Data(floor_2)

# ---- group: legend and mesh colors / divide mesh into 3
num_analysis_result_2 = Number(num_analysis_result)
num_higher_limit_5 = Number(num_higher_limit_3)
num_lower_limit_5 = Number(num_lower_limit_3)
python = PythonScript(Results=num_analysis_result_2, LowerLimit=num_lower_limit_5, HigherLimit=num_higher_limit_5)  # -> out, a, lower, higher; inputs LowerLimit: Int32, HigherLimit: Int32
# ---------- python: Python ----------
if _Results<=_LowerLimit:
    a=True
    lower=False
    higher=True
elif _Results>=_HigherLimit:
    a=True
    lower=True
    higher=False
else:
    a=False
    lower=True
    higher=True
# ---------- end python ----------
mesh_3 = Mesh(mesh_2)
cullf = CullFaces(Mesh=mesh_3, Pattern=python.a)
cullf_2 = CullFaces(Mesh=mesh_3, Pattern=python.lower)
cullf_3 = CullFaces(Mesh=mesh_3, Pattern=python.higher)

# ----
python_2 = PythonScript(Results=results, LowerLimit=num_lower_limit_4, HigherLimit=num_higher_limit_4)  # -> out, a, lower, higher; inputs LowerLimit: Int32, HigherLimit: Int32; same code as python
path_mapper = PathMapper(zone_names_all_2, source="{A}", target="{A}")
all_mesh_3 = Mesh(all_mesh_2)
all_mesh_4 = Mesh(all_mesh_2)
all_mesh_5 = Mesh(all_mesh_2)
number_7 = Data(number_6)
cullf_4 = CullFaces(Mesh=all_mesh_3, Pattern=python_2.a)
cullf_5 = CullFaces(Mesh=all_mesh_5, Pattern=python_2.higher)
cullf_6 = CullFaces(Mesh=all_mesh_4, Pattern=python_2.lower)
number_8 = Data(number_6)
number_9 = Data(number_6)
number_10 = Data(number_6)
tbi_8 = TreeBranchIndex(DataTree=path_mapper, BranchIndex=number_7)
trim_3 = TrimTree(Tree=cullf_4, Depth=1)
trim_4 = TrimTree(Tree=cullf_5, Depth=1)
path_3 = DataPath(number_8)
trim_5 = TrimTree(Tree=cullf_6, Depth=1)
path_4 = DataPath(number_9)
path_5 = DataPath(number_10)
zone_names = Text(path_mapper)
zone_names_2 = Text(tbi_8)
branch_3 = TreeBranch(Tree=trim_3, Path=path_3, MaintainPaths=True)
branch_4 = TreeBranch(Tree=trim_4, Path=path_4, MaintainPaths=True)
branch_5 = TreeBranch(Tree=trim_5, Path=path_5, MaintainPaths=True)
lower = Area(Geometry=branch_5)  # -> Area, Centroid
higher = Area(Geometry=branch_4)  # -> Area, Centroid
lit = Area(Geometry=branch_3)  # -> Area, Centroid
daylitarea = Data(lit.Area)
total = Addition(A=lit.Area, B=lower.Area, C=higher.Area)
totalarea = Data(total)
daylitarea_2 = Data(daylitarea)
zonenames = Data(zone_names_2)
totalarea_2 = Data(lower.Area)
totalarea_3 = Data(higher.Area)

# ---- group: legend and mesh colors / get middle result
num_analysis_result_3 = Number(num_analysis_result)
num_lower_limit_6 = Number(num_lower_limit_3)
smaller = SmallerThan(FirstNumber=num_analysis_result_3, SecondNumber=num_lower_limit_6)  # -> SmallerThan, OrEqualTo
num_higher_limit_6 = Number(num_higher_limit_3)
dispatch = Dispatch(List=num_analysis_result_3, DispatchPattern=smaller.OrEqualTo)  # -> ListA, ListB
larger = LargerThan(FirstNumber=dispatch.ListB, SecondNumber=num_higher_limit_6)  # -> LargerThan, OrEqualTo
dispatch_2 = Dispatch(List=dispatch.ListB, DispatchPattern=larger.OrEqualTo)  # -> ListA, ListB

# ----
irregular_6 = Data(irregular_5)

# ---- group: legend and mesh colors / legend para
num_no_of_segments_2 = Number(num_no_of_segments)
num_lower_limit_7 = Number(num_lower_limit_3)
num_higher_limit_7 = Number(num_higher_limit_3)
color_lower_limit_3 = Colour(color_lower_limit_2)
color_upper_limit_3 = Colour(color_upper_limit_2)
legendpar = Ladybug_LegendParameters(
    lowBound=num_lower_limit_7,
    highBound=num_higher_limit_7,
    numSegments=num_no_of_segments_2,
    customColors=flatten([color_lower_limit_3, color_upper_limit_3]))  # -> legendPar; plug-in component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

# ----
split = TextSplit(Text=zone_names, Separators=" ")
item_2 = ListItem(List=split, Index=Slider(5, range=0..10), Wrap=True)
cset = CreateSet(List=flatten(item_2))  # -> Set, Map
panel_3 = Panel(cset.Set)
panel_4 = Panel("""Conference rooms, Meeting
Offices, Lobby
Conference rooms, Meeting
Office, Corridor
Conference rooms, Meeting
Offices, Private office
Offices, Private office
Offices, Open office
Offices, Private office
Offices, Private office
Data centers, Facilities staff offices""")
replace = ReplaceMembers(Set=flatten(item_2), Find=cset.Set, Replace=panel_4)
match_2 = MatchTreeStructure(DataList=flatten(replace), TreeMask=item_2)
path_mapper_2 = PathMapper(match_2, source="{A;B;C}", target="{A;0}")
number_11 = Data(number_6)
tbi_9 = TreeBranchIndex(DataTree=path_mapper_2, BranchIndex=number_11)
zone_names_3 = Text(tbi_9)
zonenames_2 = Data(zone_names_3)
ins = InsertItems(List=zonenames_2, Item=" ", Indices="0", Wrap=True)
flatten = FlattenTree(Tree=ins, Path="{0}")
lng_2 = ListLength(List=flatten)
ins_2 = InsertItems(List=flatten, Item=" ", Indices=lng_2, Wrap=True)

# ---- group: legend and mesh colors
recolormesh = Ladybug_RecolorMesh(analysisResult=flatten(dispatch_2.ListB), inputMesh=cullf, legendPar=legendpar, analysisTitle=" ")  # -> out, newMesh, newLegend, legendBasePt, meshColors, legendColors; plug-in component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

ladybug_2 = Ladybug_Ladybug()  # -> Vviiiiiiiiiizzz; plug-in component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

# ----
panel_5 = Panel("""2
3
4
5""")

# ---- group: legend and mesh colors
num_no_of_segments_3 = Number(num_no_of_segments)
num_higher_limit_8 = Number(num_higher_limit_3)
num_lower_limit_8 = Number(num_lower_limit_3)
txt_heading_2 = Text(txt_heading)
panel_6 = Panel(num_lower_limit_8)
panel_7 = Panel(num_no_of_segments_3)
panel_8 = Panel(num_higher_limit_8)
round_2 = Round(Number=panel_8)  # -> Nearest, Floor, Ceiling
dom = ConstructDomain(DomainStart=panel_6, DomainEnd=panel_8)
concat = Concatenate(FragmentA="> ", FragmentB=round_2.Nearest)
range = Range(Domain=dom, Steps=panel_7)  # -> flatten(Range)
panel_9 = Panel(concat)
round_3 = Round(Number=range)  # -> Nearest, Floor, Ceiling
data = Data(reverse(["0", round_3.Nearest]))
panel_10 = Panel(txt_heading_2)
replace_2 = ReplaceItems(List=data, Item=panel_9, Indices="0", Wrap=False)  # -> reverse(flatten(List))
txt = Text(panel_10)
data_2 = Data([replace_2, txt])
panel_11 = Panel(data_2)

# ----
lng_3 = ListLength(List=zonenames)
level_serese_3 = Integer(level_serese_2)
number_12 = Data(number_6)
addition = Addition(A=lng_3, B=2)
division = Division(A=daylitarea_2, B=totalarea)
round_4 = Round(Number=totalarea)  # -> Nearest, Floor, Ceiling
round_5 = Round(Number=totalarea_2)  # -> Nearest, Floor, Ceiling
item_3 = ListItem(List=level_serese_3, Index=number_12, Wrap=True)
round_6 = Round(Number=daylitarea_2)  # -> Nearest, Floor, Ceiling
dup = DuplicateData(Data=" ", Number=addition, Order=True)  # -> flatten(Data)
round_7 = Round(Number=totalarea_3)  # -> Nearest, Floor, Ceiling
multiplication = Multiplication(A=division, B=100)
concat_2 = Concatenate(FragmentC="Level ", FragmentA=item_3)
daylitpercentage = Data(multiplication)
number_slider_3 = Slider(0, range=0..100)
ins_3 = InsertItems(List=round_4.Nearest, Item=" ", Indices="0", Wrap=True)
ins_4 = InsertItems(List=round_5.Nearest, Item=" ", Indices="0", Wrap=True)
ins_5 = InsertItems(List=round_6.Nearest, Item=" ", Indices="0", Wrap=True)
ins_6 = InsertItems(List=zonenames, Item=" ", Indices="0", Wrap=True)
ins_7 = InsertItems(List=round_7.Nearest, Item=" ", Indices="0", Wrap=True)
round_8 = Round(Number=daylitpercentage)  # -> Nearest, Floor, Ceiling
ma = MassAddition(Input=flatten(daylitarea_2))  # -> Result, PartialResults
ma_2 = MassAddition(Input=flatten(totalarea))  # -> Result, PartialResults
ma_3 = MassAddition(Input=flatten(totalarea))  # -> Result, PartialResults
ma_4 = MassAddition(Input=flatten(daylitarea_2))  # -> Result, PartialResults
ma_5 = MassAddition(Input=flatten(totalarea_2))  # -> Result, PartialResults
flatten_2 = FlattenTree(Tree=ins_3, Path="{0}")
flatten_3 = FlattenTree(Tree=ins_4, Path="{0}")
flatten_4 = FlattenTree(Tree=ins_5, Path="{0}")
ma_6 = MassAddition(Input=flatten(totalarea_3))  # -> Result, PartialResults
flatten_5 = FlattenTree(Tree=ins_6, Path="{0}")
flatten_6 = FlattenTree(Tree=ins_7, Path="{0}")
concat_3 = Concatenate(FragmentA=concat_2, FragmentB=" Total")
division_2 = Division(A=ma.Result, B=ma_2.Result)
replace_3 = ReplaceItems(List=dup, Item=concat_2, Indices=number_slider_3, Wrap=False)  # -> reverse(List)
ins_8 = InsertItems(List=round_8.Nearest, Item=" ", Indices="0", Wrap=True)
lng_4 = ListLength(List=flatten_5)
round_9 = Round(Number=ma_4.Result)  # -> Nearest, Floor, Ceiling
lng_5 = ListLength(List=flatten_4)
round_10 = Round(Number=ma_3.Result)  # -> Nearest, Floor, Ceiling
lng_6 = ListLength(List=flatten_2)
round_11 = Round(Number=ma_5.Result)  # -> Nearest, Floor, Ceiling
lng_7 = ListLength(List=flatten_3)
round_12 = Round(Number=ma_6.Result)  # -> Nearest, Floor, Ceiling
lng_8 = ListLength(List=flatten_6)
multiplication_2 = Multiplication(A=division_2, B=100)
ins_9 = InsertItems(List=flatten_5, Item=" ", Indices=lng_4, Wrap=True)
flatten_7 = FlattenTree(Tree=ins_8, Path="{0}")
ins_10 = InsertItems(List=flatten_2, Item=round_10.Nearest, Indices=lng_6, Wrap=True)
ins_11 = InsertItems(List=flatten_6, Item=round_12.Nearest, Indices=lng_8, Wrap=True)
ins_12 = InsertItems(List=flatten_4, Item=round_9.Nearest, Indices=lng_5, Wrap=True)
ins_13 = InsertItems(List=flatten_3, Item=round_11.Nearest, Indices=lng_7, Wrap=True)
round_13 = Round(Number=multiplication_2)  # -> Nearest, Floor, Ceiling
replace_4 = ReplaceItems(List=replace_3, Item=concat_3, Indices=number_slider_3, Wrap=False)  # -> reverse(List)
lng_9 = ListLength(List=flatten_7)
ins_14 = InsertItems(List=flatten_7, Item=round_13.Nearest, Indices=lng_9, Wrap=True)
lng_10 = ListLength(List=ins_9)
dup_2 = DuplicateData(Data=" ", Number=lng_10, Order=True)

entwine = Entwine(Branch00=replace_4, Branch01=ins_9, Branch02=ins_12, Branch03=ins_10, Branch04=ins_14, FlattenInputs=True)
entwine_2 = Entwine(
    Branch00=replace_4,
    Branch01=ins_9,
    Branch02=ins_2,
    Branch03=ins_10,
    Branch04=dup_2,
    Branch05=ins_12,
    Branch06=ins_11,
    Branch07=dup_2,
    Branch08=ins_10,
    FlattenInputs=True)  # disabled
panel_12 = Panel(round_13.Nearest)
column_headings = Panel("""Level A
Space ID B
Space Type C,D
Total floor Area E
F
Daylit Area (sqm) G
Glare area (sqm) H
 I
Daylit Area (%) j""")  # disabled
column_headings_2 = Panel("""Level
Zone
Daylit Area (sqm)
Total Area (sqm)
Daylit Area (%)""")

panel_13 = Panel(entwine_2)
directory = Panel("A:\Desktop\balt")

# ---- group: outputs
color_lower_limit_4 = Colour(color_lower_limit)
color_upper_limit_4 = Colour(color_upper_limit)
higher_2 = Geometry(cullf_3)
lower_2 = Geometry(cullf_2)

# ---- group: outputs / mid
analysis_mesh = Geometry(recolormesh.newMesh)

# ----
directory_2 = Panel("C:\Users\EDS-40\Desktop\alt")  # disabled
concat_4 = Concatenate(FragmentA=directory, FragmentB="\")
bool = Boolean(Toggle(False))
concat_5 = Concatenate()  # disabled
toggle = BooleanToggle(True)
number_slider_4 = Slider(0.01, range=0..0.01)
number_slider_5 = Slider(8000, range=0..10000)
number_slider_6 = Slider(5000, range=0..10000)
number_slider_7 = Slider(1000, range=0..1000)
toggle_2 = BooleanToggle(True)

# ---- group: outputs
color_upper_limit_5 = Colour(color_upper_limit_4)
color_lower_limit_5 = Colour(color_lower_limit_4)
higher_3 = Geometry(higher_2)
lower_3 = Geometry(lower_2)

# ---- group: outputs / mid
analysis_mesh_2 = Geometry(analysis_mesh)

# ----
text_location_4 = Data(text_location_3)
text_4 = Data(text_3)
scale_4 = Data(scale_3)
tag_2 = TextTag3D(Location=text_location_4, Text=text_4, Size=scale_4, Colour=ColourSwatch(SwatchColor=RGB(0, 0, 0)), Justification=1)

bbox = BoundingBox(Content=flatten([irregular_6, cullf_3, cullf, cullf_2]), Plane=PlaneXY(0, 0, 0), UnionBox=True)  # -> Box, Box_2
debox = DeconstructBox(Box=bbox.Box)  # -> Plane, X, Y, Z
dedomain = DeconstructDomain(Domain=debox.X)  # -> Start, End
addition_2 = Addition(A=dedomain.End, B=1)
pt = ConstructPoint(XCoordinate=addition_2, YCoordinate=0, ZCoordinate=0)
pt_2 = Point(pt)
pt_3 = Point(pt)

dedomain_2 = DeconstructDomain(Domain=debox.Y)  # -> Start, End
dedomain_3 = DeconstructDomain(Domain=debox.Z)  # -> Start, End
dedomain_4 = DeconstructDomain(Domain=debox.X)  # -> Start, End
number_slider_8 = Slider(-4, range=-10..0)
pt_4 = ConstructPoint(XCoordinate=dedomain_4.Start, YCoordinate=dedomain_2.Start, ZCoordinate=dedomain_3.Start)
level_serese_4 = Integer(level_serese)
number_13 = Data(number_floor)
Y = UnitY(Factor=number_slider_8)
neg = Negative(Value=number_slider_8)
time_text_4 = Data(time_text_3)
item_4 = ListItem(List=panel_5, Index=number_13, Wrap=True)
move = Move(Geometry=pt_4, Motion=Y)  # -> Geometry, Transform
division_3 = Division(A=neg, B=2)
concat_6 = Concatenate(Level="Level ", B=item_4, space=" ", A=time_text_4)
text_location_5 = Data(move.Geometry)
text_5 = Data(concat_6)
scale_5 = Data(division_3)

panel_14 = Panel(level_serese_4)
file_name = Data(concat_6)
file_name_2 = Data(concat_6)  # disabled
concat_7 = Concatenate(FragmentA=concat_4, FragmentB=file_name, FragmentC=".xlsx")
concat_8 = Concatenate(FragmentA=directory_2, FragmentB=file_name_2, FragmentC=".xlsx")  # disabled
excelwrite = ExcelWrite(
    WriteExcelData=False,
    WorkbookPath=concat_8,
    WorksheetName="Sheet1",
    ColumnHeadings=column_headings,
    Data=entwine_2,
    ClearSheet=bool)  # disabled
excelwrite_2 = ExcelWrite(
    WriteExcelData=bool,
    WorkbookPath=concat_7,
    WorksheetName="Sheet1",
    ColumnHeadings=column_headings_2,
    Data=entwine,
    ClearSheet=bool)

text_location_6 = Data(text_location_5)
text_6 = Data(text_5)
scale_6 = Data(scale_5)
tag_3 = TextTag3D(Location=text_location_6, Text=text_6, Size=scale_6, Colour=ColourSwatch(SwatchColor=RGB(0, 0, 0)), Justification=7)

captureview = Ladybug_CaptureView(
    fileName=file_name_2,
    folder=concat_4,
    viewNames="Top",
    imageWidth=Slider(10000, range=0..10000),
    keepAspectR=toggle_2,
    transparBack=toggle_2,
    capture=bool)  # -> imagePath; plug-in component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

# ---- group: legend and mesh colors / creating legend
item_5 = ListItem(List=recolormesh.newLegend, Index=0, Wrap=True)
faceb_2 = FaceBoundaries(Mesh=item_5)
item_6 = ListItem(List=faceb_2, Index=0, Wrap=True)
rev = ReverseList(List=faceb_2)
item_7 = ListItem(List=rev, Index=0, Wrap=True)
geo = Geometry(item_6)
boundary = BoundarySurfaces(Edges=geo)
geo_2 = Geometry(item_7)
boundary_2 = BoundarySurfaces(Edges=geo_2)
dim = Dimensions(Surface=boundary)  # -> UDimension, VDimension
size_of_box = Number(dim.UDimension)
Y_2 = UnitY(Factor=size_of_box)
rev_2 = Reverse(Vector=Y_2)
boundary_3 = Data(faceb_2)
area_2 = Area(Geometry=boundary_3)  # -> Area, Centroid
size_of_box_2 = Number(dim.UDimension)
division_4 = Division(A=size_of_box_2, B=2)
Y_3 = UnitY(Factor=division_4)
size_of_box_3 = Number(dim.UDimension)
rev_3 = Reverse(Vector=Y_3)
X = UnitX(Factor=size_of_box_3)
size_of_box_4 = Number(dim.UDimension)
Y_4 = UnitY(Factor=size_of_box_4)
multiplication_3 = Multiplication(A=Y_4, B=1.5)

# ---- group: legend and mesh colors / creating legend / low
move_2 = Move(Geometry=boundary, Motion=rev_2)  # -> Geometry, Transform

# ---- group: legend and mesh colors / creating legend / high
move_3 = Move(Geometry=boundary_2, Motion=Y_2)  # -> Geometry, Transform

# ---- group: legend and mesh colors / creating legend (continued)
area_3 = Area(Geometry=move_3.Geometry)  # -> Area, Centroid
area_4 = Area(Geometry=move_2.Geometry)  # -> Area, Centroid
data_3 = Data([area_4.Centroid, area_2.Centroid, area_3.Centroid])
move_4 = Move(Geometry=data_3, Motion=rev_3)  # -> Geometry, Transform
move_5 = Move(Geometry=move_4.Geometry, Motion=X)  # -> Geometry, Transform
item_8 = ListItem(List=reverse(move_5.Geometry), Index=0, Wrap=True)
move_6 = Move(Geometry=item_8, Motion=multiplication_3)  # -> Geometry, Transform
data_4 = Data([move_5.Geometry, move_6.Geometry])

# ---- group: outputs
num_scale_of_text_2 = Number(num_scale_of_text)
panel_15 = Panel(num_scale_of_text_2)
points_for_text_legend = Data(data_4)
text_for_legend = Data(panel_11)

color_upper_limit_6 = Colour(color_upper_limit)
color_lower_limit_6 = Colour(color_lower_limit)
original_boxes = Geometry(item_5)
higher_4 = Geometry(move_3.Geometry)
lower_4 = Geometry(move_2.Geometry)

# ----
bbox_2 = BoundingBox(Content=flatten([higher_4, original_boxes, lower_4]), Plane=PlaneXY(0, 0, 0), UnionBox=True)  # -> Box, Box_2
debox_2 = DeconstructBox(Box=bbox_2.Box)  # -> Plane, X, Y, Z
dedomain_5 = DeconstructDomain(Domain=debox_2.X)  # -> Start, End
pt_5 = ConstructPoint(XCoordinate=dedomain_5.Start, YCoordinate=0, ZCoordinate=0)
pt_6 = Point(pt_5)
vec2pt = Vector2Pt(PointA=pt_6, PointB=pt_3, Unitize=False)  # -> Vector, Length
X_2 = UnitX(Factor=vec2pt.Vector)

move_7 = Move(Geometry=original_boxes, Motion=X_2)  # -> Geometry, Transform
move_8 = Move(Geometry=higher_4, Motion=X_2)  # -> Geometry, Transform
move_9 = Move(Geometry=lower_4, Motion=X_2)  # -> Geometry, Transform
move_10 = Move(Geometry=points_for_text_legend, Motion=X_2)  # -> Geometry, Transform

# ---- group: outputs
num_scale_of_text_3 = Number(panel_15)
panel_16 = Panel(num_scale_of_text_3)
points_for_text_legend_2 = Data(move_10.Geometry)
swatch = ColourSwatch(SwatchColor=RGB(0, 0, 0))
text_for_legend_2 = Data(text_for_legend)

color_upper_limit_7 = Colour(color_upper_limit_6)
color_lower_limit_7 = Colour(color_lower_limit_6)
original_boxes_2 = Geometry(move_7.Geometry)
higher_5 = Geometry(move_8.Geometry)
lower_5 = Geometry(move_9.Geometry)

# ---- group: preview
original_boxes_3 = Geometry(original_boxes_2)
analysis_mesh_3 = Geometry(analysis_mesh_2)
preview = CustomPreview(Geometry=higher_3, Shader=color_upper_limit_5)
preview_2 = CustomPreview(Geometry=lower_3, Shader=color_lower_limit_5)
preview_3 = CustomPreview(Geometry=higher_5, Shader=color_upper_limit_7)
preview_4 = CustomPreview(Geometry=lower_5, Shader=color_lower_limit_7)
tag_4 = TextTag3D(Location=points_for_text_legend_2, Text=text_for_legend_2, Size=panel_16, Colour=swatch, Justification=4)

# ----
walls_4 = Data(walls_3)
irregular_7 = Data(irregular_6)
window_4 = Data(window_3)
floor_4 = Data(floor_3)
preview_5 = CustomPreview(Geometry=irregular_7, Shader=ColourSwatch(SwatchColor=RGB(125, 125, 125)))
preview_6 = CustomPreview(Geometry=window_4, Shader=ColourSwatch(SwatchColor=RGB(0, 236, 252)))
preview_7 = CustomPreview(Geometry=floor_4, Shader=ColourSwatch(SwatchColor=RGB(255, 255, 255)))

python_3 = PythonScript(planarSurfBreps=walls_4, thickness=Slider(0.05, range=0..0.1))  # -> out, solid; inputs planarSurfBreps: list of Brep
# ---------- python_3: Python ----------
import rhinoscriptsyntax as rs
import Rhino.Geometry as rg
import scriptcontext as sc

import clr
clr.AddReference("Grasshopper")
from Grasshopper.Kernel.Data import GH_Path
from Grasshopper import DataTree

tolerance = sc.doc.ModelAbsoluteTolerance

solid = DataTree[rg.Brep]()

i = 0
for srf in planarSurfBreps:
    path = GH_Path(i)
    i += 1
    osrf = rs.OffsetSurface(srf,thickness/2,tolerance,True,True)
    if(osrf != None):
        solid.AddRange([rs.coercebrep(osrf)], path)
        rs.DeleteObjects(osrf)
    else:
        print "offset surface failed with "+str(srf)
# ---------- end python_3 ----------

preview_8 = CustomPreview(Geometry=python_3.solid, Shader=ColourSwatch(SwatchColor=RGB(125, 125, 125)))
