# Grasshopper definition tool_v6_15.gh (Grasshopper 0.9.76)
# plug-ins: Heteroptera, MeshEdit Components, Python Interpreter, Human UI, Human, FalseStartToggle, LunchBox, MetaHopper, TT Toolbox

ladybug = Ladybug_Ladybug()  # -> out; plug-in component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
honeybee = Honeybee_Honeybee()  # -> out; plug-in component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

# ----
# TAB 0 GEOMETRY INPUTS
panel = Panel("Enter No of Floors")
label = CreateLabel(LabelText=panel, LabelSize=expr("x*0.9", 18), Justification=0)
textbox = CreateTextBox(Label="Floors Above Ground (eg. 6)", DefaultText="0", UpdateButton=True, showLabel=True)
textbox_2 = CreateTextBox(Label="Floors Under Ground (eg. 2)", DefaultText="0", UpdateButton=True, showLabel=True)
label_2 = CreateLabel(LabelText="Enter No of Window Types", LabelSize=expr("x*0.9", 18), Justification=0)
textbox_3 = CreateTextBox(UpdateButton=True, showLabel=True)
label_3 = CreateLabel(LabelText="Enter No of Horizontal Shade Types", LabelSize=expr("x*0.9", 18), Justification=0)
textbox_4 = CreateTextBox(UpdateButton=True, showLabel=True)
label_4 = CreateLabel(LabelText="Enter No of Vertical Shade Types", LabelSize=expr("x*0.9", 18), Justification=0)
textbox_5 = CreateTextBox(UpdateButton=True, showLabel=True)
entwine = Entwine(Branch00=label_2, Branch01=textbox_3, FlattenInputs=True)
entwine_2 = Entwine(Branch00=label_4, Branch01=textbox_5, FlattenInputs=True)
entwine_3 = Entwine(Branch00=label_3, Branch01=textbox_4, FlattenInputs=True)
entwine_4 = Entwine(
    Branch00=label,
    Branch01=textbox,
    Branch02=textbox_2,
    Branch03=entwine,
    Branch04=entwine_3,
    Branch05=entwine_2,
    FlattenInputs=True)
values = ValueListener(Elements=textbox, SomeProperty=True)  # -> Values, Indices
values_2 = ValueListener(Elements=textbox_2, SomeProperty=True)  # -> Values, Indices
panel_2 = Panel(values.Values)
panel_3 = Panel(values_2.Values)
stack = CreateStack(UIElements=entwine_4, Horizontal=False)

number_slider = Slider(0.6, range=0..1)
radopaquematerial = Honeybee_RadianceOpaqueMaterial(
    materialName="Unoccupiued Zone_Context",
    RReflectance=number_slider,
    GReflectance=number_slider,
    BReflectance=number_slider,
    roughness="0.05",
    specularity="0")  # -> avrgRef, RADMaterial; plug-in component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
txt = Text("0")
txt_2 = Text("1")
panel_4 = Panel("""Floor Levels            
Window Geometry            
Horizontal Shading            
Vertical Shading""")

# ----
# TAB 2 MATERIALS
panel_5 = Panel("Enter Material Properties")
panel_6 = Panel("""Wall Material
Window Material
Roof Material
Floor Material
Ceiling Material
Skylight Material
Context Material""")
default_reflectance = Panel("""0.6
 
0.8
0.2
0.8
0.4
0.6""")
default_roughness = Panel("0.05")
default_specularity = Panel("0")
default_refractive_index = Panel("1.52")
label_5 = CreateLabel(LabelText=panel_5, LabelSize=expr("x*0.9", 18), Justification=0)
label_6 = CreateLabel(LabelText=panel_6, LabelSize=expr("x*0.9", 18), Justification=0)
item = ListItem(List=label_6, Index=0, Wrap=True)  # -> Item, Item1, Item2, Item3, Item4, Item5, Item6
item_2 = ListItem(List=reverse(default_reflectance), Index=0, Wrap=True)  # -> Item, Item1, Item2, Item3, Item4, Item5, Item6
toggle = BooleanToggle(False)
label_7 = Label("Refractive Index ")
textbox_6 = CreateTextBox(Label="Reflectance        ", DefaultText=item_2.Item, UpdateButton=True, showLabel=True)
textbox_7 = CreateTextBox(Label="Roughness         ", DefaultText=default_roughness, UpdateButton=True, showLabel=True)
textbox_8 = CreateTextBox(Label="Specularity         ", DefaultText=default_specularity, UpdateButton=True, showLabel=True)
textbox_9 = CreateTextBox(Label="Reflectance        ", DefaultText=item_2.Item1, UpdateButton=True, showLabel=True)
textbox_10 = CreateTextBox(Label=label_7, DefaultText=default_refractive_index, UpdateButton=True, showLabel=True)
textbox_11 = CreateTextBox(Label="Reflectance        ", DefaultText=item_2.Item2, UpdateButton=True, showLabel=True)
textbox_12 = CreateTextBox(Label="Roughness         ", DefaultText=default_roughness, UpdateButton=True, showLabel=True)
textbox_13 = CreateTextBox(Label="Specularity         ", DefaultText=default_specularity, UpdateButton=True, showLabel=True)
textbox_14 = CreateTextBox(Label="Reflectance        ", DefaultText=item_2.Item3, UpdateButton=True, showLabel=True)
textbox_15 = CreateTextBox(Label="Roughness         ", DefaultText=default_roughness, UpdateButton=True, showLabel=True)
textbox_16 = CreateTextBox(Label="Specularity         ", DefaultText=default_specularity, UpdateButton=True, showLabel=True)
textbox_17 = CreateTextBox(Label="Reflectance        ", DefaultText=item_2.Item4, UpdateButton=True, showLabel=True)
textbox_18 = CreateTextBox(Label="Roughness         ", DefaultText=default_roughness, UpdateButton=True, showLabel=True)
textbox_19 = CreateTextBox(Label="Specularity         ", DefaultText=default_specularity, UpdateButton=True, showLabel=True)
textbox_20 = CreateTextBox(Label="Reflectance        ", DefaultText=item_2.Item5, UpdateButton=True, showLabel=True)
textbox_21 = CreateTextBox(Label=label_7, DefaultText=default_refractive_index, UpdateButton=True, showLabel=True)
textbox_22 = CreateTextBox(Label="Specularity         ", DefaultText=default_specularity, UpdateButton=True, showLabel=True)
textbox_23 = CreateTextBox(Label="Reflectance        ", DefaultText=item_2.Item6, UpdateButton=True, showLabel=True)
textbox_24 = CreateTextBox(Label="Roughness         ", DefaultText=default_roughness, UpdateButton=True, showLabel=True)
merge = Merge(Data1=textbox_23, Data2=textbox_24, Data3=textbox_22)
merge_2 = Merge(Data1=textbox_20, Data2=textbox_21)
stack_2 = CreateStack(UIElements=merge_2, Horizontal=toggle)
merge_3 = Merge(Data1=textbox_17, Data2=textbox_18, Data3=textbox_19)
merge_4 = Merge(Data1=textbox_14, Data2=textbox_15, Data3=textbox_16)
merge_5 = Merge(Data1=textbox_11, Data2=textbox_12, Data3=textbox_13)
merge_6 = Merge(Data1=textbox_9, Data2=textbox_10)
merge_7 = Merge(Data1=textbox_6, Data2=textbox_7, Data3=textbox_8)
stack_3 = CreateStack(UIElements=merge_7, Horizontal=toggle)
stack_4 = CreateStack(UIElements=merge_5, Horizontal=toggle)
stack_5 = CreateStack(UIElements=merge_4, Horizontal=toggle)
stack_6 = CreateStack(UIElements=merge_3, Horizontal=toggle)
stack_7 = CreateStack(UIElements=merge, Horizontal=toggle)
stack_8 = CreateStack(UIElements=merge_6, Horizontal=toggle)
merge_8 = Merge(
    Data1=item.Item,
    Data2=stack_7,
    Data3=item.Item1,
    Data4=stack_2,
    Data5=item.Item2,
    Data6=stack_6,
    Data7=item.Item3,
    Data8=stack_5,
    Data9=item.Item4,
    Data10=stack_4,
    Data11=item.Item5,
    Data12=stack_8,
    Data13=item.Item6,
    Data14=stack_3)
stack_9 = CreateStack(UIElements=merge_8, Horizontal=False)
merge_9 = Merge(Data1=label_5, Data2=stack_9)

values_3 = ValueListener(Elements=merge, SomeProperty=True)  # -> Values, Indices
values_4 = ValueListener(Elements=merge_4, SomeProperty=True)  # -> Values, Indices
values_5 = ValueListener(Elements=merge_6, SomeProperty=True)  # -> Values, Indices
values_6 = ValueListener(Elements=merge_2, SomeProperty=True)  # -> Values, Indices
values_7 = ValueListener(Elements=merge_5, SomeProperty=True)  # -> Values, Indices
values_8 = ValueListener(Elements=merge_3, SomeProperty=True)  # -> Values, Indices
values_9 = ValueListener(Elements=merge_7, SomeProperty=True)  # -> Values, Indices
entwine_5 = Entwine(
    Branch00=values_3.Values,
    Branch01=values_6.Values,
    Branch02=values_8.Values,
    Branch03=values_4.Values,
    Branch04=values_7.Values,
    Branch05=values_5.Values,
    Branch06=values_9.Values,
    FlattenInputs=True)
ignore_this_thing = Number(entwine_5)

# ----
# TAB 3 RECIPE
panel_7 = Panel("Select EPW File")
panel_8 = Panel(" Quality                                   ")
panel_9 = Panel("""Ambient Bounces              
Ambient Divisions             
Ambient Super-Samples   
Ambient Resolution          
Ambient Accuracy             """)
radparams = Panel("""2
512
128
16
0.25""")
panel_10 = Panel("""Grid Size                                  
Distance from Base Surface     """)
# Analysis Recipe + Simulation
panel_11 = Panel("""1
0.750""")
textbox_25 = CreateTextBox(Label=panel_9, DefaultText=radparams, UpdateButton=True, showLabel=True)
textbox_26 = CreateTextBox(Label="Specify Rotation Angle", DefaultText="0", UpdateButton=Toggle(True), showLabel=True)
label_8 = CreateLabel(LabelText="Input Radiance Parameters", LabelSize=expr("x*0.9", 18), Justification=0)
label_9 = CreateLabel(LabelText="Create Analysis Grid", LabelSize=expr("x*0.9", 18), Justification=0)
filepicker = CreateFilePicker(ButtonLabelText=panel_7, DialogType=0, MustExist=True, Filter="All Files|*.*")
label_10 = CreateLabel(LabelText="Create Daylight Analysis Recipe", LabelSize=expr("x*0.9", 18), Justification=0)
label_11 = CreateLabel(LabelText="Input Weather File", LabelSize=expr("x*0.9", 18), Justification=0)
textbox_27 = CreateTextBox(Label=panel_10, DefaultText=panel_11, UpdateButton=True, showLabel=True)
label_12 = CreateLabel(LabelText=panel_8, LabelSize=12, Justification=0)
radiobtn = CreateRadioButton(RadioButtonName="Low      ", RadioButtonGroup=panel_8, InitiallySelected=True)
radiobtn_2 = CreateRadioButton(RadioButtonName="Medium      ", RadioButtonGroup=panel_8, InitiallySelected=False)
radiobtn_3 = CreateRadioButton(RadioButtonName="High      ", RadioButtonGroup=panel_8, InitiallySelected=False)
values_10 = ValueListener(Elements=textbox_26, SomeProperty=True)  # -> Values, Indices
merge_10 = Merge(Data1=label_12, Data2=radiobtn, Data3=radiobtn_2, Data4=radiobtn_3)
values_11 = ValueListener(Elements=radiobtn, SomeProperty=True)  # -> Values, Indices
values_12 = ValueListener(Elements=radiobtn_2, SomeProperty=True)  # -> Values, Indices
values_13 = ValueListener(Elements=radiobtn_3, SomeProperty=True)  # -> Values, Indices
merge_11 = Merge(Data1=label_9, Data2=textbox_27)
merge_12 = Merge(Data1=label_10, Data2=label_11, Data3=filepicker, Data4=textbox_26)
stack_10 = CreateStack(UIElements=merge_10, Horizontal=True)
stack_11 = CreateStack(UIElements=merge_11, Horizontal=False)
merge_13 = Merge(Data1=values_11.Values, Data2=values_12.Values, Data3=values_13.Values)
num = Number(merge_13)
python = PythonScript(x=num)  # -> a; inputs x: list of Int32
# ---------- python: Python ----------
for i in range(len(x)):
    if x[i] == 1:
        a = i
# ---------- end python ----------
entwine_6 = Entwine(Branch00=merge_12, Branch01=label_8, Branch02=stack_10, Branch03=textbox_25, Branch04=stack_11, FlattenInputs=True)
stack_12 = CreateStack(UIElements=entwine_6, Horizontal=False)

# ---- group: EPW
values_14 = ValueListener(Elements=filepicker, SomeProperty=True)  # -> Values, Indices
epw_file_path = FilePath(values_14.Values)

# ---- group: Grid
values_15 = ValueListener(Elements=textbox_27, SomeProperty=True)  # -> Values, Indices
bang = ExplodeTree(Data=values_15.Values)  # -> Branch0, Branch1

# ---- group: Rad Params
values_16 = ValueListener(Elements=textbox_25, SomeProperty=True)  # -> Values, Indices
bang_2 = ExplodeTree(Data=values_16.Values)  # -> Branch0, Branch1, Branch2, Branch3, Branch4

# ----
panel_12 = Panel("""5400
3000
3000""")
panel_13 = Panel("""108
300
300""")
data = Data(Tree({0}: ["689.63", "735.63", "765.28", "769.51", "776.54", "768.35", "740.62", "689.48", "681.93", "701.69"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], {1}: ["60.76", "57.15", "68.52", "77.71", "98.12", "137.56"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], {2}: ["16427.04", "17290.48", "769.53", "493.84", "312.64", "334.46", "345.72", "196.34", "179.07", "188.96"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], {3}: ["0.15", "0.02", "0.05", "0.00", "0.00", "0.00", "0.00", "0.00", "0.00", "0.00"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], {4}: ["0.00", "0.00", "0.00", "0.00", "0.00", "0.00", "0.00", "0.00", "0.00", "0.00"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], {5}: ["308.93", "581.09", "44314.43", "170.01", "43387.07", "134.57"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]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))
data_2 = Data(Tree({0;0}: [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], {0;1}: [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], {0;2}: [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], {0;3}: [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], {0;4}: [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], {1;0}: [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]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))
mesh = Mesh(data_2)
results = Data(data)
match = MatchTree(Tree=results, Guide=mesh)
trim = TrimTree(Tree=match, Depth=1)
trim_2 = TrimTree(Tree=mesh, Depth=1)
path = DataPath()
path_2 = DataPath()
branch = TreeBranch(Tree=trim_2, Path=path, MaintainPaths=True)
branch_2 = TreeBranch(Tree=trim, Path=path_2, MaintainPaths=True)
data_3 = Data(Tree({0;0}: [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], {0;1}: [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], {0;2}: [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], {1;0}: [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], {1;1}: [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], {1;2}: [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], {1;3}: [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], {2;0}: [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], {2;1}: [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], {2;2}: [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]))
mjoin = MeshJoin(Meshes=flatten(branch))
path_3 = DataPath()
path_4 = DataPath()
path_5 = DataPath()

# ---- group: Analysis Results
data_4 = Data(Tree({0}: ["0.00", "0.00", "0.00", "0.00", "0.00", "0.00", "0.00", "0.00", "0.00", "0.00"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], {1}: ["0.00", "0.00", "0.00", "0.00", "0.00", "0.00", "0.00", "0.00", "0.00", "0.00"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], {2}: ["0.00", "0.00", "0.00", "0.00", "0.00", "0.00", "0.00", "0.00", "0.00", "0.00"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], {3}: ["82.30", "177.39", "271.35", "747.18", "739.10", "414.38"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], {4}: ["74.13", "88.98", "239.70", "664.14", "386.68", "288.68", "231.35", "232.75", "277.72", "255.28"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], {5}: ["183.05", "170.81", "155.49", "190.06", "215.67", "233.50", "233.23", "279.21", "331.03", "354.87"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], {6}: ["0.00", "0.00", "0.00", "0.00", "0.00", "0.00", "0.00", "0.00", "0.00", "0.00"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], {7}: ["121.13", "627.11", "763.06", "475.68", "397.31", "317.35"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], {8}: ["55.38", "61.92", "71.31", "69.32", "77.72", "79.00", "72.43", "78.75", "70.76", "82.58"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], {9}: ["188.30", "189.68", "334.21", "696.47", "484.21", "427.56", "375.15", "451.12", "532.11", "559.41"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]))

# ---- group: MeshData
mesh_2 = Mesh(Tree({0;0}: [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], {0;1}: [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], {0;2}: [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], {1;0}: [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], {1;1}: [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], {1;2}: [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], {1;3}: [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], {2;0}: [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], {2;1}: [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], {2;2}: [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]))

# ----
panel_14 = Panel("""5000
3000
3000""")
panel_15 = Panel("""108
300
300""")
panel_16 = Panel("""212,212,212
117,172,233
104,155,235
90,139,237
76,122,239
62,105,240
48,89,242
35,72,244
21,56,245
7,39,247
255,208,0""")
panel_17 = Panel("""9am
3pm""")
entwine_7 = Entwine(
    Branch00=ColourSwatch(SwatchColor=RGB(0, 86, 255)),
    Branch01=ColourSwatch(SwatchColor=RGB(138, 138, 138)),
    Branch02=ColourSwatch(SwatchColor=RGB(255, 200, 0)),
    FlattenInputs=True)
viewer = ParamViewer(data)
series = Series(Start=Slider(0, range=0..100), Step=Slider(2, range=0..10), Count=Slider(135, range=0..1000))
branch_3 = TreeBranch(Tree=data, Path=series, MaintainPaths=True)
viewer_2 = ParamViewer(branch_3)
column_headings = Panel("""Level
Zone
Daylit Area (sqm)
Total Area (sqm)
Daylit Area (%)""")
tb = CreateTextBlock(Text="Daylit Area Percentage", TextSize=Slider(20, range=0..100), Justification=0)
directory = Panel("F:\Computational\Daylighting\Results\")
bool = Boolean(Toggle(False))
directory_2 = Panel("A:\Desktop\alt\")
directory_3 = Panel("A:\Desktop\alt")
number_slider_2 = Slider(8000, range=0..10000)
number_slider_3 = Slider(5000, range=0..10000)
number_slider_4 = Slider(1000, range=0..1000)
toggle_2 = BooleanToggle(True)
swatch = ColourSwatch(SwatchColor=RGB(7, 39, 247))
swatch_2 = ColourSwatch(SwatchColor=RGB(255, 255, 255))
swatch_3 = ColourSwatch(SwatchColor=RGB(255, 208, 0))

window_width = Panel("800")
window_height = Panel("540")

panel_18 = Panel("Select Floor for Inspection ")
pan = Panel("""Geometry Input    
Geometry View    
Materials    
Recipe    
Run    
Results   """)
label_13 = CreateLabel(LabelText=panel_18, LabelSize=expr("x*0.9", 18), Justification=0)
launchwin = LaunchWindow(
    Show=Toggle(True),
    Name="Daylighting Analyser - Vishal | Anurag ©",
    Width=window_width,
    Height=window_height,
    ChildStatus=1,
    EnableHorizScroll=False)
slider = CreateSlider(Slider=Slider(4, range=0..10), ShowBounds=False, showLabel=True, ShowTicks=False, ShowTooltip=False, ShowValLabel=True)
values_17 = ValueListener(Elements=slider, SomeProperty=True)  # -> Values, Indices
panel_19 = Panel(values_17.Values)

number_slider_5 = Slider(1, range=0..1)
num_2 = Number(number_slider_5)
Z = UnitZ(Factor=num_2)
rev = Reverse(Vector=Z)
multiplication = Multiplication(A=number_slider_5, B=2)
multiplication_2 = Multiplication(A=rev, B=2)
Z_2 = UnitZ(Factor=multiplication)

txt_3 = Text("0")
txt_4 = Text("1")

if_shading_doesn_t_work = BooleanToggle(True)

button = Button()

# ---- group: SUBTAB_T0
num_3 = Number(panel_2)
num_4 = Number(panel_3)
addition = Addition(A=num_3, B=num_4)
true_button = CreateTrueOnlyButton(ButtonName="Commit Changes", ButtonStyle=0)
true_button_2 = CreateTrueOnlyButton(ButtonName="Create HBzones", ButtonStyle=0)
dup = DuplicateData(Data="Floor Height     ", Number=addition, Order=True)
dup_2 = DuplicateData(Data="4", Number=addition, Order=True)
dup_3 = DuplicateData(Data="Level Elevation ", Number=addition, Order=True)
toggle_3 = BooleanToggle(False)
textbox_28 = CreateTextBox(Label=dup, DefaultText=dup_2, UpdateButton=toggle_3, showLabel=True)
values_18 = ValueListener(Elements=true_button, SomeProperty=True)  # -> Values, Indices
values_19 = ValueListener(Elements=true_button_2, SomeProperty=True)  # -> Values, Indices
values_20 = ValueListener(Elements=textbox_28, Trigger=values_18.Values, SomeProperty=False)  # -> Values, Indices

# ---- group: FloorHeight
data_5 = Data(values_20.Values)

data_6 = Data(data_5)

# ----
create_hb_zones = Boolean(values_19.Values)

floor_heights = Data(data_6)
floor_heights_2 = Data(floor_heights)
Z_3 = UnitZ(Factor=floor_heights_2)

floor_heights_3 = Data(data_6)
floor_heights_4 = Data(floor_heights_3)
Z_4 = UnitZ(Factor=floor_heights_4)

floor_heights_5 = Data(data_6)
floor_heights_6 = Data(floor_heights_5)
Z_5 = UnitZ(Factor=floor_heights_6)

floor_heights_7 = Data(data_6)
floor_heights_8 = Data(floor_heights_7)
Z_6 = UnitZ(Factor=floor_heights_8)

floor_heights_9 = Data(data_6)
floor_heights_10 = Data(floor_heights_9)
subtraction = Subtraction(A=floor_heights_10, B=number_slider_5)
Z_7 = UnitZ(Factor=subtraction)

floor_heights_11 = Data(data_6)
floor_heights_12 = Data(floor_heights_11)
floor_heights_13 = Data(floor_heights_12)
Z_8 = UnitZ(Factor=floor_heights_13)

floor_heights_14 = Data(data_6)
floor_heights_15 = Data(floor_heights_14)

# ---- group: SUBTAB_T1
panel_20 = Panel("""0.1
3.25
0.5
1.52""")
panel_21 = Panel("""Sill Level             
Window Height  
VLT Value            
Refractive Index  """)
values_21 = ValueListener(Elements=textbox_3, SomeProperty=True)  # -> Values, Indices
series_2 = Series(Start=1, Step=1, Count=values_21.Values)
int = Integer(series_2)
label_14 = CreateLabel(LabelText="Enter Window Properties", LabelSize=expr("x*0.9", 18), Justification=0)
concat = Concatenate(FragmentA="Window Type ", FragmentB=int)
dup_4 = DuplicateData(Data=panel_21, Number=values_21.Values, Order=True)
dup_5 = DuplicateData(Data=panel_20, Number=values_21.Values, Order=True)
label_15 = CreateLabel(LabelText=concat, LabelSize=expr("x*0.75", 18), Justification=0)
textbox_29 = CreateTextBox(Label=dup_4, DefaultText=dup_5, UpdateButton=Toggle(False), showLabel=True)
true_button_3 = CreateTrueOnlyButton(ButtonName="Create Windows", ButtonStyle=0)
true_button_4 = CreateTrueOnlyButton(ButtonName="Commit Changes", ButtonStyle=0)
values_22 = ValueListener(Elements=true_button_4, SomeProperty=True)  # -> Values, Indices
window_values = ValueListener(Elements=textbox_29, Trigger=values_22.Values, SomeProperty=False)  # -> Values, Indices
values_23 = ValueListener(Elements=true_button_3, SomeProperty=True)  # -> Values, Indices

# ---- group: SUBTAB_T1 / Multilevel Weaving
panel_22 = Panel("""0
1
1
1
1""")
weave = Weave(Pattern=panel_22, Stream0=label_15, Stream1=textbox_29, NullGaps=False)

# ---- group: SUBTAB_T1 (continued)
entwine_8 = Entwine(Branch00=label_14, Branch01=label_15, Branch02=weave, Branch03=true_button_4, Branch04=true_button_3, FlattenInputs=True)

# ----
onoff = EnableDisableObject(Enabled=values_23.Values, AllObjects_Object=addhbglz)

window_types = Data(window_values.Values)

window_types_2 = Data(window_types)
window_types_3 = Data(window_types_2)
lng = ListLength(List=flatten(window_types_3))
number_of_windows = Number(expr("x/4", lng))
number_of_windows_2 = Number(number_of_windows)
number_of_windows_3 = Number(number_of_windows_2)
int_2 = Integer(number_of_windows_3)
series_3 = Series(Start=1, Step=1, Count=int_2)
int_3 = Integer(series_3)
window_types_4 = Data(window_types_2)
path_mapper = PathMapper(window_types_4, source="{a}(i)", target="{0;floor(a/4)}")
flip = FlipMatrix(Data=path_mapper)
window_data = ExplodeTree(Data=flip)  # -> Branch0, Branch1, flatten(Branch2), flatten(Branch3)
number_of_windows_4 = Number(number_of_windows_2)
number_of_windows_5 = Number(number_of_windows_2)
path_mapper_2 = PathMapper(window_data.Branch0, source="{0;1}", target="{0}")
path_mapper_3 = PathMapper(window_data.Branch1, source="{0;1}", target="{0}")
int_4 = Integer(number_of_windows_4)
series_4 = Series(Start=1, Step=1, Count=number_of_windows_4)
data_7 = Data(graft(path_mapper_3))
data_8 = Data(graft(path_mapper_2))
int_5 = Integer(series_4)
number_of_windows_6 = Number(number_of_windows_2)
concat_2 = Concatenate(FragmentA="winType", FragmentB=int_5)
data_9 = Data(window_data.Branch3)
data_10 = Data(window_data.Branch2)
number_of_windows_7 = Number(number_of_windows_2)
radglassmaterial = Honeybee_RadianceGlassMaterial(materialName=concat_2, RTransmittance=data_10, GTransmittance=data_10, BTransmittance=data_10, refractiveIndex=data_9)  # -> avrgTrans, RADMaterial; plug-in component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
dup_6 = DuplicateData(Data=data_7, Number=number_of_windows_6, Order=True)
dup_7 = DuplicateData(Data=data_8, Number=number_of_windows_7, Order=True)
flip_2 = FlipMatrix(Data=dup_6)
flip_3 = FlipMatrix(Data=dup_7)
flip_4 = FlipMatrix(Data=radglassmaterial.RADMaterial)
path_mapper_4 = PathMapper(flip_2, source="{A;B;C}(i)", target="{B;(i)}")
path_mapper_5 = PathMapper(flip_3, source="{A;B;C}(i)", target="{B;(i)}")
Z_9 = UnitZ(Factor=path_mapper_5)  # -> graft(UnitVector)
Z_10 = UnitZ(Factor=path_mapper_4)  # -> graft(UnitVector)

# ---- group: SUBTAB_T2
panel_23 = Panel("""Height from floor
Thickness            
Reflectance          
Roughness           
Specularity          """)
panel_24 = Panel("""2.8
0.25
0.6
0.05
0""")
values_24 = ValueListener(Elements=textbox_4, SomeProperty=True)  # -> Values, Indices
series_5 = Series(Start=1, Step=1, Count=values_24.Values)
int_6 = Integer(series_5)
concat_3 = Concatenate(FragmentA="Horizontal Shading Type ", FragmentB=int_6)
label_16 = CreateLabel(LabelText="Enter Shade Properties", LabelSize=expr("x*0.9", 18), Justification=0)
dup_8 = DuplicateData(Data=panel_23, Number=values_24.Values, Order=True)
dup_9 = DuplicateData(Data=panel_24, Number=values_24.Values, Order=True)
toggle_4 = FalseStartToggle(False)
label_17 = CreateLabel(LabelText=concat_3, LabelSize=expr("x*0.75", 18), Justification=0)
textbox_30 = CreateTextBox(Label=dup_8, DefaultText=dup_9, UpdateButton=toggle_4, showLabel=True)
true_button_5 = CreateTrueOnlyButton(ButtonName="Commit Changes", ButtonStyle=0)
values_25 = ValueListener(Elements=true_button_5, SomeProperty=True)  # -> Values, Indices
values_26 = ValueListener(Elements=textbox_30, Trigger=values_25.Values, SomeProperty=False)  # -> Values, Indices

# ---- group: SUBTAB_T2 / Multilevel Weaving
panel_25 = Panel("""0
1
1
1
1
1""")
weave_2 = Weave(Pattern=panel_25, Stream0=label_17, Stream1=textbox_30, NullGaps=False)

# ---- group: SUBTAB_T2 (continued)
entwine_9 = Entwine(Branch00=label_16, Branch01=label_17, Branch02=weave_2, Branch03=true_button_5, FlattenInputs=True)

# ----
h_shade_types = Data(values_26.Values)

h_shade_types_2 = Data(h_shade_types)
h_shade_types_3 = Data(h_shade_types_2)
lng_2 = ListLength(List=flatten(h_shade_types_3))
number_of_h_shades = Number(expr("x/5", lng_2))
number_of_hshades = Number(number_of_h_shades)
int_7 = Integer(number_of_hshades)
series_6 = Series(Start=1, Step=1, Count=int_7)
int_8 = Integer(series_6)
h_shade_types_4 = Data(h_shade_types_2)
path_mapper_6 = PathMapper(h_shade_types_4, source="{a}(i)", target="{0;floor(a/5)}")
flip_5 = FlipMatrix(Data=path_mapper_6)
window_data_2 = ExplodeTree(Data=flip_5)  # -> Branch0, Branch1, flatten(Branch2), flatten(Branch3), Branch4
number_of_h_shades_2 = Number(number_of_h_shades)
number_of_h_shades_3 = Number(number_of_h_shades)
path_mapper_7 = PathMapper(window_data_2.Branch0, source="{0;1}", target="{0}")
path_mapper_8 = PathMapper(window_data_2.Branch1, source="{0;1}", target="{0}")
int_9 = Integer(number_of_h_shades_2)
series_7 = Series(Start=1, Step=1, Count=number_of_h_shades_2)
data_11 = Data(graft(path_mapper_7))
data_12 = Data(graft(path_mapper_8))
int_10 = Integer(series_7)
concat_4 = Concatenate(FragmentA="hshadeType", FragmentB=int_10)
data_13 = Data(window_data_2.Branch3)
data_14 = Data(window_data_2.Branch4)
data_15 = Data(window_data_2.Branch2)
radopaquematerial_2 = Honeybee_RadianceOpaqueMaterial(
    materialName=concat_4,
    RReflectance=data_15,
    GReflectance=data_15,
    BReflectance=data_15,
    roughness=data_13,
    specularity=data_14)  # -> avrgRef, RADMaterial; plug-in component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
flip_6 = FlipMatrix(Data=radopaquematerial_2.RADMaterial)

# ---- group: SUBTAB_T3
values_27 = ValueListener(Elements=textbox_5, SomeProperty=True)  # -> Values, Indices
panel_26 = Panel("""Reflectance          
Roughness           
Specularity          """)
panel_27 = Panel("""0.6
0.05
0""")
series_8 = Series(Start=1, Step=1, Count=values_27.Values)
int_11 = Integer(series_8)
label_18 = CreateLabel(LabelText="Enter Shade Properties", LabelSize=expr("x*0.9", 18), Justification=0)
dup_10 = DuplicateData(Data=panel_26, Number=values_27.Values, Order=True)
concat_5 = Concatenate(FragmentA="Vertical Shading Type ", FragmentB=int_11)
label_19 = CreateLabel(LabelText=concat_5, LabelSize=expr("x*0.75", 18), Justification=0)
dup_11 = DuplicateData(Data=panel_27, Number=values_27.Values, Order=True)
toggle_5 = FalseStartToggle(False)
textbox_31 = CreateTextBox(Label=dup_10, DefaultText=dup_11, UpdateButton=toggle_5, showLabel=True)
true_button_6 = CreateTrueOnlyButton(ButtonName="Commit Changes", ButtonStyle=0)
values_28 = ValueListener(Elements=true_button_6, SomeProperty=True)  # -> Values, Indices
values_29 = ValueListener(Elements=textbox_31, Trigger=values_28.Values, SomeProperty=False)  # -> Values, Indices

panel_28 = Panel("""0
1
1
1""")
weave_3 = Weave(Pattern=panel_28, Stream0=label_19, Stream1=textbox_31, NullGaps=False)

entwine_10 = Entwine(Branch00=label_18, Branch01=label_19, Branch02=weave_3, Branch03=true_button_6, FlattenInputs=True)

# ----
v_shade_types = Data(values_29.Values)

v_shade_types_2 = Data(v_shade_types)
v_shade_types_3 = Data(v_shade_types_2)
lng_3 = ListLength(List=flatten(v_shade_types_3))
number_of_v_shades = Number(expr("x/3", lng_3))
number_of_vshades = Number(number_of_v_shades)
int_12 = Integer(number_of_vshades)
series_9 = Series(Start=1, Step=1, Count=int_12)
int_13 = Integer(series_9)
v_shade_types_4 = Data(v_shade_types_2)
path_mapper_9 = PathMapper(v_shade_types_4, source="{a}(i)", target="{0;floor(a/3)}")
flip_7 = FlipMatrix(Data=path_mapper_9)
window_data_3 = ExplodeTree(Data=flip_7)  # -> Branch0, Branch1, flatten(Branch2)
number_of_v_shades_2 = Number(number_of_v_shades)
number_of_h_shades_4 = Number(number_of_v_shades)
int_14 = Integer(number_of_v_shades_2)
series_10 = Series(Start=1, Step=1, Count=number_of_v_shades_2)
int_15 = Integer(series_10)
concat_6 = Concatenate(FragmentA="vshadeType", FragmentB=int_15)
data_16 = Data(window_data_3.Branch1)
data_17 = Data(window_data_3.Branch2)
data_18 = Data(window_data_3.Branch0)
radopaquematerial_3 = Honeybee_RadianceOpaqueMaterial(
    materialName=concat_6,
    RReflectance=data_18,
    GReflectance=data_18,
    BReflectance=data_18,
    roughness=data_16,
    specularity=data_17)  # -> avrgRef, RADMaterial; plug-in component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
flip_8 = FlipMatrix(Data=radopaquematerial_3.RADMaterial)

# ---- group: SUBTAB_T0 / Multi Level Weaving for dynamic text box creation
panel_29 = Panel("""0
1
1""")
panel_30 = Panel("""0
1""")

# ----
panel_31 = Panel("Enter Floor Range ( For Single Floor, use x to x. (eg.) For 5th Floor use 5 to 5 ) ")
python_2 = PythonScript(ag=num_3, ug=num_4)  # -> a; inputs ag: Int32, ug: Int32
# ---------- python_2: Python ----------
a = []
v = -(ug)
for i in range(ug):
    a.append(v)
    v=v+1

for j in range(ag):
    a.append(j)
# ---------- end python_2 ----------
panel_32 = Panel("""View Geometry
Walls
Windows
Roofs
Ceilings
Floors
Shading/Context
Unoccupied Zones""")
# TAB 1 GEOMETRY VIEWS
panel_33 = Panel("Select Floor for Inspection ")
data_19 = Data(["True", "False", "False", "False", "False", "False", "False", "False"])
bnd = Bounds(Numbers=python_2)
data_20 = Data(simplify(panel_32))
label_20 = CreateLabel(LabelText="Select Geometry for Inspection", LabelSize=expr("x*0.9", 18), Justification=0)
concat_7 = Concatenate(FragmentA=panel_33, FragmentA_2="( ", FragmentB=bnd, FragmentA_3=" )  ")
label_21 = CreateLabel(LabelText=panel_33, LabelSize=expr("x*0.9", 18), Justification=0)
textbox_32 = CreateTextBox(Label=panel_31, DefaultText="0", UpdateButton=True, showLabel=True)
checklist = CreateChecklist(ChecklistItems=data_20, Selected=data_19)
floor = ValueListener(Elements=textbox_32, SomeProperty=True)  # -> Values, Indices
dedomain = DeconstructDomain(Domain=bnd)  # -> Start, End
setlabel = SetLabelContents(LabelToModify=label_21, NewLabelContents=concat_7)
domain = Domain(floor.Values)
dedomain_2 = DeconstructDomain(Domain=domain)  # -> Start, End
merge_14 = Merge(Data1=label_21, Data2=textbox_32)
python_3 = PythonScript(s=dedomain_2.Start, e=dedomain_2.End, min=dedomain.Start)  # -> a; inputs s: Int32, e: Int32, min: Int32
# ---------- python_3: Python ----------
a = []

temp = abs(e-s)
start = abs(min - 0)
p = s+start
for i in range(temp+1):
    a.append(p)
    p=p+1
# ---------- end python_3 ----------
swatch_4 = ColourSwatch(SwatchColor=RGBA(33, 33, 33, 203))
swatch_5 = ColourSwatch(SwatchColor=RGBA(133, 126, 126, 203))
checkbox = ValueListener(Elements=checklist, SomeProperty=True)  # -> Values, Indices
entwine_11 = Entwine(
    Branch00=ColourSwatch(SwatchColor=RGBA(191, 191, 191, 135)),
    Branch01=ColourSwatch(SwatchColor=RGBA(255, 255, 255, 195)),
    Branch02=ColourSwatch(SwatchColor=RGBA(78, 148, 255, 173)),
    Branch03=ColourSwatch(SwatchColor=RGBA(64, 0, 0, 173)),
    Branch04=swatch_4,
    Branch05=swatch_4,
    Branch06=swatch_5,
    Branch07=swatch_5,
    FlattenInputs=True)

# ---- group: Indices of Checked
python_4 = PythonScript(x=checkbox.Values)  # -> a; inputs x: list of Boolean
# ---------- python_4: Python ----------
a = []
b = []
for i in range(len(x)):
    if x[i] == True:
        a.append(i)

if a[0] == 0:
    if len(a) >1:
        a.remove(0)
    else:
        a = []
        a = {1,2,3,4,5,6,7}
# ---------- end python_4 ----------

# ----
panel_34 = Panel("Select Floors for Simulation")
dedomain_3 = DeconstructDomain(Domain=bnd)  # -> Start, End
# TAB 4 RUN
panel_35 = Panel("To Simulate")
panel_36 = Panel("Enter Floor Range ( For Single Floor, use x to x. (eg.) For 5th Floor use 5 to 5 ) ")
label_22 = CreateLabel(LabelText=panel_35, LabelSize=expr("x*0.9", 18), Justification=0)
concat_8 = Concatenate(FragmentA=panel_34, FragmentA_2="( ", FragmentB=bnd, FragmentA_3=" )  ")
radiobtn_4 = CreateRadioButton(RadioButtonName="Whole Building", RadioButtonGroup=panel_35, InitiallySelected=Toggle(True))
radiobtn_5 = CreateRadioButton(RadioButtonName="Floor By Floor", RadioButtonGroup=panel_35, InitiallySelected=False)
label_23 = CreateLabel(LabelText=panel_34, LabelSize=expr("x*0.9", 18), Justification=0)
textbox_33 = CreateTextBox(Label=panel_36, DefaultText="0", UpdateButton=True, showLabel=True)
values_30 = ValueListener(Elements=radiobtn_5, SomeProperty=True)  # -> Values, Indices
merge_15 = Merge(Data1=label_23, Data2=textbox_33)
merge_16 = Merge(Data1=radiobtn_4, Data2=radiobtn_5)
setlabel_2 = SetLabelContents(LabelToModify=label_23, NewLabelContents=concat_8)
floor_2 = ValueListener(Elements=textbox_33, SomeProperty=True)  # -> Values, Indices
freeze_gate = StreamFreezeGate(Data=merge_15, PassingSwitch=values_30.Values, Freeze=False)
stack_13 = CreateStack(UIElements=merge_16, Horizontal=Toggle(True))
entwine_12 = Entwine(Branch00=label_22, Branch01=stack_13, Branch02=freeze_gate, FlattenInputs=True)
stack_14 = CreateStack(UIElements=entwine_12, Horizontal=Toggle(False))

concat_9 = Concatenate(FragmentA=panel_18, FragmentA_2="( ", FragmentB=bnd, FragmentA_3=" )  ")
setlabel_3 = SetLabelContents(LabelToModify=label_13, NewLabelContents=concat_9)
setslider = SetSlider(UISlider=slider, Range=bnd)

# ---- group: SUBTAB_T0 (continued)
series_11 = Series(Start=dedomain.Start, Step=1, Count=addition)
multiplication_3 = Multiplication(A=series_11, B="4")
int_16 = Integer(series_11)
int_17 = Integer(multiplication_3)
concat_10 = Concatenate(FragmentA="Level ", FragmentB=int_16)
label_24 = CreateLabel(LabelText=concat_10, LabelSize=expr("x*0.9", 18), Justification=0)
textbox_34 = CreateTextBox(Label=dup_3, DefaultText=int_17, UpdateButton=toggle_3, showLabel=True)
values_31 = ValueListener(Elements=textbox_34, Trigger=values_18.Values, SomeProperty=False)  # -> Values, Indices

# ---- group: Level_Elevation
data_21 = Data(values_31.Values)

# ----
int_18 = Integer(series_11)
int_19 = Integer(int_18)

# ---- group: Level_Elevation
data_22 = Data(data_21)

# ----
level_data = Integer(int_19)
floor_level = Data(data_22)
concat_11 = Concatenate(FragmentA="lvl", FragmentA_2=" ", FragmentA_3=level_data, FragmentA_4=" ", FragmentB="regular_internal")
dpipeline = DynamicGeometryPipeline(
    LayerFilter=concat_11,
    TypeFilter="Curve",
    NameFilter="*",
    enableFullPath=False,
    GroupByLayer=False,
    GroupByType=False,
    IncludeHidden=True,
    IncludeLocked=True,
    listenToAttriubtes=True)  # -> simplify(GeometryOut)
floor_level_2 = Data(floor_level)
regular = Curve(dpipeline)
Z_11 = UnitZ(Factor=floor_level_2)
move = Move(Geometry=regular, Motion=Z_11)  # -> Geometry, Transform
boundary = BoundarySurfaces(Edges=move.Geometry)
regular_2 = Extrude(Base=boundary, Direction=Z_4)

# ----
# Geometry Generation
level_data_2 = Integer(int_19)
floor_level_3 = Data(data_22)
concat_12 = Concatenate(FragmentA="lvl", FragmentA_2=" ", FragmentA_3=level_data_2, FragmentA_4=" ", FragmentB="regular")
dpipeline_2 = DynamicGeometryPipeline(
    LayerFilter=concat_12,
    TypeFilter="Curve",
    NameFilter="*",
    enableFullPath=False,
    GroupByLayer=False,
    GroupByType=False,
    IncludeHidden=True,
    IncludeLocked=True,
    listenToAttriubtes=True)  # -> simplify(GeometryOut)
floor_level_4 = Data(floor_level_3)
Z_12 = UnitZ(Factor=floor_level_4)
regular_3 = Curve(dpipeline_2)
move_2 = Move(Geometry=regular_3, Motion=Z_12)  # -> Geometry, Transform
boundary_2 = BoundarySurfaces(Edges=move_2.Geometry)
regular_4 = Extrude(Base=boundary_2, Direction=Z_3)

floor_level_5 = Data(data_22)
level_data_3 = Integer(int_19)
concat_13 = Concatenate(
    FragmentA="lvl",
    FragmentB=" ",
    FragmentA_2=graft(level_data_3),
    FragmentA_3=" ",
    FragmentA_4="win_type",
    FragmentB_2=" ",
    FragmentA_5=int_3)  # -> simplify(Result)
dpipeline_3 = DynamicGeometryPipeline(
    LayerFilter=concat_13,
    TypeFilter="Curve",
    NameFilter="*",
    enableFullPath=False,
    GroupByLayer=False,
    GroupByType=False,
    IncludeHidden=True,
    IncludeLocked=True,
    listenToAttriubtes=True)  # -> simplify(GeometryOut)
floor_level_6 = Data(floor_level_5)
Z_13 = UnitZ(Factor=floor_level_6)
dup_12 = DuplicateData(Data=Z_13, Number=number_of_windows_5, Order=True)  # -> simplify(graft(Data))
windows = Curve(dpipeline_3)
move_3 = Move(Geometry=windows, Motion=dup_12)  # -> Geometry, Transform
level_serese = Integer(level_data_3)
lng_4 = ListLength(List=level_serese)
dup_13 = DuplicateData(Data=flip_4, Number=lng_4, Order=True)
extr = Extrude(Base=move_3.Geometry, Direction=Z_10)
flip_9 = FlipMatrix(Data=dup_13)  # -> simplify(graft(Data))
move_4 = Move(Geometry=extr, Motion=Z_9)  # -> Geometry, Transform
clean = CleanTree(RemoveNulls=True, RemoveInvalid=True, RemoveEmpty=False, Tree=move_4.Geometry)
path_mapper_10 = PathMapper(clean, source="{A;B;C}", target="{A;B}")
lng_5 = ListLength(List=path_mapper_10)
dup_14 = DuplicateData(Data=flip_9, Number=lng_5, Order=True)
path_mapper_11 = PathMapper(dup_14, source="{A;B;C}", target="{A;B}")

level_data_4 = Integer(int_19)
floor_level_7 = Data(data_22)
concat_14 = Concatenate(FragmentA="lvl", FragmentA_2=" ", FragmentA_3=level_data_4, FragmentA_4=" ", FragmentB="internal_wall")
dpipeline_4 = DynamicGeometryPipeline(
    LayerFilter=concat_14,
    TypeFilter="Curve",
    NameFilter="*",
    enableFullPath=False,
    GroupByLayer=False,
    GroupByType=False,
    IncludeHidden=True,
    IncludeLocked=True,
    listenToAttriubtes=True)  # -> simplify(GeometryOut)
floor_level_8 = Data(floor_level_7)
regular_5 = Curve(dpipeline_4)
Z_14 = UnitZ(Factor=floor_level_8)
move_5 = Move(Geometry=regular_5, Motion=Z_14)  # -> Geometry, Transform
extr_2 = Extrude(Base=move_5.Geometry, Direction=Z_5)
clean_2 = CleanTree(RemoveNulls=True, RemoveInvalid=True, RemoveEmpty=False, Tree=extr_2)
gate = StreamGate(Stream=clean_2, Gate=button)  # -> flatten(Target0), Target1
createhbsrfs = Honeybee_createHBSrfs(geometry=[gate.Target0, gate.Target1], srfType=Slider(0, range=0..100))  # -> readMe, simplify(HBSurface); plug-in component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
match_2 = MatchTreeStructure(DataList=flatten(createhbsrfs.HBSurface), TreeMask=clean_2)
data_23 = Data(createhbsrfs.HBSurface)
filter = StreamFilter(Gate=button, Stream0=match_2, Stream1=data_23)
data_24 = Data(filter)
clean_3 = CleanTree(RemoveNulls=True, RemoveInvalid=True, RemoveEmpty=False, Tree=data_24)  # -> simplify(Tree)
path_mapper_12 = PathMapper(clean_3, source="{A}", target="{0;A}")

floor_level_9 = Data(data_22)
level_data_5 = Integer(int_19)
concat_15 = Concatenate(FragmentA="lvl", FragmentA_2=" ", FragmentA_3=level_data_5, FragmentA_4=" ", FragmentB="irregular")
dpipeline_5 = DynamicGeometryPipeline(
    LayerFilter=concat_15,
    TypeFilter="Curve",
    NameFilter="*",
    enableFullPath=False,
    GroupByLayer=False,
    GroupByType=False,
    IncludeHidden=True,
    IncludeLocked=True,
    listenToAttriubtes=True)  # -> simplify(GeometryOut)
floor_level_10 = Data(floor_level_9)
irregular = Curve(dpipeline_5)
Z_15 = UnitZ(Factor=floor_level_10)
move_6 = Move(Geometry=irregular, Motion=Z_15)  # -> Geometry, Transform
boundary_3 = BoundarySurfaces(Edges=move_6.Geometry)
irregular_2 = Extrude(Base=boundary_3, Direction=Z_6)

level_serese_2 = Integer(int_19)
floor_level_11 = Data(data_22)
floor_level_12 = Data(data_22)
level_serese_3 = Integer(int_19)
level_serese_4 = Integer(level_serese_2)
level_serese_5 = Integer(level_serese_3)
concat_16 = Concatenate(FragmentA="lvl", FragmentA_2=" ", FragmentA_3=level_serese_4, FragmentA_4=" ", FragmentB="cutout_above")
concat_17 = Concatenate(FragmentA="lvl", FragmentA_2=" ", FragmentA_3=level_serese_5, FragmentA_4=" ", FragmentB="cutout_below")
dpipeline_6 = DynamicGeometryPipeline(
    LayerFilter=concat_16,
    TypeFilter="Curve",
    NameFilter="*",
    enableFullPath=False,
    GroupByLayer=False,
    GroupByType=False,
    IncludeHidden=True,
    IncludeLocked=True,
    listenToAttriubtes=True)  # -> simplify(GeometryOut)
dpipeline_7 = DynamicGeometryPipeline(
    LayerFilter=concat_17,
    TypeFilter="Curve",
    NameFilter="*",
    enableFullPath=False,
    GroupByLayer=False,
    GroupByType=False,
    IncludeHidden=True,
    IncludeLocked=True,
    listenToAttriubtes=True)  # -> simplify(GeometryOut)
floor_level_13 = Data(floor_level_11)
floor_level_14 = Data(floor_level_12)
regular_6 = Curve(dpipeline_6)
regular_7 = Curve(dpipeline_7)
Z_16 = UnitZ(Factor=floor_level_13)
Z_17 = UnitZ(Factor=floor_level_14)
move_7 = Move(Geometry=regular_6, Motion=Z_16)  # -> Geometry, Transform
move_8 = Move(Geometry=regular_7, Motion=Z_17)  # -> Geometry, Transform
move_9 = Move(Geometry=move_7.Geometry, Motion=Z_7)  # -> Geometry, Transform
move_10 = Move(Geometry=move_8.Geometry, Motion=Z)  # -> Geometry, Transform
boundary_4 = BoundarySurfaces(Edges=move_9.Geometry)
boundary_5 = BoundarySurfaces(Edges=move_10.Geometry)
regular_8 = Extrude(Base=boundary_4, Direction=Z_2)
regular_9 = Extrude(Base=boundary_5, Direction=multiplication_2)

floor_level_15 = Data(data_22)
level_serese_6 = Integer(int_19)
level_serese_7 = Integer(int_19)
level_serese_8 = Integer(level_serese_6)
concat_18 = Concatenate(FragmentA="lvl", FragmentA_2=" ", FragmentA_3=level_serese_8, FragmentA_4=" ", FragmentB="zone_name")
dpipeline_8 = DynamicGeometryPipeline(
    LayerFilter=concat_18,
    TypeFilter="Text",
    NameFilter="*",
    enableFullPath=False,
    GroupByLayer=False,
    GroupByType=False,
    IncludeHidden=True,
    IncludeLocked=True,
    listenToAttriubtes=True)  # -> simplify(GeometryOut)
data_25 = Data(dpipeline_8)
txtobjinfo = TextObjectInfo(TextObjects=data_25)  # -> Plane, Text, Size, Alignment, VerticalAlignment
lng_6 = ListLength(List=regular_3)
floor_level_16 = Data(floor_level_15)
lng_7 = ListLength(List=flatten(data_25))  # -> flatten(Length)
merge_17 = Merge(Data1=regular_2, Data2=irregular_2)
addition_2 = Addition(A=floor_level_16, B=1)
data_26 = Data(irregular_2)

# ---- group: SUBTAB_T0 / Multi Level Weaving for dynamic text box creation (continued)
weave_4 = Weave(Pattern=panel_30, Stream0=textbox_28, Stream1=textbox_34, NullGaps=False)
weave_5 = Weave(Pattern=panel_29, Stream0=label_24, Stream1=weave_4, NullGaps=False)

# ---- group: Boolean Out Internal Zone and Unoccupied Zones
sdiff = SolidDifference(BrepsA=regular_4, BrepsB=merge_17)

# ----
data_27 = Data(regular_2)
pt = Point(txtobjinfo.Plane)
Z_18 = UnitZ(Factor=addition_2)
level_serese_9 = Integer(graft(level_serese_7))
ifcomponent = PythonScript(x=regular_4, y=sdiff)  # -> a; inputs x: Brep, y: Brep
# ---------- ifcomponent: Python ----------
if y!=None:
    a=y
else:
    a=x
# ---------- end ifcomponent ----------
move_11 = Move(Geometry=pt, Motion=Z_18)  # -> Geometry, Transform
clean_4 = CleanTree(RemoveNulls=True, RemoveInvalid=True, RemoveEmpty=False, Tree=flatten(move_11.Geometry))
geo = Geometry([regular_8, regular_9])
gate_2 = StreamGate(Stream=data_26, Gate=Toggle(True))  # -> flatten(Target0), Target1

# ---- group: Add Internal Zones
merge_18 = Merge(Data1=ifcomponent, Data2=data_27)

# ---- group: SUBTAB_T0 (continued)
entwine_13 = Entwine(Branch00=weave_5, Branch01=true_button, Branch02=true_button_2, FlattenInputs=True)

# ----
data_28 = Data(txtobjinfo.Text)
data_29 = Data(merge_18)

floor_level_17 = Data(data_22)
level_data_6 = Integer(int_19)
level_serese_10 = Integer(int_19)
concat_19 = Concatenate(FragmentA="lvl", FragmentA_2=" ", FragmentA_3=level_data_6, FragmentA_4=" ", FragmentB="zone_name")
dpipeline_9 = DynamicGeometryPipeline(
    LayerFilter=concat_19,
    TypeFilter="Text",
    NameFilter="*",
    enableFullPath=False,
    GroupByLayer=False,
    GroupByType=False,
    IncludeHidden=True,
    IncludeLocked=True,
    listenToAttriubtes=True)  # -> simplify(GeometryOut)
data_30 = Data(dpipeline_9)
txtobjinfo_2 = TextObjectInfo(TextObjects=data_30)  # -> Plane, Text, Size, Alignment, VerticalAlignment
zones = Data(flatten(data_29))
floor_level_18 = Data(floor_level_17)
data_31 = Data(zones)
lng_8 = ListLength(List=flatten(data_30))  # -> flatten(Length)
addition_3 = Addition(A=floor_level_18, B=1)
lng_9 = ListLength(List=data_31)
pt_2 = Point(txtobjinfo_2.Plane)
Z_19 = UnitZ(Factor=addition_3)
subtraction_2 = Subtraction(A=lng_9, B=lng_8)
level_serese_11 = Integer(graft(level_serese_10))
move_12 = Move(Geometry=pt_2, Motion=Z_19)  # -> flatten(Geometry), Transform
series_12 = Series(Start=lng_8, Step=1, Count=subtraction_2)
brepinc = PointInBrep(Brep=graft(zones), Point=move_12.Geometry, Strict=False)
round = Round(Number=series_12)  # -> Nearest, Floor, Ceiling
data_32 = Data(txtobjinfo_2.Text)
series_13 = Series(Start="1", Step=1, Count=subtraction_2)
round_2 = Round(Number=series_13)  # -> Nearest, Floor, Ceiling
concat_20 = Concatenate(A="lvl", spoace=" ", zone_name=level_serese_11, space=" ", B=data_32)  # -> flatten(Result)
mindex = MemberIndex(Set=brepinc, Member=Toggle(True))  # -> flatten(Index), flatten(Count)
data_33 = Data(round_2.Nearest)
concat_21 = Concatenate(FragmentA="unnamed zone", FragmentC=" ", FragmentB=data_33)  # -> flatten(Result)
txt_5 = Text(mindex.Count)
mindex_2 = MemberIndex(Set=txt_5, Member=txt_3)  # -> Index, Count
replace = ReplaceItems(List=mindex.Count, Item=round.Nearest, Indices=mindex_2.Index, Wrap=False)  # -> flatten(List)
data_34 = Data(flatten([concat_20, concat_21]))
txt_6 = Text(replace)
mindex_3 = MemberIndex(Set=txt_6, Member=txt_4)  # -> Index, Count
replace_2 = ReplaceItems(List=replace, Item=mindex.Index, Indices=mindex_3.Index, Wrap=False)
item_3 = ListItem(List=data_34, Index=replace_2, Wrap=True)
zone_names = Text(item_3)

zones_2 = Data(flatten(data_29))
data_35 = Data(zones_2)
lng_10 = ListLength(List=data_35)
subtraction_3 = Subtraction(A=lng_10, B=lng_7)
series_14 = Series(Start=lng_7, Step=1, Count=subtraction_3)
brepinc_2 = PointInBrep(Brep=graft(zones_2), Point=clean_4, Strict=False)
round_3 = Round(Number=series_14)  # -> Nearest, Floor, Ceiling
series_15 = Series(Start="1", Step=1, Count=subtraction_3)
round_4 = Round(Number=series_15)  # -> Nearest, Floor, Ceiling
createhbsrfs_2 = Honeybee_createHBSrfs(geometry=[gate_2.Target0, gate_2.Target1], srfType="6", RADMaterial=radopaquematerial.RADMaterial)  # -> readMe, simplify(HBSurface); plug-in component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

# ---- group: cutouts
data_36 = Data(geo)
trim_3 = TrimSolid(Shape=data_29, Cutters=data_36)

# ----
concat_22 = Concatenate(A="lvl", spoace=" ", zone_name=level_serese_9, space=" ", B=data_28)  # -> flatten(Result)
mindex_4 = MemberIndex(Set=brepinc_2, Member=Toggle(True))  # -> flatten(Index), flatten(Count)
data_37 = Data(round_4.Nearest)
zones_3 = Data(trim_3)
concat_23 = Concatenate(FragmentA="unnamed zone", FragmentC=" ", FragmentB=data_37)  # -> flatten(Result)
txt_7 = Text(mindex_4.Count)
zone_names_2 = Text(zone_names)

# ---- group: Unoccupied Zones
brep = Brep(createhbsrfs_2.HBSurface)

# ----
mindex_5 = MemberIndex(Set=txt_7, Member=txt)  # -> Index, Count
data_38 = Data(flatten([concat_22, concat_23]))
replace_3 = ReplaceItems(List=mindex_4.Count, Item=round_3.Nearest, Indices=mindex_5.Index, Wrap=False)  # -> flatten(List)
mass2zone = Honeybee_Masses2Zones(
    zoneMasses=flatten(zones_3),
    zoneNames=zone_names_2,
    isConditioned=Toggle(True),
    maxRoofAngle=30,
    createHBZones=create_hb_zones)  # -> readMe, HBZones; plug-in component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
txt_8 = Text(replace_3)
mindex_6 = MemberIndex(Set=txt_8, Member=txt_2)  # -> Index, Count
clean_5 = CleanTree(RemoveNulls=True, RemoveInvalid=True, RemoveEmpty=False, Tree=mass2zone.HBZones)
trim_4 = TrimTree(Tree=zones_3, Depth=1)
replace_4 = ReplaceItems(List=replace_3, Item=mindex_4.Index, Indices=mindex_6.Index, Wrap=False)
match_3 = MatchTreeStructure(DataList=flatten(clean_5), TreeMask=trim_4)
internal_walls = Data(path_mapper_12)  # disabled
item_4 = ListItem(List=data_38, Index=replace_4, Wrap=True)
addhbglz = Honeybee_addHBGlz(HBObj=[match_3, internal_walls], childSurfaces=flatten(path_mapper_10), RADMaterials=flatten(path_mapper_11))  # -> HBObjWGLZ; plug-in component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
zone_names_3 = Text(item_4)
tabs = TabbedView(
    TabNames=panel_4,
    TabTextSize=18,
    Tab0=flatten(entwine_13),
    Tab1=flatten(entwine_8),
    Tab2=flatten(entwine_9),
    Tab3=flatten(entwine_10))
match_4 = MatchTreeStructure(DataList=flatten(zone_names_3), TreeMask=match_3)
trim_5 = TrimTree(Tree=addhbglz, Depth=1)
entwine_14 = Entwine(Branch00=stack, Branch01=tabs, FlattenInputs=True)
panel_37 = Panel(match_4)
text_location = Data(move_11.Geometry)
text = Data(txtobjinfo.Text)
scale = Data(txtobjinfo.Size)
series_16 = Series(Start=0, Step=1, Count=lng_6)
round_5 = Round(Number=series_16)  # -> Nearest, Floor, Ceiling
concat_24 = Concatenate(FragmentA="Zone", FragmentB=round_5.Nearest)
tbi = TreeBranchIndex(DataTree=concat_24, BranchIndex=0)
tbi_2 = TreeBranchIndex(DataTree=lng_6, BranchIndex=0)

# ---- group: Irregular
wall = Brep(createhbsrfs_2.HBSurface)

# ----
level = PythonScript(x=tbi_2)  # -> a; inputs x: tree of Int32
# ---------- level: Python ----------
import rhinoscriptsyntax as rs
import ghpythonlib as gh
level = start
a = []
for i in x.Branches:
    for j in range(i[0]):
        if j == 0:
            a.append("Level " + str(level))
            a.append(" ")
        else:
            a.append("  ")
    level = level+1

print a
# ---------- end level ----------
zonenames = Data(tbi)
levelnames = Data(level)
flatten = FlattenTree(Tree=levelnames, Path="{0}")
ins = InsertItems(List=zonenames, Item=" ", Indices="0", Wrap=True)
lng_11 = ListLength(List=flatten)
flatten_2 = FlattenTree(Tree=ins, Path="{0}")
lng_12 = ListLength(List=flatten_2)
ins_2 = InsertItems(List=flatten, Item="Total", Indices=lng_11, Wrap=True)
ins_3 = InsertItems(List=flatten_2, Item=" ", Indices=lng_12, Wrap=True)

floor_level_19 = Data(data_22)
level_data_7 = Integer(int_19)
concat_25 = Concatenate(
    FragmentA="lvl",
    FragmentB=" ",
    FragmentA_2=graft(level_data_7),
    FragmentA_3=" ",
    FragmentA_4="vshade type",
    FragmentB_2=" ",
    FragmentA_5=int_13)  # -> simplify(Result)
dpipeline_10 = DynamicGeometryPipeline(
    LayerFilter=concat_25,
    TypeFilter="Curve",
    NameFilter="*",
    enableFullPath=False,
    GroupByLayer=False,
    GroupByType=False,
    IncludeHidden=True,
    IncludeLocked=True,
    listenToAttriubtes=True)  # -> simplify(GeometryOut)
floor_level_20 = Data(floor_level_19)
Z_20 = UnitZ(Factor=floor_level_20)
dup_15 = DuplicateData(Data=Z_20, Number=number_of_h_shades_4, Order=True)  # -> simplify(graft(Data))
windows_2 = Curve(dpipeline_10)
move_13 = Move(Geometry=windows_2, Motion=dup_15)  # -> Geometry, Transform
boundary_6 = BoundarySurfaces(Edges=move_13.Geometry)
extr_3 = Extrude(Base=boundary_6, Direction=Z_8)
lng_13 = ListLength(List=level_data_7)
dup_16 = DuplicateData(Data=flip_8, Number=lng_13, Order=True)
flip_10 = FlipMatrix(Data=dup_16)  # -> simplify(graft(Data))
path_mapper_13 = PathMapper(extr_3, source="{A;B}", target="{A;B}")

floor_level_21 = Data(data_22)
level_data_8 = Integer(int_19)
concat_26 = Concatenate(
    FragmentA="lvl",
    FragmentB=" ",
    FragmentA_2=graft(level_data_8),
    FragmentA_3=" ",
    FragmentA_4="hshade type",
    FragmentB_2=" ",
    FragmentA_5=int_8)  # -> simplify(Result)
dpipeline_11 = DynamicGeometryPipeline(
    LayerFilter=concat_26,
    TypeFilter="Curve",
    NameFilter="*",
    enableFullPath=False,
    GroupByLayer=False,
    GroupByType=False,
    IncludeHidden=True,
    IncludeLocked=True,
    listenToAttriubtes=True)  # -> simplify(GeometryOut)
floor_level_22 = Data(floor_level_21)
Z_21 = UnitZ(Factor=floor_level_22)
dup_17 = DuplicateData(Data=Z_21, Number=number_of_h_shades_3, Order=True)  # -> simplify(graft(Data))
windows_3 = Curve(dpipeline_11)
move_14 = Move(Geometry=windows_3, Motion=dup_17)  # -> Geometry, Transform
lng_14 = ListLength(List=level_data_8)
dup_18 = DuplicateData(Data=data_11, Number=flatten(lng_14), Order=True)
dup_19 = DuplicateData(Data=data_12, Number=flatten(lng_14), Order=True)
flip_11 = FlipMatrix(Data=dup_18)
flip_12 = FlipMatrix(Data=dup_19)
path_mapper_14 = PathMapper(flip_11, source="{A;B;C}(i)", target="{B;(i)}")
path_mapper_15 = PathMapper(flip_12, source="{A;B;C}(i)", target="{B;(i)}")
dup_20 = DuplicateData(Data=flip_6, Number=lng_14, Order=True)
Z_22 = UnitZ(Factor=path_mapper_15)  # -> graft(UnitVector)
Z_23 = UnitZ(Factor=path_mapper_14)  # -> graft(UnitVector)
move_15 = Move(Geometry=move_14.Geometry, Motion=Z_23)  # -> Geometry, Transform
flip_13 = FlipMatrix(Data=dup_20)  # -> simplify(graft(Data))
boundary_7 = BoundarySurfaces(Edges=move_15.Geometry)
extr_4 = Extrude(Base=boundary_7, Direction=Z_22)
clean_6 = CleanTree(RemoveNulls=True, RemoveInvalid=True, RemoveEmpty=False, Tree=extr_4)
path_mapper_16 = PathMapper(clean_6, source="{A;B;C}", target="{A;B}")

# ---- group: New Geometry
regular_10 = Brep(trim_5)

# ----
viewer_3 = ParamViewer(regular_10)

buildingbrep = Brep(regular_10)

branch_4 = TreeBranch(Tree=brep, Path=python_3, MaintainPaths=True)
branch_5 = TreeBranch(Tree=buildingbrep, Path=python_3, MaintainPaths=True)
decomposebytype = Honeybee_DecomposeBasedOnType(HBZone=branch_5)  # -> walls, interiorWalls, airWalls, windows, interiorWindows, skylights, roofs, ceilings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; plug-in component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
branch_6 = TreeBranch(Tree=simplify(entwine_11), Path=python_4, MaintainPaths=True)

# ---- group: Windows
brep_2 = Brep([decomposebytype.windows, decomposebytype.interiorWindows, decomposebytype.skylights])

# ---- group: Roof
brep_3 = Brep(decomposebytype.roofs)

# ---- group: Walls
brep_4 = Brep([decomposebytype.interiorWalls, decomposebytype.walls, decomposebytype.airWalls, decomposebytype.undergroundWalls])

# ---- group: Ceiling
brep_5 = Brep([decomposebytype.ceilings, decomposebytype.undergroundCeilings])

# ---- group: Floors
brep_6 = Brep([decomposebytype.floors, decomposebytype.exposedFloors, decomposebytype.groundFloors, decomposebytype.undergroundSlabs])

# ----
debrep = DeconstructBrep(Brep=path_mapper_16)  # -> Faces, Edges, Vertices
trim_6 = TrimTree(Tree=debrep.Faces, Depth=1)
data_39 = Data(trim_6)
flatten_if_doesnt_work = Boolean(if_shading_doesn_t_work)
gate_3 = StreamGate(Stream=data_39, Gate=flatten_if_doesnt_work)  # -> flatten(Target0), Target1

lng_15 = ListLength(List=trim_6)
dup_21 = DuplicateData(Data=flip_13, Number=lng_15, Order=True)
path_mapper_17 = PathMapper(dup_21, source="{A;B;C}", target="{A;B}")

debrep_2 = DeconstructBrep(Brep=path_mapper_13)  # -> Faces, Edges, Vertices
trim_7 = TrimTree(Tree=debrep_2.Faces, Depth=1)
data_40 = Data(trim_7)
flatten_if_doesnt_work_2 = Boolean(if_shading_doesn_t_work)
gate_4 = StreamGate(Stream=data_40, Gate=flatten_if_doesnt_work_2)  # -> flatten(Target0), Target1

lng_16 = ListLength(List=trim_7)
dup_22 = DuplicateData(Data=flip_10, Number=lng_16, Order=True)
path_mapper_18 = PathMapper(dup_22, source="{A;B;C}", target="{A;B}")

gate_5 = StreamGate(Stream=path_mapper_17, Gate=flatten_if_doesnt_work)  # -> flatten(Target0), Target1
createhbsrfs_3 = Honeybee_createHBSrfs(geometry=[gate_3.Target0, gate_3.Target1], srfType=Slider(6, range=0..10), RADMaterial=[gate_5.Target0, gate_5.Target1])  # -> readMe, simplify(HBSurface); plug-in component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
data_41 = Data(createhbsrfs_3.HBSurface)

gate_6 = StreamGate(Stream=path_mapper_18, Gate=flatten_if_doesnt_work_2)  # -> flatten(Target0), Target1
createhbsrfs_4 = Honeybee_createHBSrfs(geometry=[gate_4.Target0, gate_4.Target1], srfType=Slider(6, range=0..10), RADMaterial=[gate_6.Target0, gate_6.Target1])  # -> readMe, simplify(HBSurface); plug-in component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
data_42 = Data(createhbsrfs_4.HBSurface)

clean_7 = CleanTree(RemoveNulls=True, RemoveInvalid=True, RemoveEmpty=False, Tree=createhbsrfs_3.HBSurface)

match_5 = MatchTreeStructure(DataList=flatten(clean_7), TreeMask=data_39)
filter_2 = StreamFilter(Gate=flatten_if_doesnt_work, Stream0=match_5, Stream1=data_41)
data_43 = Data(filter_2)
clean_8 = CleanTree(RemoveNulls=True, RemoveInvalid=True, RemoveEmpty=False, Tree=data_43)  # -> simplify(Tree)
data_44 = Data(clean_8)

trim_8 = TrimTree(Tree=data_44, Depth=Slider(2, range=0..10))

clean_9 = CleanTree(RemoveNulls=True, RemoveInvalid=True, RemoveEmpty=False, Tree=createhbsrfs_4.HBSurface)

match_6 = MatchTreeStructure(DataList=flatten(clean_9), TreeMask=data_40)
filter_3 = StreamFilter(Gate=flatten_if_doesnt_work_2, Stream0=match_6, Stream1=data_42)
data_45 = Data(filter_3)
clean_10 = CleanTree(RemoveNulls=True, RemoveInvalid=True, RemoveEmpty=False, Tree=data_45)  # -> simplify(Tree)
data_46 = Data(clean_10)

trim_9 = TrimTree(Tree=data_46, Depth=Slider(2, range=0..10))

brep_7 = Brep([trim_8, trim_9])

# ---- group: New Geometry (continued)
irregular_3 = Brep(brep_7)

# ----
contextbrep = Brep(irregular_3)

gate_7 = StreamGate(Stream=brep_7, Gate=values_30.Values)  # -> Target0, Target1
domain_2 = Domain(floor_2.Values)
dedomain_4 = DeconstructDomain(Domain=domain_2)  # -> Start, End
python_5 = PythonScript(s=dedomain_4.Start, e=dedomain_4.End, min=dedomain_3.Start)  # -> a; inputs s: Int32, e: Int32, min: Int32; same code as python_3
branch_7 = TreeBranch(Tree=gate_7.Target1, Path=python_5, MaintainPaths=True)
brep_8 = Brep([branch_7, gate_7.Target0])

brep_9 = Brep([buildingbrep, contextbrep])
brep_10 = Brep(flatten(brep_9))
branch_8 = TreeBranch(Tree=contextbrep, Path=python_3, MaintainPaths=True)
_3dview = Create3DView(
    MeshToDisplay=brep_10,
    MeshColors=ColourSwatch(SwatchColor=RGBA(191, 191, 191, 135)),
    ViewWidth=expr("x-200", "900"),
    ViewHeight=350)
merge_19 = Merge(Data1=checklist, Data2=_3dview)
stack_15 = CreateStack(UIElements=merge_19, Horizontal=True)
entwine_15 = Entwine(
    Branch01=brep_4,
    Branch02=brep_2,
    Branch03=brep_3,
    Branch04=brep_5,
    Branch05=brep_6,
    Branch06=branch_8,
    Branch07=branch_4,
    FlattenInputs=True)
merge_20 = Merge(Data1=flatten(merge_14), Data2=label_20, Data3=stack_15)
branch_9 = TreeBranch(Tree=simplify(entwine_15), Path=python_4, MaintainPaths=True)
lng_17 = ListLength(List=branch_9)

# ---- group: Match no of colours with meshes
dup_23 = DuplicateData(Data=branch_6, Number=lng_17, Order=True)

# ----
set3dview = Set3DView(_3DView=_3dview, MeshToDisplay=flatten(branch_9), MeshColors=flatten(dup_23))

# ----
# 9am calculation
# 3pm calculation
weatherfile = FilePath(epw_file_path)
# Sky File
importepw = Ladybug_ImportEpw(epwFile=weatherfile)  # -> readMe, latitude, location, dryBulbTemperature, dewPointTemperature, relativeHumidity, windSpeed, windDirection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; plug-in component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
sunpath = Ladybug_SunPath(location=importepw.location, hour=12, day=21, month=12, timeStep=1, dailyOrAnnualSunPath=True)  # -> readMe, sunVectors, sunAltitudes, sunAzimuths, port, sunSpheresMesh, sunPathCrvs, compassCrvs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; plug-in component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
april = Panel("""1
2
3
4
5""")
months = Panel("""3
4""")
march = Panel("""6
7
8
9
10
11
12
13
14
15
16
17
18
19
20
21
22
23
24
25
26
27
28
29
30
31""")
months_2 = Panel("""9
10""")
oct = Panel("""1
2
3
4
5""")
sept = Panel("""6
7
8
9
10
11
12
13
14
15
16
17
18
19
20
21
22
23
24
25
26
27
28
29
30
31""")
hours = Panel("9")
hours_2 = Panel("9")
entwine_16 = Entwine(Branch00=sept, Branch01=oct, FlattenInputs=True)
entwine_17 = Entwine(Branch00=march, Branch01=april, FlattenInputs=True)
doy_hoy = Ladybug_DOY_HOY(days=entwine_17, months=simplify(graft(months)), hours=hours)  # -> flatten(HOY), DOY, flatten(date); plug-in component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
doy_hoy_2 = Ladybug_DOY_HOY(days=entwine_16, months=simplify(graft(months_2)), hours=hours_2)  # -> flatten(HOY), DOY, flatten(date); plug-in component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
strnum = Ladybug_SeparateData(inputList=flatten(importepw.directNormalRadiation))  # -> numbers, strings; plug-in component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
strnum_2 = Ladybug_SeparateData(inputList=flatten(importepw.diffuseHorizontalRadiation))  # -> numbers, strings; plug-in component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
subtraction_4 = Subtraction(A="90", B=sunpath.sunAltitudes)
_6hr = Addition(A=doy_hoy.HOY, B=6)
_6hr_2 = Addition(A=doy_hoy_2.HOY, B=6)
data_47 = Data(subtraction_4)
path_mapper_19 = PathMapper(_6hr, source="{A}", target="{1;1;0}")
path_mapper_20 = PathMapper(doy_hoy.HOY, source="{A}", target="{0;1;0}")
path_mapper_21 = PathMapper(_6hr_2, source="{A}", target="{1;1;1}")
path_mapper_22 = PathMapper(doy_hoy_2.HOY, source="{A}", target="{0;1;1}")
directnormalradiation = Data(strnum.numbers)
diffusehorizontalradiation = Data(strnum_2.numbers)
_9am_hours = Integer(path_mapper_20)
_15pm_hours = Integer(path_mapper_19)
_9am_hours_2 = Integer(path_mapper_22)
_15pm_hours_2 = Integer(path_mapper_21)
data_48 = Data([_9am_hours, _15pm_hours, _9am_hours_2, _15pm_hours_2])
directnormalradiation_wh_m2 = Number(directnormalradiation)
diffusehorizontalradiation_wh_m2 = Number(diffusehorizontalradiation)
item_5 = ListItem(List=directnormalradiation_wh_m2, Index=data_48, Wrap=True)
item_6 = ListItem(List=diffusehorizontalradiation_wh_m2, Index=data_48, Wrap=True)
python_6 = PythonScript(diffuseirradiance=item_6, directirradiance=item_5, sunzenith=data_47)  # -> skyclearness
# ---------- python_6: Python ----------
import math
skyclearness = ((diffuseirradiance + directirradiance) / (diffuseirradiance) +1.041 * sunzenith * math.pi / 180 * sunzenith * math.pi /180 * sunzenith * math.pi / 180) / (1 + 1.041 * sunzenith * math.pi / 180 *sunzenith * math.pi / 180 * sunzenith *math.pi / 180)
# ---------- end python_6 ----------
skyclearness = Data(python_6)
sort = SortList(Keys=skyclearness)  # -> Keys, ValuesA
addition_4 = Addition(A="9", B="6")
item_7 = ListItem(List=sort.Keys, Index=0, Wrap=True)  # -> Item1, Item
merge_21 = Merge(Data1="9", Data2=addition_4)
python_7 = PythonScript(x=skyclearness, y=item_7.Item1)  # -> a
# ---------- python_7: Python ----------
if x==y:
    a=True
else:
    a=False
# ---------- end python_7 ----------
cull = CullPattern(List=item_5, CullPattern=python_7)
cull_2 = CullPattern(List=item_6, CullPattern=python_7)
trim_10 = TrimTree(Tree=cull_2, Depth=1)
trim_11 = TrimTree(Tree=cull, Depth=1)
avr = Average(Input=trim_10)  # -> flatten(ArithmeticMean)
avr_2 = Average(Input=trim_11)  # -> flatten(ArithmeticMean)
item_8 = ListItem(List=avr, Index=0, Wrap=True)
item_9 = ListItem(List=avr, Index=1, Wrap=True)
item_10 = ListItem(List=avr_2, Index=0, Wrap=True)
item_11 = ListItem(List=avr_2, Index=1, Wrap=True)
int_20 = Integer(item_9)
int_21 = Integer(item_10)
int_22 = Integer(item_11)
int_23 = Integer(item_8)
directnormalradiation_wh_m2_2 = Panel(int_21)
diffusehorizontalradiation_wh_m2_2 = Panel(int_23)
directnormalradiation_wh_m2_3 = Panel(int_22)
diffusehorizontalradiation_wh_m2_3 = Panel(int_20)
gencustomsky = Honeybee_GenerateCustomSky(
    north=values_10.Values,
    locationData=importepw.location,
    directNrmRad=directnormalradiation_wh_m2_2,
    diffuseHorRad=diffusehorizontalradiation_wh_m2_2,
    month="3",
    day="21",
    hour="9")  # -> skyFilePath; plug-in component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
gencustomsky_2 = Honeybee_GenerateCustomSky(
    north=values_10.Values,
    locationData=importepw.location,
    directNrmRad=directnormalradiation_wh_m2_3,
    diffuseHorRad=diffusehorizontalradiation_wh_m2_3,
    month="3",
    day="21",
    hour="15")  # -> skyFilePath; plug-in component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
merge_22 = Merge(Data1=gencustomsky, Data2=gencustomsky_2)

bang_3 = ExplodeTree(Data=ignore_this_thing)  # -> Branch0, Branch1, Branch2, Branch3, Branch4, Branch5, Branch6
roofmaterialname = Panel("Window")
wallmaterialname = Panel("Wall")
floormaterialname = Panel("Floor")
roofmaterialname_2 = Panel("Roof")
ceilingmaterialname = Panel("Ceiling")
skylightmaterialname = Panel("Skylight")
item_12 = ListItem(List=bang_3.Branch1, Index=0, Wrap=True)  # -> Item, Item1
item_13 = ListItem(List=bang_3.Branch0, Index=0, Wrap=True)  # -> Item, Item1, Item2
item_14 = ListItem(List=bang_3.Branch5, Index=0, Wrap=True)  # -> Item, Item1
item_15 = ListItem(List=bang_3.Branch3, Index=0, Wrap=True)  # -> Item, Item1, Item2
item_16 = ListItem(List=bang_3.Branch2, Index=0, Wrap=True)  # -> Item, Item1, Item2
item_17 = ListItem(List=bang_3.Branch4, Index=0, Wrap=True)  # -> Item, Item1, Item2
radglassmaterial_2 = Honeybee_RadianceGlassMaterial(
    materialName=roofmaterialname,
    RTransmittance=item_12.Item,
    GTransmittance=item_12.Item,
    BTransmittance=item_12.Item,
    refractiveIndex=item_12.Item1)  # -> avrgTrans, RADMaterial; plug-in component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
radopaquematerial_4 = Honeybee_RadianceOpaqueMaterial(
    materialName=wallmaterialname,
    RReflectance=item_13.Item,
    GReflectance=item_13.Item,
    BReflectance=item_13.Item,
    roughness=item_13.Item1,
    specularity=item_13.Item2)  # -> avrgRef, RADMaterial; plug-in component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
radopaquematerial_5 = Honeybee_RadianceOpaqueMaterial(
    materialName=floormaterialname,
    RReflectance=item_15.Item,
    GReflectance=item_15.Item,
    BReflectance=item_15.Item,
    roughness=item_15.Item1,
    specularity=item_15.Item2)  # -> avrgRef, RADMaterial; plug-in component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
radopaquematerial_6 = Honeybee_RadianceOpaqueMaterial(
    materialName=roofmaterialname_2,
    RReflectance=item_16.Item,
    GReflectance=item_16.Item,
    BReflectance=item_16.Item,
    roughness=item_16.Item1,
    specularity=item_16.Item2)  # -> avrgRef, RADMaterial; plug-in component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
radglassmaterial_3 = Honeybee_RadianceGlassMaterial(
    materialName=skylightmaterialname,
    RTransmittance=item_14.Item,
    GTransmittance=item_14.Item,
    BTransmittance=item_14.Item,
    refractiveIndex=item_14.Item1)  # -> avrgTrans, RADMaterial; plug-in component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
radopaquematerial_7 = Honeybee_RadianceOpaqueMaterial(
    materialName=ceilingmaterialname,
    RReflectance=item_17.Item,
    GReflectance=item_17.Item,
    BReflectance=item_17.Item,
    roughness=item_17.Item1,
    specularity=item_17.Item2)  # -> avrgRef, RADMaterial; plug-in component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
setradmaterials = Honeybee_SetRadianceMaterials(
    HBObject=trim_5,
    wallRADMaterial=radopaquematerial_4.RADMaterial,
    windowRADMaterial=radglassmaterial_2.RADMaterial,
    roofRADMaterial=radopaquematerial_6.RADMaterial,
    floorRADMaterial=radopaquematerial_5.RADMaterial,
    ceilingRADMaterial=radopaquematerial_7.RADMaterial,
    skylightRADMaterial=radglassmaterial_3.RADMaterial)  # -> modifiedHBObject; plug-in component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
trim_12 = TrimTree(Tree=setradmaterials, Depth=1)  # -> simplify(Tree)
radparameters = Honeybee_RADParameters(quality=python, ab=bang_2.Branch0, ad=bang_2.Branch1, as=bang_2.Branch2, ar=bang_2.Branch3, aa=bang_2.Branch4)  # -> readMe, radParameters; plug-in component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

gate_8 = StreamGate(Stream=trim_12, Gate=values_30.Values)  # -> Target0, Target1
domain_3 = Domain(floor_2.Values)
dedomain_5 = DeconstructDomain(Domain=domain_3)  # -> Start, End
python_8 = PythonScript(s=dedomain_5.Start, e=dedomain_5.End, min=dedomain_3.Start)  # -> a; inputs s: Int32, e: Int32, min: Int32; same code as python_3
branch_10 = TreeBranch(Tree=gate_8.Target1, Path=python_8, MaintainPaths=True)
brep_11 = Brep([branch_10, gate_8.Target0])

decomposebytype_2 = Honeybee_DecomposeBasedOnType(HBZone=brep_11)  # -> walls, interiorWalls, airWalls, windows, interiorWindows, skylights, roofs, ceilings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; plug-in component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
merge_23 = Merge(
    Data1=decomposebytype_2.floors,
    Data2=decomposebytype_2.exposedFloors,
    Data3=decomposebytype_2.groundFloors,
    Data4=decomposebytype_2.undergroundSlabs)
brep_12 = Brep(merge_23)
trim_13 = TrimTree(Tree=brep_12, Depth=1)
separatebynormal = Honeybee_SeparateByNormal(geometry=trim_13)  # -> lookingUp, lookingDown, simplify(lookingSide); plug-in component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
flip_14 = Flip(Surface=separatebynormal.lookingDown)  # -> Surface, Result
merge_24 = Merge(Data1=separatebynormal.lookingUp, Data2=flip_14.Surface)
trim_14 = TrimTree(Tree=merge_24, Depth=1)
gentestpts = Honeybee_GenerateTestPoints(testGeometry=trim_14, gridSize=bang.Branch0, distBaseSrf=bang.Branch1, moveTestMesh=Toggle(True))  # -> out, simplify(testPoints), simplify(ptsVectors), simplify(facesArea), simplify(mesh); plug-in component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

textbox_35 = CreateTextBox(Label="  ", DefaultText="Run", UpdateButton=True, showLabel=True)
textbox_36 = CreateTextBox(Label=" ", DefaultText="4", UpdateButton=True, showLabel=True)
panel_38 = Panel("Select Time of Simulation")
panel_39 = Panel("Select Method of Simulation")
path_6 = FilePath("C:\ladybug")
label_25 = CreateLabel(LabelText="Select Working Directory", LabelSize=expr("x*0.9", 18), Justification=0)
radiobtn_6 = CreateRadioButton(RadioButtonName="LEED v4.1 op2    ", RadioButtonGroup=panel_39, InitiallySelected=True)
radiobtn_7 = CreateRadioButton(RadioButtonName="LEED v4 op2    ", RadioButtonGroup=panel_39, InitiallySelected=True)
filepicker_2 = CreateFilePicker(ButtonLabelText=" Browse ", DialogType=2, MustExist=True, Filter="All Files|*.*", StartingPath=path_6)
label_26 = CreateLabel(LabelText="Input RAD File Name", LabelSize=expr("x*0.9", 18), Justification=0)
values_32 = ValueListener(Elements=textbox_35, SomeProperty=True)  # -> Values, Indices
label_27 = CreateLabel(LabelText="Input No of CPUs", LabelSize=expr("x*0.9", 18), Justification=0)
values_33 = ValueListener(Elements=textbox_36, SomeProperty=True)  # -> Values, Indices
label_28 = CreateLabel(LabelText=panel_39, LabelSize=expr("x*0.9", 18), Justification=0)
radiobtn_8 = CreateRadioButton(RadioButtonName="LEED v2009 op1   ", RadioButtonGroup=panel_39, InitiallySelected=True)
label_29 = CreateLabel(LabelText=panel_38, LabelSize=expr("x*0.9", 18), Justification=0)
radiobtn_9 = CreateRadioButton(RadioButtonName="9 AM      ", RadioButtonGroup=panel_38, InitiallySelected=True)
radiobtn_10 = CreateRadioButton(RadioButtonName="3 PM", RadioButtonGroup=panel_38, InitiallySelected=False)
merge_25 = Merge(Data1=radiobtn_8, Data2=radiobtn_7, Data3=radiobtn_6)
merge_26 = Merge(Data1=radiobtn_9, Data2=radiobtn_10)
merge_27 = Merge(Data1=label_25, Data2=filepicker_2)
values_34 = ValueListener(Elements=merge_25, SomeProperty=True)  # -> flatten(Values), Indices
toggle_6 = CreateToggle(Default=False, Label="Write RAD")
toggle_7 = CreateToggle(Default=False, Label="Run RAD")
stack_16 = CreateStack(UIElements=merge_25, Horizontal=True)
values_35 = ValueListener(Elements=merge_26, SomeProperty=True)  # -> flatten(Values), Indices
stack_17 = CreateStack(UIElements=merge_26, Horizontal=True)
stack_18 = CreateStack(UIElements=merge_27, Horizontal=False)
merge_28 = Merge(Data1=toggle_6, Data2=toggle_7)
values_36 = ValueListener(Elements=merge_28, SomeProperty=True)  # -> Values, Indices
bang_4 = ExplodeTree(Data=values_36.Values)  # -> Branch0, Branch1

dispatch = Dispatch(List=merge_21, DispatchPattern=values_35.Values)  # -> ListA, ListB
genstandardciesky = Honeybee_GenerateStandardCIESky(weatherFile=weatherfile, month="9", day="21", hour=dispatch.ListA, skyType=0)  # -> skyFilePath; plug-in component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
dispatch_2 = Dispatch(List=merge_22, DispatchPattern=values_35.Values)  # -> ListA, ListB
merge_29 = Merge(Data1=genstandardciesky, Data2=dispatch_2.ListA, Data3=dispatch_2.ListA)
dispatch_3 = Dispatch(List=merge_29, DispatchPattern=values_34.Values)  # -> ListA, ListB

# ---- group: Simulation Path
values_37 = ValueListener(Elements=filepicker_2, SomeProperty=True)  # -> Values, Indices

# ----
panel_40 = Panel(values_35.Values)
entwine_18 = Entwine(
    Branch00=stack_14,
    Branch02=stack_18,
    Branch03=label_26,
    Branch04=textbox_35,
    Branch05=label_27,
    Branch06=textbox_36,
    Branch07=label_28,
    Branch08=stack_16,
    Branch09=label_29,
    Branch010=stack_17,
    Branch011=toggle_6,
    Branch012=toggle_7,
    FlattenInputs=True)

stack_19 = CreateStack(UIElements=entwine_18, Horizontal=False)

gridbasedsimulation = Honeybee_GridBasedSimulation(
    skyFile=dispatch_3.ListA,
    testPoints=gentestpts.testPoints,
    ptsVectors=gentestpts.ptsVectors,
    testMesh=gentestpts.mesh,
    simulationType=0,
    radParameters=radparameters.radParameters)  # -> analysisRecipe; plug-in component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
rundaylightanalysis = Honeybee_RunDaylightSimulation(
    HBObjects=flatten([brep_11, brep_8]),
    analysisRecipe=gridbasedsimulation,
    writeRad=bang_4.Branch0,
    runRad=bang_4.Branch1,
    numOfCPUs=values_33.Values,
    workingDir=values_37.Values,
    radFileName=values_32.Values,
    overwriteResults=Toggle(True))  # -> out, analysisType, resultsUnit, illuminance_values, testPts, resultFiles, radGeoFile, studyFolder, done; plug-in component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

dispatch_4 = Dispatch(List=panel_13, DispatchPattern=values_34.Values)  # -> ListA, ListB
dispatch_5 = Dispatch(List=panel_12, DispatchPattern=values_34.Values)  # -> ListA, ListB

# ---- group: Lower Limit
data_49 = Data(dispatch_4.ListA)

# ---- group: Higher Limit
data_50 = Data(dispatch_5.ListA)

# ----
dispatch_6 = Dispatch(List=panel_15, DispatchPattern=values_34.Values)  # -> ListA, ListB
dispatch_7 = Dispatch(List=panel_14, DispatchPattern=values_34.Values)  # -> ListA, ListB
python_9 = PythonScript(Results=results, LowerLimit=dispatch_6.ListA, HigherLimit=dispatch_7.ListA)  # -> out, a, lower, higher; inputs LowerLimit: Int32, HigherLimit: Int32
# ---------- python_9: Python ----------
if _Results<=_LowerLimit:
    a=True
    lower=False
    higher=True
elif _Results>=_HigherLimit:
    a=True
    lower=True
    higher=False
else:
    a=False
    lower=True
    higher=True
# ---------- end python_9 ----------
cullf = CullFaces(Mesh=mesh, Pattern=python_9.a)
cullf_2 = CullFaces(Mesh=mesh, Pattern=python_9.lower)
cullf_3 = CullFaces(Mesh=mesh, Pattern=python_9.higher)
trim_15 = TrimTree(Tree=cullf, Depth=1)
trim_16 = TrimTree(Tree=cullf_3, Depth=1)
trim_17 = TrimTree(Tree=cullf_2, Depth=1)
branch_11 = TreeBranch(Tree=trim_15, Path=path_5, MaintainPaths=True)
branch_12 = TreeBranch(Tree=trim_16, Path=path_4, MaintainPaths=True)
branch_13 = TreeBranch(Tree=trim_17, Path=path_3, MaintainPaths=True)
legendpar = Ladybug_LegendParameters(lowBound=dispatch_6.ListA, highBound=dispatch_7.ListA, customColors=flatten(panel_16))  # -> legendPar; plug-in component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
area = Area(Geometry=branch_12)  # -> Area, Centroid
area_2 = Area(Geometry=branch_11)  # -> Area, Centroid
area_3 = Area(Geometry=branch_13)  # -> Area, Centroid
entwine_19 = Entwine(Branch00=branch_11, Branch01=branch_13, Branch02=branch_12, FlattenInputs=True)
cull_3 = CullPattern(List=panel_17, CullPattern=values_35.Values)
daylitarea = Data(area_2.Area)
underlitarea = Data(area_3.Area)
overlitarea = Data(area.Area)
addition_5 = Addition(A=area_2.Area, B=underlitarea, C=overlitarea)

text_location_2 = Data(text_location)
text_2 = Data(text)
scale_2 = Data(scale)
brep_13 = Brep(trim_5)
time_text = Data(cull_3)
number_floor = Data(values_17.Values)
illuminance_data_all = Data(data_4)
num_lower_limit = Number(Slider(108, range=0..1000))
num_higher_limit = Number(Slider(5400, range=0..10000))
level_series = Integer(series_11)
mesh_data_all = Data(mesh_2)

lng_18 = ListLength(List=entwine_19)
recolormesh = Ladybug_RecolorMesh(
    analysisResult=flatten(branch_2),
    inputMesh=mjoin,
    lowBoundColor=ColourSwatch(SwatchColor=RGB(212, 212, 212)),
    highBoundColor=ColourSwatch(SwatchColor=RGB(255, 208, 0)),
    legendPar=legendpar,
    analysisTitle=" ",
    legendTitle="Lux values")  # -> out, newMesh, newLegend, legendBasePt, meshColors, legendColors; plug-in component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
totalarea = Data(addition_5)
daylitarea_2 = Data(daylitarea)
division = Division(A=daylitarea_2, B=totalarea)
multiplication_4 = Multiplication(A=division, B=100)
daylitpercentage = Data(multiplication_4)
branch_14 = TreeBranch(Tree=brep_13, Path=number_floor, MaintainPaths=True)
branch_15 = TreeBranch(Tree=wall, Path=number_floor, MaintainPaths=True)
dup_24 = DuplicateData(Data=entwine_7, Number=lng_18, Order=True)
number = Data(number_floor)
number_2 = Data(number_floor)
match_7 = MatchTree(Tree=illuminance_data_all, Guide=mesh_data_all)
trim_18 = TrimTree(Tree=mesh_data_all, Depth=1)
number_3 = Data(number_floor)
path_7 = DataPath(number)
round_6 = Round(Number=daylitarea_2)  # -> Nearest, Floor, Ceiling
ma = MassAddition(Input=flatten(daylitarea_2))  # -> Result, PartialResults
ma_2 = MassAddition(Input=flatten(totalarea))  # -> Result, PartialResults
decomposebytype_3 = Honeybee_DecomposeBasedOnType(HBZone=branch_14)  # -> walls, interiorWalls, airWalls, windows, interiorWindows, skylights, roofs, ceilings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; plug-in component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
round_7 = Round(Number=totalarea)  # -> Nearest, Floor, Ceiling
round_8 = Round(Number=daylitpercentage)  # -> Nearest, Floor, Ceiling
trim_19 = TrimTree(Tree=match_7, Depth=1)
branch_16 = TreeBranch(Tree=trim_18, Path=path_7, MaintainPaths=True)
path_8 = DataPath(number_3)
branch_17 = TreeBranch(Tree=text_location_2, Path=number_2, MaintainPaths=True)
branch_18 = TreeBranch(Tree=text_2, Path=number_2, MaintainPaths=True)
branch_19 = TreeBranch(Tree=scale_2, Path=number_2, MaintainPaths=True)
mjoin_2 = MeshJoin(Meshes=flatten(branch_16))
branch_20 = TreeBranch(Tree=trim_19, Path=path_8, MaintainPaths=True)
ins_4 = InsertItems(List=round_6.Nearest, Item=" ", Indices="0", Wrap=True)
ins_5 = InsertItems(List=round_7.Nearest, Item=" ", Indices="0", Wrap=True)
text_location_3 = Data(branch_17)
text_3 = Data(branch_18)
scale_3 = Data(branch_19)
ins_6 = InsertItems(List=round_8.Nearest, Item=" ", Indices="0", Wrap=True)
division_2 = Division(A=ma.Result, B=ma_2.Result)
cull_i = CullIndex(List=recolormesh.newLegend, Indices=Slider(0, range=0..100), Wrap=True)  # -> flatten(List)
flatten_3 = FlattenTree(Tree=ins_4, Path="{0}")
flatten_4 = FlattenTree(Tree=ins_5, Path="{0}")
flatten_5 = FlattenTree(Tree=ins_6, Path="{0}")
item_18 = ListItem(List=recolormesh.newLegend, Index=Slider(0, range=0..100), Wrap=True)
mesh_3 = Data(mesh_data_all)
illuminance = Data(illuminance_data_all)
mesh_1_floor = Data(mjoin_2)
illuminance_2 = Data(branch_20)
lng_19 = ListLength(List=cull_i)

# ---- group: Window
wall_2 = Brep([decomposebytype_3.windows, decomposebytype_3.interiorWindows, decomposebytype_3.skylights])

# ---- group: Floor
wall_3 = Brep([decomposebytype_3.floors, decomposebytype_3.exposedFloors, decomposebytype_3.groundFloors, decomposebytype_3.undergroundSlabs])

# ----
wall_4 = Brep([decomposebytype_3.walls, decomposebytype_3.interiorWalls, decomposebytype_3.airWalls, decomposebytype_3.undergroundWalls])
multiplication_5 = Multiplication(A=division_2, B=100)
ma_3 = MassAddition(Input=flatten(daylitarea_2))  # -> Result, PartialResults
ma_4 = MassAddition(Input=flatten(totalarea))  # -> Result, PartialResults
lng_20 = ListLength(List=flatten_3)
lng_21 = ListLength(List=flatten_4)
explode = MeshExplode(Mesh=recolormesh.newMesh, Interpolate=False)  # -> flatten(Faces)
lng_22 = ListLength(List=flatten_5)
trim_20 = TrimTree(Tree=mesh_3, Depth=1)
explode_2 = MeshExplode(Mesh=item_18, Interpolate=False)  # -> flatten(Faces)

num_higher_limit_2 = Number(num_higher_limit)
num_lower_limit_2 = Number(num_lower_limit)
panel_41 = Panel(num_higher_limit_2)
panel_42 = Panel(num_lower_limit_2)
analysis_result = Data(illuminance_2)
all_mesh = Data(mesh_1_floor)

dup_25 = DuplicateData(Data=ColourSwatch(SwatchColor=RGB(71, 69, 69)), Number=lng_19, Order=True)  # -> flatten(Data)
round_9 = Round(Number=ma_3.Result)  # -> Nearest, Floor, Ceiling
round_10 = Round(Number=ma_4.Result)  # -> Nearest, Floor, Ceiling
round_11 = Round(Number=multiplication_5)  # -> Nearest, Floor, Ceiling
merge_30 = Merge(Data1=flatten(recolormesh.meshColors), Data2=flatten(recolormesh.legendColors), Data3=flatten(dup_25))
merge_31 = Merge(Data1=explode, Data2=explode_2, Data3=cull_i)
_3dview_2 = Create3DView(MeshToDisplay=merge_31, MeshColors=merge_30, ViewWidth=300, ViewHeight=300)  # -> flatten(_3DView)
adjustpos = AdjustElementPositioning(ElementsToAdjust=_3dview_2, AbsolutePositioning=False, Width="550", Height="400")
set3dview_2 = Set3DView(_3DView=_3dview_2, MeshToDisplay=flatten(merge_31), MeshColors=flatten(merge_30))  # disabled
panel_43 = Panel(trim_20)
ins_7 = InsertItems(List=flatten_3, Item=round_9.Nearest, Indices=lng_20, Wrap=True)
ins_8 = InsertItems(List=flatten_4, Item=round_10.Nearest, Indices=lng_21, Wrap=True)
ins_9 = InsertItems(List=flatten_5, Item=round_11.Nearest, Indices=lng_22, Wrap=True)

# ---- group: inputs
num_no_of_segments = Number("11")
num_scale_of_text = Number(Slider(0.8, range=0..10))
num_analysis_result = Number(analysis_result)
color_upper_limit = Colour(ColourSwatch(SwatchColor=RGB(7, 39, 247)))
color_upper_limit_2 = Colour(ColourSwatch(SwatchColor=RGB(255, 208, 0)))
num_higher_limit_3 = Number(panel_41)
color_lower_limit = Colour(ColourSwatch(SwatchColor=RGB(255, 255, 255)))
color_lower_limit_2 = Colour(ColourSwatch(SwatchColor=RGB(144, 205, 230)))
num_lower_limit_3 = Number(panel_42)
txt_heading = Text("Lux values")
mesh_4 = Mesh(all_mesh)

# ----
zone_names_all = Text(match_4)
num_higher_limit_4 = Number(num_higher_limit)
num_lower_limit_4 = Number(num_lower_limit)
level_serese_12 = Integer(level_series)
all_mesh_2 = Mesh(mesh_3)
number_4 = Data(number_floor)
results_2 = Data(illuminance)

text_location_4 = Data(text_location_3)
time_text_2 = Data(time_text)
scale_4 = Data(scale_3)
text_4 = Data(text_3)

entwine_20 = Entwine(Branch00=ins_2, Branch01=ins_3, Branch02=ins_7, Branch03=ins_8, Branch04=ins_9, FlattenInputs=True)
viewer_4 = ParamViewer(mesh_4)
viewer_5 = ParamViewer(all_mesh_2)
panel_44 = Panel(zone_names_all)
panel_45 = Panel(entwine_20)
panel_46 = Panel(results_2)

# ---- group: legend and mesh colors / divide mesh into 3
num_analysis_result_2 = Number(num_analysis_result)
num_higher_limit_5 = Number(num_higher_limit_3)
num_lower_limit_5 = Number(num_lower_limit_3)
python_10 = PythonScript(Results=num_analysis_result_2, LowerLimit=num_lower_limit_5, HigherLimit=num_higher_limit_5)  # -> out, a, lower, higher; inputs LowerLimit: Int32, HigherLimit: Int32; same code as python_9
mesh_5 = Mesh(mesh_4)
cullf_4 = CullFaces(Mesh=mesh_5, Pattern=python_10.a)
cullf_5 = CullFaces(Mesh=mesh_5, Pattern=python_10.lower)
cullf_6 = CullFaces(Mesh=mesh_5, Pattern=python_10.higher)

# ----
python_11 = PythonScript(Results=results_2, LowerLimit=num_lower_limit_4, HigherLimit=num_higher_limit_4)  # -> out, a, lower, higher; inputs LowerLimit: Int32, HigherLimit: Int32; same code as python_9
all_mesh_3 = Mesh(all_mesh_2)
all_mesh_4 = Mesh(all_mesh_2)
all_mesh_5 = Mesh(all_mesh_2)
number_5 = Data(number_4)
cullf_7 = CullFaces(Mesh=all_mesh_4, Pattern=python_11.a)
cullf_8 = CullFaces(Mesh=all_mesh_3, Pattern=python_11.higher)
cullf_9 = CullFaces(Mesh=all_mesh_5, Pattern=python_11.lower)
number_6 = Data(number_4)
number_7 = Data(number_4)
number_8 = Data(number_4)
tbi_3 = TreeBranchIndex(DataTree=zone_names_all, BranchIndex=number_5)
trim_21 = TrimTree(Tree=cullf_7, Depth=1)
path_9 = DataPath(number_6)
trim_22 = TrimTree(Tree=cullf_8, Depth=1)
trim_23 = TrimTree(Tree=cullf_9, Depth=1)
path_10 = DataPath(number_7)
path_11 = DataPath(number_8)
zone_names_4 = Text(tbi_3)
branch_21 = TreeBranch(Tree=trim_21, Path=path_9, MaintainPaths=True)
branch_22 = TreeBranch(Tree=trim_22, Path=path_10, MaintainPaths=True)
branch_23 = TreeBranch(Tree=trim_23, Path=path_11, MaintainPaths=True)
lower = Area(Geometry=branch_23)  # -> Area, Centroid
higher = Area(Geometry=branch_22)  # -> Area, Centroid
lit = Area(Geometry=branch_21)  # -> Area, Centroid
daylitarea_3 = Data(lit.Area)
total = Addition(A=lit.Area, B=lower.Area, C=higher.Area)
totalarea_2 = Data(total)
daylitarea_4 = Data(daylitarea_3)
zonenames_2 = Data(zone_names_4)
totalarea_3 = Data(lower.Area)
totalarea_4 = Data(higher.Area)

# ---- group: legend and mesh colors / get middle result
num_analysis_result_3 = Number(num_analysis_result)
num_lower_limit_6 = Number(num_lower_limit_3)
smaller = SmallerThan(FirstNumber=num_analysis_result_3, SecondNumber=num_lower_limit_6)  # -> SmallerThan, OrEqualTo
num_higher_limit_6 = Number(num_higher_limit_3)
dispatch_8 = Dispatch(List=num_analysis_result_3, DispatchPattern=smaller.OrEqualTo)  # -> ListA, ListB
larger = LargerThan(FirstNumber=dispatch_8.ListB, SecondNumber=num_higher_limit_6)  # -> LargerThan, OrEqualTo
dispatch_9 = Dispatch(List=dispatch_8.ListB, DispatchPattern=larger.OrEqualTo)  # -> ListA, ListB

# ---- group: legend and mesh colors / legend para
num_no_of_segments_2 = Number(num_no_of_segments)
num_lower_limit_7 = Number(num_lower_limit_3)
num_higher_limit_7 = Number(num_higher_limit_3)
color_lower_limit_3 = Colour(color_lower_limit_2)
color_upper_limit_3 = Colour(color_upper_limit)
legendpar_2 = Ladybug_LegendParameters(
    lowBound=num_lower_limit_7,
    highBound=num_higher_limit_7,
    numSegments=num_no_of_segments_2,
    customColors=flatten([color_lower_limit_3, color_upper_limit_3]))  # -> legendPar; plug-in component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

# ----
irregular_4 = Data(branch_15)
datatable = CreateDataTable(Data=panel_45, ColumnHeadings=column_headings, AllowSorting=True, ColumnSizingMode=-1)

# ---- group: legend and mesh colors
recolormesh_2 = Ladybug_RecolorMesh(analysisResult=flatten(dispatch_9.ListB), inputMesh=cullf_4, legendPar=legendpar_2, analysisTitle=" ")  # -> out, newMesh, newLegend, legendBasePt, meshColors, legendColors; plug-in component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

# ----
concat_27 = Concatenate(FragmentA=round_11.Nearest, FragmentB="%")
tb_2 = CreateTextBlock(Text=concat_27, TextSize=Slider(40, range=0..100), Justification=Slider(1, range=0..3))

# ---- group: legend and mesh colors
num_no_of_segments_3 = Number(num_no_of_segments)
num_higher_limit_8 = Number(num_higher_limit_3)
num_lower_limit_8 = Number(num_lower_limit_3)
txt_heading_2 = Text(txt_heading)
panel_47 = Panel(num_lower_limit_8)
panel_48 = Panel(num_no_of_segments_3)
panel_49 = Panel(num_higher_limit_8)
round_12 = Round(Number=panel_49)  # -> Nearest, Floor, Ceiling
dom = ConstructDomain(DomainStart=panel_47, DomainEnd=panel_49)
concat_28 = Concatenate(FragmentA="> ", FragmentB=round_12.Nearest)
range = Range(Domain=dom, Steps=panel_48)  # -> flatten(Range)
panel_50 = Panel(concat_28)
round_13 = Round(Number=range)  # -> Nearest, Floor, Ceiling
data_51 = Data(reverse(["0", round_13.Nearest]))
panel_51 = Panel(txt_heading_2)
replace_5 = ReplaceItems(List=data_51, Item=panel_50, Indices="0", Wrap=False)  # -> reverse(flatten(List))
txt_9 = Text(panel_51)
data_52 = Data([replace_5, txt_9])
panel_52 = Panel(data_52)

# ----
merge_32 = Merge(Data1=tb, Data2=tb_2)

lng_23 = ListLength(List=zonenames_2)
level_serese_13 = Integer(level_serese_12)
number_9 = Data(number_4)
addition_6 = Addition(A=lng_23, B=2)
division_3 = Division(A=daylitarea_4, B=totalarea_2)
round_14 = Round(Number=daylitarea_4)  # -> Nearest, Floor, Ceiling
round_15 = Round(Number=totalarea_2)  # -> Nearest, Floor, Ceiling
round_16 = Round(Number=totalarea_3)  # -> Nearest, Floor, Ceiling
item_19 = ListItem(List=level_serese_13, Index=number_9, Wrap=True)
dup_26 = DuplicateData(Data=" ", Number=addition_6, Order=True)  # -> flatten(Data)
round_17 = Round(Number=totalarea_4)  # -> Nearest, Floor, Ceiling
multiplication_6 = Multiplication(A=division_3, B=100)
concat_29 = Concatenate(FragmentC="Level ", FragmentA=item_19)
daylitpercentage_2 = Data(multiplication_6)
number_slider_6 = Slider(0, range=0..100)
ins_10 = InsertItems(List=round_15.Nearest, Item=" ", Indices="0", Wrap=True)
ins_11 = InsertItems(List=round_16.Nearest, Item=" ", Indices="0", Wrap=True)
ins_12 = InsertItems(List=round_14.Nearest, Item=" ", Indices="0", Wrap=True)
ins_13 = InsertItems(List=zonenames_2, Item=" ", Indices="0", Wrap=True)
ins_14 = InsertItems(List=round_17.Nearest, Item=" ", Indices="0", Wrap=True)
round_18 = Round(Number=daylitpercentage_2)  # -> Nearest, Floor, Ceiling
ma_5 = MassAddition(Input=flatten(daylitarea_4))  # -> Result, PartialResults
ma_6 = MassAddition(Input=flatten(totalarea_2))  # -> Result, PartialResults
ma_7 = MassAddition(Input=flatten(totalarea_2))  # -> Result, PartialResults
ma_8 = MassAddition(Input=flatten(daylitarea_4))  # -> Result, PartialResults
ma_9 = MassAddition(Input=flatten(totalarea_3))  # -> Result, PartialResults
flatten_6 = FlattenTree(Tree=ins_10, Path="{0}")
flatten_7 = FlattenTree(Tree=ins_11, Path="{0}")
flatten_8 = FlattenTree(Tree=ins_12, Path="{0}")
ma_10 = MassAddition(Input=flatten(totalarea_4))  # -> Result, PartialResults
flatten_9 = FlattenTree(Tree=ins_13, Path="{0}")
flatten_10 = FlattenTree(Tree=ins_14, Path="{0}")
concat_30 = Concatenate(FragmentA=concat_29, FragmentB=" Total")
division_4 = Division(A=ma_5.Result, B=ma_6.Result)
replace_6 = ReplaceItems(List=dup_26, Item=concat_29, Indices=number_slider_6, Wrap=False)  # -> reverse(List)
ins_15 = InsertItems(List=round_18.Nearest, Item=" ", Indices="0", Wrap=True)
lng_24 = ListLength(List=flatten_9)
round_19 = Round(Number=ma_8.Result)  # -> Nearest, Floor, Ceiling
lng_25 = ListLength(List=flatten_8)
round_20 = Round(Number=ma_7.Result)  # -> Nearest, Floor, Ceiling
lng_26 = ListLength(List=flatten_6)
round_21 = Round(Number=ma_9.Result)  # -> Nearest, Floor, Ceiling
lng_27 = ListLength(List=flatten_7)
round_22 = Round(Number=ma_10.Result)  # -> Nearest, Floor, Ceiling
lng_28 = ListLength(List=flatten_10)
multiplication_7 = Multiplication(A=division_4, B=100)
ins_16 = InsertItems(List=flatten_9, Item=" ", Indices=lng_24, Wrap=True)
flatten_11 = FlattenTree(Tree=ins_15, Path="{0}")
ins_17 = InsertItems(List=flatten_6, Item=round_20.Nearest, Indices=lng_26, Wrap=True)
ins_18 = InsertItems(List=flatten_10, Item=round_22.Nearest, Indices=lng_28, Wrap=True)
ins_19 = InsertItems(List=flatten_8, Item=round_19.Nearest, Indices=lng_25, Wrap=True)
ins_20 = InsertItems(List=flatten_7, Item=round_21.Nearest, Indices=lng_27, Wrap=True)
round_23 = Round(Number=multiplication_7)  # -> Nearest, Floor, Ceiling
replace_7 = ReplaceItems(List=replace_6, Item=concat_30, Indices=number_slider_6, Wrap=False)  # -> reverse(List)
lng_29 = ListLength(List=flatten_11)
ins_21 = InsertItems(List=flatten_11, Item=round_23.Nearest, Indices=lng_29, Wrap=True)
lng_30 = ListLength(List=ins_16)
dup_27 = DuplicateData(Data=" ", Number=lng_30, Order=True)

stack_20 = CreateStack(UIElements=merge_32, Horizontal=Toggle(False))
stack_21 = CreateStack(UIElements=stack_20, Horizontal=True)
merge_33 = Merge(Data1=_3dview_2, Data2=stack_21)
stack_22 = CreateStack(UIElements=merge_33, Horizontal=True)
panel_53 = Panel(merge_33)

entwine_21 = Entwine(Branch00=replace_7, Branch01=ins_16, Branch02=ins_17, Branch03=ins_19, Branch04=ins_21, FlattenInputs=True)
entwine_22 = Entwine(
    Branch00=replace_7,
    Branch01=ins_16,
    Branch02=ins_17,
    Branch03=dup_27,
    Branch04=ins_19,
    Branch05=ins_18,
    Branch06=dup_27,
    Branch07=ins_17,
    FlattenInputs=True)
column_headings_2 = Panel("""Level A
Space ID B
Total floor Area E
F
Daylit Area (sqm) G
Glare area (sqm) H
 I
Daylit Area (%) j""")
column_headings_3 = Panel("""Level
Zone
Total Area (sqm)
Daylit Area (sqm)
Daylit Area (%)""")

panel_54 = Panel(replace_7)
panel_55 = Panel(ins_16)
panel_56 = Panel(entwine_21)
panel_57 = Panel(ins_17)

# ---- group: outputs
color_lower_limit_4 = Colour(color_lower_limit)
color_upper_limit_4 = Colour(color_upper_limit_2)
higher_2 = Geometry(cullf_6)
lower_2 = Geometry(cullf_5)

# ---- group: outputs / mid
analysis_mesh = Geometry(recolormesh_2.newMesh)

# ----
time_text_3 = Data(time_text_2)
panel_58 = Panel(ins_21)
concat_31 = Concatenate(FragmentA=directory, FragmentB="result", FragmentD="_", FragmentE=time_text_3, FragmentC=".xlsx")

# ---- group: outputs
color_upper_limit_5 = Colour(color_upper_limit_4)
color_lower_limit_5 = Colour(color_lower_limit_4)
higher_3 = Geometry(higher_2)
lower_3 = Geometry(lower_2)

# ---- group: outputs / mid
analysis_mesh_2 = Geometry(analysis_mesh)

# ----
text_location_5 = Data(text_location_4)
text_5 = Data(text_4)
scale_5 = Data(scale_4)
tag = TextTag3D(Location=text_location_5, Text=text_5, Size=scale_5, Colour=ColourSwatch(SwatchColor=RGB(0, 0, 0)), Justification=7)

datatable_2 = CreateDataTable(Data=entwine_21, ColumnHeadings=column_headings_3, AllowSorting=True, ColumnSizingMode=-1)

bbox = BoundingBox(Content=flatten([irregular_4, cullf_6, cullf_4, cullf_5]), Plane=PlaneXY(0, 0, 0), UnionBox=True)  # -> Box, Box_2
debox = DeconstructBox(Box=bbox.Box)  # -> Plane, X, Y, Z
dedomain_6 = DeconstructDomain(Domain=debox.X)  # -> Start, End
addition_7 = Addition(A=dedomain_6.End, B=1)
pt_3 = ConstructPoint(XCoordinate=addition_7, YCoordinate=0, ZCoordinate=0)
pt_4 = Point(pt_3)
pt_5 = Point(pt_3)

dedomain_7 = DeconstructDomain(Domain=debox.Y)  # -> Start, End
dedomain_8 = DeconstructDomain(Domain=debox.Z)  # -> Start, End
dedomain_9 = DeconstructDomain(Domain=debox.X)  # -> Start, End
number_slider_7 = Slider(-4, range=-10..0)
pt_6 = ConstructPoint(XCoordinate=dedomain_9.Start, YCoordinate=dedomain_7.Start, ZCoordinate=dedomain_8.Start)
level_serese_14 = Integer(level_series)
number_10 = Data(number_floor)
Y = UnitY(Factor=number_slider_7)
neg = Negative(Value=number_slider_7)
time_text_4 = Data(time_text_2)
item_20 = ListItem(List=level_serese_14, Index=number_10, Wrap=True)
move_16 = Move(Geometry=pt_6, Motion=Y)  # -> Geometry, Transform
division_5 = Division(A=neg, B=2)
concat_32 = Concatenate(Level="Level ", B=item_20, space=" ", A=time_text_4)
text_location_6 = Data(move_16.Geometry)
text_6 = Data(concat_32)
scale_6 = Data(division_5)

panel_59 = Panel(number_10)
panel_60 = Panel(concat_32)
file_name = Data(concat_32)
concat_33 = Concatenate(FragmentA=directory_2, FragmentB=file_name, FragmentC=".xlsx")
excelwrite = ExcelWrite(
    WriteExcelData=Toggle(True),
    WorkbookPath=concat_31,
    WorksheetName=concat_32,
    ColumnHeadings=column_headings_3,
    Data=entwine_21,
    ClearSheet=bool)
excelwrite_2 = ExcelWrite(
    WriteExcelData=False,
    WorkbookPath=concat_33,
    WorksheetName="Sheet1",
    ColumnHeadings=column_headings_2,
    Data=entwine_22,
    ClearSheet=bool)

text_location_7 = Data(text_location_6)
text_7 = Data(text_6)
scale_7 = Data(scale_6)
tag_2 = TextTag3D(Location=text_location_7, Text=text_7, Size=scale_7, Colour=ColourSwatch(SwatchColor=RGB(0, 0, 0)), Justification=7)

captureview = Ladybug_CaptureView(
    fileName=file_name,
    folder=directory_3,
    viewNames="Top",
    imageWidth=Slider(10000, range=0..10000),
    keepAspectR=toggle_2,
    transparBack=toggle_2,
    capture=bool)  # -> imagePath; plug-in component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
panel_61 = Panel(scale_7)
python_12 = PythonScript(text=text_7, textPt=text_location_7, textHeight=scale_7)  # -> out, textMesh; inputs text: list, textPt: list of Point3d
# ---------- python_12: Python ----------
import scriptcontext as sc
lb_visualization = sc.sticky["ladybug_ResultVisualization"]()
textMesh = []
for meshList in lb_visualization.text2srf(text, textPt, 'Arial', textHeight):
    textMesh.extend(meshList)
# ---------- end python_12 ----------
lng_31 = ListLength(List=python_12.textMesh)
dup_28 = DuplicateData(Data=ColourSwatch(SwatchColor=RGB(54, 49, 49)), Number=lng_31, Order=True)
entwine_23 = Entwine(
    Branch00=swatch_3,
    Branch01=swatch_3,
    Branch02=swatch,
    Branch03=swatch,
    Branch04=swatch_2,
    Branch05=swatch_2,
    Branch06=dup_28,
    FlattenInputs=True)  # -> flatten(Result)

# ---- group: legend and mesh colors / creating legend
item_21 = ListItem(List=recolormesh_2.newLegend, Index=0, Wrap=True)
faceb = FaceBoundaries(Mesh=item_21)
item_22 = ListItem(List=faceb, Index=0, Wrap=True)
rev_2 = ReverseList(List=faceb)
geo_2 = Geometry(item_22)
item_23 = ListItem(List=rev_2, Index=0, Wrap=True)
boundary_8 = BoundarySurfaces(Edges=geo_2)
geo_3 = Geometry(item_23)
boundary_9 = BoundarySurfaces(Edges=geo_3)
dim = Dimensions(Surface=boundary_8)  # -> UDimension, VDimension
size_of_box = Number(dim.UDimension)
Y_2 = UnitY(Factor=size_of_box)
rev_3 = Reverse(Vector=Y_2)
boundary_10 = Data(faceb)
area_4 = Area(Geometry=boundary_10)  # -> Area, Centroid
size_of_box_2 = Number(dim.UDimension)
division_6 = Division(A=size_of_box_2, B=2)
Y_3 = UnitY(Factor=division_6)
size_of_box_3 = Number(dim.UDimension)
rev_4 = Reverse(Vector=Y_3)
X = UnitX(Factor=size_of_box_3)
size_of_box_4 = Number(dim.UDimension)
Y_4 = UnitY(Factor=size_of_box_4)
multiplication_8 = Multiplication(A=Y_4, B=1.5)

# ---- group: legend and mesh colors / creating legend / high
move_17 = Move(Geometry=boundary_9, Motion=Y_2)  # -> Geometry, Transform

# ---- group: legend and mesh colors / creating legend / low
move_18 = Move(Geometry=boundary_8, Motion=rev_3)  # -> Geometry, Transform

# ---- group: legend and mesh colors / creating legend (continued)
area_5 = Area(Geometry=move_17.Geometry)  # -> Area, Centroid
area_6 = Area(Geometry=move_18.Geometry)  # -> Area, Centroid
data_53 = Data([area_6.Centroid, area_4.Centroid, area_5.Centroid])
move_19 = Move(Geometry=data_53, Motion=rev_4)  # -> Geometry, Transform
move_20 = Move(Geometry=move_19.Geometry, Motion=X)  # -> Geometry, Transform
item_24 = ListItem(List=reverse(move_20.Geometry), Index=0, Wrap=True)
move_21 = Move(Geometry=item_24, Motion=multiplication_8)  # -> Geometry, Transform
data_54 = Data([move_20.Geometry, move_21.Geometry])

# ---- group: outputs
num_scale_of_text_2 = Number(num_scale_of_text)
panel_62 = Panel(num_scale_of_text_2)
points_for_text_legend = Data(data_54)
text_for_legend = Data(panel_52)

color_upper_limit_6 = Colour(color_upper_limit_2)
color_lower_limit_6 = Colour(color_lower_limit)
original_boxes = Geometry(item_21)
higher_4 = Geometry(move_17.Geometry)
lower_4 = Geometry(move_18.Geometry)

# ----
bbox_2 = BoundingBox(Content=flatten([higher_4, original_boxes, lower_4]), Plane=PlaneXY(0, 0, 0), UnionBox=True)  # -> Box, Box_2
debox_2 = DeconstructBox(Box=bbox_2.Box)  # -> Plane, X, Y, Z
dedomain_10 = DeconstructDomain(Domain=debox_2.X)  # -> Start, End
pt_7 = ConstructPoint(XCoordinate=dedomain_10.Start, YCoordinate=0, ZCoordinate=0)
pt_8 = Point(pt_7)
vec2pt = Vector2Pt(PointA=pt_8, PointB=pt_5, Unitize=False)  # -> Vector, Length
X_2 = UnitX(Factor=vec2pt.Vector)

move_22 = Move(Geometry=original_boxes, Motion=X_2)  # -> Geometry, Transform
move_23 = Move(Geometry=higher_4, Motion=X_2)  # -> Geometry, Transform
move_24 = Move(Geometry=lower_4, Motion=X_2)  # -> Geometry, Transform
move_25 = Move(Geometry=points_for_text_legend, Motion=X_2)  # -> Geometry, Transform

# ---- group: outputs
num_scale_of_text_3 = Number(panel_62)
panel_63 = Panel(num_scale_of_text_3)
points_for_text_legend_2 = Data(move_25.Geometry)
swatch_6 = ColourSwatch(SwatchColor=RGB(0, 0, 0))
text_for_legend_2 = Data(text_for_legend)

color_upper_limit_7 = Colour(color_upper_limit_6)
color_lower_limit_7 = Colour(color_lower_limit_6)
original_boxes_2 = Geometry(move_22.Geometry)
higher_5 = Geometry(move_23.Geometry)
lower_5 = Geometry(move_24.Geometry)

# ---- group: preview
original_boxes_3 = Geometry(original_boxes_2)
analysis_mesh_3 = Geometry(analysis_mesh_2)
preview = CustomPreview(Geometry=higher_3, Shader=color_upper_limit_5)
preview_2 = CustomPreview(Geometry=lower_3, Shader=color_lower_limit_5)
preview_3 = CustomPreview(Geometry=higher_5, Shader=color_upper_limit_7)
preview_4 = CustomPreview(Geometry=lower_5, Shader=color_lower_limit_7)
tag_3 = TextTag3D(Location=points_for_text_legend_2, Text=text_for_legend_2, Size=panel_63, Colour=swatch_6, Justification=4)

# ----
entwine_24 = Entwine(
    Branch00=[higher_3, higher_5],
    Branch01=[analysis_mesh_3, original_boxes_3],
    Branch02=[lower_3, lower_5],
    Branch03=python_12.textMesh,
    FlattenInputs=True)  # -> flatten(Result)
_3dview_3 = Create3DView(MeshToDisplay=entwine_24, MeshColors=entwine_23, ViewWidth="700", ViewHeight=300)  # -> flatten(_3DView)
stack_23 = CreateStack(UIElements=_3dview_3, Horizontal=True)
merge_34 = Merge(Data1=label_13, Data2=slider, Data3=datatable_2, Data4=stack_23)
tabs_2 = TabbedView(
    TabNames=pan,
    TabTextSize="20",
    Tab0=flatten(entwine_14),
    Tab1=flatten(merge_20),
    Tab2=flatten(merge_9),
    Tab3=flatten(stack_12),
    Tab4=flatten(stack_19),
    Tab5=flatten(merge_34))
addelems = AddElements(Window=launchwin, Elements=flatten(tabs_2), DoVLChecking=True)  # -> AddedElements, ElementNames

walls = Data(wall_4)
irregular_5 = Data(irregular_4)
window = Data(wall_2)
floor_3 = Data(wall_3)
preview_5 = CustomPreview(Geometry=irregular_5, Shader=ColourSwatch(SwatchColor=RGB(125, 125, 125)))
preview_6 = CustomPreview(Geometry=window, Shader=ColourSwatch(SwatchColor=RGB(0, 236, 252)))
preview_7 = CustomPreview(Geometry=floor_3, Shader=ColourSwatch(SwatchColor=RGB(255, 255, 255)))

python_13 = PythonScript(planarSurfBreps=walls, thickness=Slider(0.05, range=0..0.1))  # -> out, solid; inputs planarSurfBreps: list of Brep
# ---------- python_13: Python ----------
import rhinoscriptsyntax as rs
import Rhino.Geometry as rg
import scriptcontext as sc

import clr
clr.AddReference("Grasshopper")
from Grasshopper.Kernel.Data import GH_Path
from Grasshopper import DataTree

tolerance = sc.doc.ModelAbsoluteTolerance

solid = DataTree[rg.Brep]()

i = 0
for srf in planarSurfBreps:
    path = GH_Path(i)
    i += 1
    osrf = rs.OffsetSurface(srf,thickness/2,tolerance,True,True)
    if(osrf != None):
        solid.AddRange([rs.coercebrep(osrf)], path)
        rs.DeleteObjects(osrf)
    else:
        print "offset surface failed with "+str(srf)
# ---------- end python_13 ----------

preview_8 = CustomPreview(Geometry=python_13.solid, Shader=ColourSwatch(SwatchColor=RGB(125, 125, 125)))
